# Grasshopper definition Encoder.gh (Grasshopper 1.0.8)
# plug-ins: jSwan

# ----
# Version
# Encodes geometrical and numerical data into a XtreeE toolpath object
# Input Names: → Planes
# → Layer widths [mm]
# → Layer heights [mm]
# Zones [mm]
# Flow rates [L/min]
# Primary proportions [mL/L]
# Secondary proportions [mL/L]
panel = Panel("v1.1.0")
panel_2 = Panel("Encoder")
outputnames = Panel("""Toolpath object
Status""")
block_version = Text(panel)

# ----
# Settings
panel_3 = Panel("10")
default_zone_mm = Integer(panel_3)
widths_domain_mm = Domain("10 To 50")
heights_domain_mm = Domain("5 To 15")
zones_domain_mm = Domain("0 To 1000")
flow_rates_domain_l_min = Domain("0 To 10")
secondary_proportions_domain_ml_l = Domain("0 To 15")
default_flow_rate_l_min = Number("2")
default_primary_proportion_ml_l = Number("10")
default_secondary_proportion_ml_l = Number("10")
angles_domain = Domain("0 To 100")
primary_proportions_domain_ml_l = Domain("0 To 15")

zones_mm = GetInteger(default_zone_mm, AtLeast=1, AtMost=1, Maximum=2147483647, Minimum=-2147483648, TreeAccess=True)
flow_rates_l_min = GetNumber(default_flow_rate_l_min, AtLeast=1, AtMost=1, Maximum=1.797693135e+308, Minimum=-1.797693135e+308, TreeAccess=True)
primary_proportions_ml_l = GetNumber(
    default_primary_proportion_ml_l,
    AtLeast=1,
    AtMost=1,
    Maximum=1.797693135e+308,
    Minimum=-1.797693135e+308,
    TreeAccess=True)
secondary_proportions_ml_l = GetNumber(
    default_secondary_proportion_ml_l,
    AtLeast=1,
    AtMost=1,
    Maximum=1.797693135e+308,
    Minimum=-1.797693135e+308,
    TreeAccess=True)
layer_widths_mm = GetNumber(AtLeast=1, AtMost=1, Maximum=1.797693135e+308, Minimum=-1.797693135e+308, TreeAccess=True)
planes = GetGeometry(AnnotationTypeFilter=0, AtLeast=1, AtMost=1, DeleteInput=False, Filter=1, TreeAccess=True)
layer_heights_mm = GetNumber(AtLeast=1, AtMost=1, Maximum=1.797693135e+308, Minimum=-1.797693135e+308, TreeAccess=True)
planes_2 = Plane(simplify(planes))
layer_widths_mm_2 = Number(simplify(layer_widths_mm))
flow_rates_l_min_2 = Number(simplify(flow_rates_l_min))
secondary_proportions_ml_l_2 = Number(simplify(secondary_proportions_ml_l))
layer_heights_mm_2 = Number(simplify(layer_heights_mm))
zones_mm_2 = Integer(simplify(zones_mm))
primary_proportions_ml_l_2 = Number(simplify(primary_proportions_ml_l))

# ---- group: Renumber Paths
renumber_paths = RenumberPaths(data=planes_2)
renumber_paths_2 = RenumberPaths(data=layer_widths_mm_2)
renumber_paths_3 = RenumberPaths(data=layer_heights_mm_2)
renumber_paths_4 = RenumberPaths(data=zones_mm_2)
renumber_paths_5 = RenumberPaths(data=flow_rates_l_min_2)
renumber_paths_6 = RenumberPaths(data=primary_proportions_ml_l_2)
renumber_paths_7 = RenumberPaths(data=secondary_proportions_ml_l_2)

# ---- group: Prop2 Default Value
item = ListItem(List=flatten(renumber_paths_7), Index=0, Wrap=True)
default_secondary_proportion_ml_l_2 = Number(default_secondary_proportion_ml_l)
null = NullItem(Item=item)  # -> NullFlags, InvalidFlags, Description
filter = StreamFilter(Gate=null.NullFlags, Stream0=renumber_paths_7, Stream1=default_secondary_proportion_ml_l_2)

# ---- group: Zones Default Value
# Null and Default Values
item_2 = ListItem(List=flatten(renumber_paths_4), Index=0, Wrap=True)
default_zone_mm_2 = Integer(default_zone_mm)
null_2 = NullItem(Item=item_2)  # -> NullFlags, InvalidFlags, Description
filter_2 = StreamFilter(Gate=null_2.NullFlags, Stream0=renumber_paths_4, Stream1=default_zone_mm_2)

# ---- group: Debit Default Value
item_3 = ListItem(List=flatten(renumber_paths_5), Index=0, Wrap=True)
default_flow_rate_l_min_2 = Number(default_flow_rate_l_min)
null_3 = NullItem(Item=item_3)  # -> NullFlags, InvalidFlags, Description
filter_3 = StreamFilter(Gate=null_3.NullFlags, Stream0=renumber_paths_5, Stream1=default_flow_rate_l_min_2)

# ---- group: Prop1 Default Value
item_4 = ListItem(List=flatten(renumber_paths_6), Index=0, Wrap=True)
default_primary_proportion_ml_l_2 = Number(default_primary_proportion_ml_l)
null_4 = NullItem(Item=item_4)  # -> NullFlags, InvalidFlags, Description
filter_4 = StreamFilter(Gate=null_4.NullFlags, Stream0=renumber_paths_6, Stream1=default_primary_proportion_ml_l_2)

# ----
Z = UnitZ(Factor=1)
block_version_2 = Text(block_version)
# ObjectInfo Encoding
split = TextSplit(Text=block_version_2, Separators=".")
item_5 = ListItem(List=split, Index="0", Wrap=True)  # -> Item, Item1
# Units Encoding
units = Panel("""LayerWidthsUnit
LayerHeightsUnit
ZonesUnit
MaterialFlowRatesUnit
PrimaryProportionsUnit
SecondaryProportionsUnit
VolumeUnit
PrintingTimeUnit""")
panel_4 = Panel("""mm
mm
mm
L/min
mL/L
mL/L
L
min""")
concat = Concatenate(FragmentA=item_5.Item, FragmentB=".", FragmentC=item_5.Item1)
json_version = Text(flatten(concat))
rejsonkv = SerializeKeysAndValues(Key=units, Value=panel_4)  # -> flatten(JSON)
units_2 = Data(rejsonkv)
units_3 = Data(units_2)

# ---- group: Minimum Toolpath
item_6 = ListItem(List=flatten(renumber_paths), Index=0, Wrap=True)
item_7 = ListItem(List=flatten(renumber_paths_2), Index=0, Wrap=True)
item_8 = ListItem(List=flatten(renumber_paths_3), Index=0, Wrap=True)
null_5 = NullItem(Item=item_6)  # -> NullFlags, InvalidFlags, Description
null_6 = NullItem(Item=item_8)  # -> NullFlags, InvalidFlags, Description
null_7 = NullItem(Item=item_7)  # -> NullFlags, InvalidFlags, Description

# ---- group: Minimum Toolpath / Check min data
or = GateOr(A=null_5.NullFlags, B=null_7.NullFlags, C=null_6.NullFlags)

# ---- group: Minimum Toolpath (continued)
not = GateNot(A=or)
is_min_data_provided = Boolean(not)

# ----
is_min_data_provided_2 = Boolean(is_min_data_provided)
is_min_data_provided_3 = Boolean(is_min_data_provided)
is_min_data_provided_4 = Boolean(is_min_data_provided)
is_min_data_provided_5 = Boolean(is_min_data_provided)
# Encoding conditions
filter_5 = StreamFilter(Gate=is_min_data_provided, Stream1=renumber_paths)
filter_6 = StreamFilter(Gate=is_min_data_provided, Stream1=renumber_paths_2)
filter_7 = StreamFilter(Gate=is_min_data_provided, Stream1=renumber_paths_3)
filter_8 = StreamFilter(Gate=is_min_data_provided_3, Stream1=filter_3)
filter_9 = StreamFilter(Gate=is_min_data_provided_5, Stream1=filter_2)
filter_10 = StreamFilter(Gate=is_min_data_provided_2, Stream1=filter_4)
filter_11 = StreamFilter(Gate=is_min_data_provided_4, Stream1=filter)
primary_proportions = Data(filter_10)
zones = Data(filter_9)
planes_3 = Data(filter_5)
flow_rates = Data(filter_8)
widths = Data(filter_6)
heights = Data(filter_7)
secondary_proportions = Data(filter_11)
secondary_proportions_2 = Data(secondary_proportions)
flow_rates_2 = Data(flow_rates)
primary_proportions_2 = Data(primary_proportions)
zones_2 = Data(zones)

# ---- group: Check tree structure
python = GhPythonScript(
    planes=planes_3,
    widths=widths,
    heights=heights,
    zones=zones_2,
    flowrates=flow_rates_2,
    primaryprops=primary_proportions_2,
    secondaryprops=secondary_proportions_2)  # -> out, Validation, Message; inputs planes: tree, widths: tree, heights: tree, zones: tree, flowrates: tree, primaryprops: tree, secondaryprops: tree
# ---------- python: Python ----------
import ghpythonlib.treehelpers as th

ToolpathValues = [widths, heights, zones, flowrates, primaryprops, secondaryprops]
ToolpathNames = ["Layer widths", "Layer heights", "Zones", "Flow rates", "Primary proportions", "Secondary proportions"]
GoodPathLength = []
GoodValuesLength = []
message = ["FAILURE : There is a problem with :"]
v = [1] # 1 value list to check against too ToolpathValues, to get True when we get a single value

def GetPathLengths(Data):
    LayerLength = []
    NofLayers = Data.BranchCount
    for b in Data.Branches:
        LayerLength.append(len(b))
    return NofLayers, LayerLength

def NumOfLayers(Main, ToCheck):
    return GetPathLengths(Main)[0] == GetPathLengths(ToCheck)[0] or GetPathLengths(ToCheck)[0] == 1

def NumOfValuesInLayers(Main, ToCheck):
    return GetPathLengths(Main)[1] == GetPathLengths(ToCheck)[1] or GetPathLengths(ToCheck)[1] == v

for List in ToolpathValues:
    GoodPathLength.append(NumOfLayers(planes, List))

for List in ToolpathValues:
    GoodValuesLength.append(NumOfValuesInLayers(planes, List))

if all(GoodPathLength) == False:
    for i in range(len(GoodPathLength)):
        if GoodPathLength[i] is False:
             message.append("The number of branches in " + ToolpathNames[i] + " is different")

if all(GoodValuesLength) == False:
    for i in range(len(GoodValuesLength)):
        if GoodValuesLength[i] is False:
             message.append("The number of items in " + ToolpathNames[i] + " is different")

Validation = not(all(GoodPathLength) and all(GoodValuesLength))

Message = message
# ---------- end python ----------

# ----
flow_rates_3 = Data(flatten(flow_rates))
widths_2 = Data(flatten(widths))
heights_2 = Data(flatten(heights))
tree_structure_error = Text(python.Message)
not_2 = GateNot(A=python.Validation)
planes_4 = Data(planes_3)
is_tree_structure_validated = Boolean(not_2)
deplane = DeconstructPlane(Plane=planes_4)  # -> Origin, XAxis, YAxis, ZAxis
points = Point(flatten(deplane.Origin))
angle = Angle(VectorA=deplane.ZAxis, VectorB=Z)  # -> Angle, Reflex
secondary_proportions_3 = Data(secondary_proportions)
primary_proportions_3 = Data(primary_proportions)
normals_angle = Data(angle.Angle)
flow_rates_4 = Data(flow_rates)
widths_3 = Data(widths)
heights_3 = Data(heights)
zones_3 = Data(zones)

# ----
# Rounding
# Validity domain
# Variable evaluation
c_script = CSharpScript(planes=planes_4)  # -> origins, normals; inputs planes: tree of Plane
# ---------- c_script: C# ----------
    DataTree<string> OriginTree = new DataTree<string>();
    DataTree<string> NormalTree = new DataTree<string>();

    //Gets plane Origin and rounds the coordinates
    for(int i = 0; i < planes.BranchCount ;i++)
    {
      for(int j = 0; j < planes.Branch(i).Count;j++){
        string Point = String.Format("{0:0.0},{1:0.0},{2:0.0}", planes.Branch(i)[j].OriginX, planes.Branch(i)[j].OriginY, planes.Branch(i)[j].OriginZ);
        OriginTree.Add(Point, new GH_Path(i));
        
        Vector3d Nvector = planes.Branch(i)[j].Normal;
        Nvector.Unitize();
        string Vector = String.Format("{0:0.000},{1:0.000},{2:0.000}", Nvector.X, Nvector.Y, Nvector.Z);
        NormalTree.Add(Vector, new GH_Path(i));
      }
    }

    //Origin and Vector to string
    origins = OriginTree;
    normals = NormalTree;
# ---------- end c_script ----------

secondary_proportions_domain_ml_l_2 = Domain(secondary_proportions_domain_ml_l)
default_secondary_proportion_ml_l_3 = Number(default_secondary_proportion_ml_l)
primary_proportions_domain_ml_l_2 = Domain(primary_proportions_domain_ml_l)
default_primary_proportion_ml_l_3 = Number(default_primary_proportion_ml_l)
flow_rates_domain_l_min_2 = Domain(flow_rates_domain_l_min)
default_flow_rate_l_min_3 = Number(default_flow_rate_l_min)
cluster = Cluster_3(
    values=flow_rates_4,
    digits="2",
    name="Flow rates",
    domain=flow_rates_domain_l_min_2,
    default_value=default_flow_rate_l_min_3)  # -> values_2, nominal_value, B, message
cluster_2 = Cluster_3(
    values=primary_proportions_3,
    digits="2",
    name="Primary proportions",
    domain=primary_proportions_domain_ml_l_2,
    default_value=default_primary_proportion_ml_l_3)  # -> values_2, nominal_value, B, message
cluster_3 = Cluster_3(
    values=secondary_proportions_3,
    digits="2",
    name="Secondary proportions",
    domain=secondary_proportions_domain_ml_l_2,
    default_value=default_secondary_proportion_ml_l_3)  # -> values_2, nominal_value, B, message

and = GateAnd(A=is_min_data_provided, B=is_tree_structure_validated)

angles_domain_2 = Domain(angles_domain)
cluster_4 = Cluster_4(value=c_script.normals, num=normals_angle, name="Orientations", domain=angles_domain_2)  # -> values, nominal_value, B, message

heights_domain_mm_2 = Domain(heights_domain_mm)
widths_domain_mm_2 = Domain(widths_domain_mm)
cluster_5 = Cluster_2(num=widths_3, digits="1", name="Layer widths", domain=widths_domain_mm_2)  # -> values, nominal_value, B, message
cluster_6 = Cluster_2(num=heights_3, digits="1", name="Layer heights", domain=heights_domain_mm_2)  # -> values, nominal_value, B, message

zones_domain_mm_2 = Domain(zones_domain_mm)
default_zone_mm_3 = Integer(default_zone_mm)
cluster_7 = Cluster(values=zones_3, name="Zones", domain=zones_domain_mm_2, default_value=default_zone_mm_3)  # -> values_2, nominal_value, bool_2, message

is_encoding_possible = Boolean(and)
warning_secondary_proportions = Text(cluster_3.message)
warning_primary_proportions = Text(cluster_2.message)
warning_widths = Text(cluster_5.message)
warning_flow_rates = Text(cluster.message)
warning_heights = Text(cluster_6.message)
warning_normals = Text(cluster_4.message)
warning_zones = Text(cluster_7.message)
normalvectors_nominal = Data(cluster_4.nominal_value)
filter_12 = StreamFilter(Gate=cluster_4.B, Stream1=cluster_4.values)
layerwidths_nominal = Data(cluster_5.nominal_value)
filter_13 = StreamFilter(Gate=cluster_5.B, Stream1=cluster_5.values)
layerheights_nominal = Data(cluster_6.nominal_value)
filter_14 = StreamFilter(Gate=cluster_6.B, Stream1=cluster_6.values)
zones_nominal = Data(cluster_7.nominal_value)
materialflowrates_nominal = Data(cluster.nominal_value)
filter_15 = StreamFilter(Gate=cluster.B, Stream1=cluster.values_2)
filter_16 = StreamFilter(Gate=cluster_3.B, Stream1=cluster_3.values_2)
filter_17 = StreamFilter(Gate=cluster_7.bool_2, Stream1=cluster_7.values_2)
primaryproportions_nominal = Data(cluster_2.nominal_value)
secondaryproportions_nominal = Data(cluster_3.nominal_value)
filter_18 = StreamFilter(Gate=cluster_2.B, Stream1=cluster_2.values_2)
layerwidths_toolpath = Data(filter_13)
normalvectors_toolpath = Data(filter_12)
layerheights_toolpath = Data(filter_14)
positions_toolpath = Data(c_script.origins)
secondaryproportions_toolpath = Data(filter_16)
materialflowrates_toolpath = Data(filter_15)
primaryproportions_toolpath = Data(filter_18)
zones_toolpath = Data(filter_17)
or_2 = GateOr(A=cluster.B, B=cluster_2.B, C=cluster_3.B)
any_variable_flow = Boolean(or_2)
secondaryproportions_toolpath_2 = Data(secondaryproportions_toolpath)
primaryproportions_toolpath_2 = Data(primaryproportions_toolpath)
materialflowrates_toolpath_2 = Data(materialflowrates_toolpath)
normalvectors_toolpath_2 = Data(normalvectors_toolpath)
layerheights_toolpath_2 = Data(layerheights_toolpath)
layerwidths_toolpath_2 = Data(layerwidths_toolpath)
secondaryproportions_nominal_2 = Data(secondaryproportions_nominal)
positions_toolpath_2 = Data(positions_toolpath)
primaryproportions_nominal_2 = Data(primaryproportions_nominal)
materialflowrates_nominal_2 = Data(materialflowrates_nominal)
zones_toolpath_2 = Data(zones_toolpath)
# ToolpathDataRange Encoding
normalvectors_nominal_2 = Data(normalvectors_nominal)
layerheights_nominal_2 = Data(layerheights_nominal)
layerwidths_nominal_2 = Data(layerwidths_nominal)
zones_nominal_2 = Data(zones_nominal)

# ---- group: Blocking Message
tree_structure_error_2 = Text(python.Message)
is_tree_structure_validated_2 = Boolean(is_tree_structure_validated)
is_min_data_provided_6 = Boolean(is_min_data_provided)
join = TextJoin(Text=tree_structure_error_2)
filter_19 = StreamFilter(Gate=is_min_data_provided_6, Stream0="At least one required data is not provided.")
filter_20 = StreamFilter(Gate=is_tree_structure_validated_2, Stream0=join)
entwine = Entwine(Branch00=filter_19, Branch01=filter_20, FlattenInputs=True)  # -> flatten(Result)
success = Panel("Toolpath object was created successfully.")
is_encoding_possible_2 = Boolean(is_encoding_possible)
filter_21 = StreamFilter(Gate=is_encoding_possible_2, Stream0=entwine, Stream1=success)

# ----
# Toolpath Encoding
rejson = SerializeJson(
    Positions=simplify(positions_toolpath_2),
    NormalVectors=simplify(normalvectors_toolpath_2),
    LayerWidths=simplify(layerwidths_toolpath_2),
    LayerHeights=simplify(layerheights_toolpath_2),
    Zones=simplify(zones_toolpath_2),
    MaterialFlowRates=simplify(materialflowrates_toolpath_2),
    PrimaryProportions=simplify(primaryproportions_toolpath_2),
    SecondaryProportions=simplify(secondaryproportions_toolpath_2),
    IncludeNullAndEmptyProperties=True)  # -> simplify(JSON)
tstat = TreeStatistics(Tree=rejson)  # -> Paths, Length, Count
subtraction = Subtraction(A=tstat.Count, B=1)
txt = Text(simplify(graft(tstat.Paths)))
bool = Boolean(subtraction)
rejsonkv_2 = SerializeKeysAndValues(Key=flatten(txt), Value=flatten(rejson))  # -> flatten(JSON)
gate = StreamGate(Stream=rejson, Gate=bool)  # -> Target0, Target1
rejson_2 = SerializeJson(_0=gate.Target0, IncludeNullAndEmptyProperties=False)
filter_22 = StreamFilter(Gate=bool, Stream0=rejson_2, Stream1=rejsonkv_2)
toolpath = Data(filter_22)

entwine_2 = Entwine(
    Branch00=normalvectors_nominal_2,
    Branch01=layerwidths_nominal_2,
    Branch02=layerheights_nominal_2,
    Branch03=zones_nominal_2,
    Branch04=materialflowrates_nominal_2,
    Branch05=primaryproportions_nominal_2,
    Branch06=secondaryproportions_nominal_2,
    FlattenInputs=True)  # -> flatten(Result)
toolpath_data_range = Panel("""NormalVectors
LayerWidths
LayerHeights
Zones
MaterialFlowRates
PrimaryProportions
SecondaryProportions""")
panel_5 = Panel(entwine_2)

any_variable_flow_2 = Boolean(any_variable_flow)
filter_23 = StreamFilter(Gate=any_variable_flow_2, Stream0="v3 or v4", Stream1="v4 only")  # -> flatten(Stream)
rejson_3 = SerializeJson(EncodingVersion=json_version, Accessibility=filter_23, IncludeNullAndEmptyProperties=True)  # -> flatten(JSON)
rejsonkv_3 = SerializeKeysAndValues(Key=toolpath_data_range, Value=panel_5)  # -> flatten(JSON)
objectinfo = Data(rejson_3)
toolpathdatarange = Data(rejsonkv_3)
warning_secondary_proportions_2 = Text(warning_secondary_proportions)
warning_primary_proportions_2 = Text(warning_primary_proportions)
warning_flow_rates_2 = Text(warning_flow_rates)
warning_normals_2 = Text(warning_normals)
warning_heights_2 = Text(warning_heights)
warning_widths_2 = Text(warning_widths)
warning_zones_2 = Text(warning_zones)

# ---- group: Validation Message
entwine_3 = Entwine(
    Branch00=warning_normals_2,
    Branch01=warning_widths_2,
    Branch02=warning_heights_2,
    Branch03=warning_zones_2,
    Branch04=warning_flow_rates_2,
    Branch05=warning_primary_proportions_2,
    Branch06=warning_secondary_proportions_2,
    Branch07=filter_21,
    FlattenInputs=True)  # -> flatten(Result)
panel_6 = Panel(entwine_3)
status = Text(entwine_3)

# ----
toolpathdatarange_2 = Data(toolpathdatarange)
objectinfo_2 = Data(objectinfo)
toolpath_2 = Data(toolpath)
context_print = ContextPrint(Status=status)
is_encoding_possible_3 = Boolean(is_encoding_possible)

multiplication = Multiplication(A=widths_2, B=heights_2)
pline = PolyLine(Vertices=points, Closed=False)
lng = ListLength(List=multiplication)
lng_2 = ListLength(List=flow_rates_3)
cull_i = CullIndex(List=multiplication, Indices="0", Wrap=True)
larger = LargerThan(FirstNumber=lng, SecondNumber="1")  # -> LargerThan, OrEqualTo
larger_2 = LargerThan(FirstNumber=lng_2, SecondNumber="1")  # -> LargerThan, OrEqualTo
cull_i_2 = CullIndex(List=flow_rates_3, Indices="0", Wrap=True)
filter_24 = StreamFilter(Gate=larger.LargerThan, Stream0=multiplication, Stream1=cull_i)
# Volume & Time calculations
explode = Explode(Curve=pline, Recursive=True)  # -> Segments, Vertices
filter_25 = StreamFilter(Gate=larger_2.LargerThan, Stream0=flow_rates_3, Stream1=cull_i_2)
len = Length(Curve=explode.Segments)
multiplication_2 = Multiplication(A=len, B=filter_24)

num = Number("1000000")

division = Division(A=multiplication_2, B=num)
division_2 = Division(A=division, B=filter_25)
ma = MassAddition(Input=division)  # -> Result, PartialResults
ma_2 = MassAddition(Input=division_2)  # -> Result, PartialResults
expression = Expression(x=ma.Result, Expression="Round(x,1)")
expression_2 = Expression(x=ma_2.Result, Expression="Round(x,2)")
rounded_volume_l = Number(expression)
rounded_time_min = Number(expression_2)

rounded_time_min_2 = Number(rounded_time_min)
rounded_volume_l_2 = Number(rounded_volume_l)
entwine_4 = Entwine(Branch00=rounded_volume_l_2, Branch01=rounded_time_min_2, FlattenInputs=True)  # -> flatten(Result)

# ----
# AnalysisData Encoding
analysis_data = Panel("""Volume
PrintingTime""")
values = Panel(entwine_4)

rejsonkv_4 = SerializeKeysAndValues(Key=analysis_data, Value=values)  # -> flatten(JSON)
analysisdata = Data(rejsonkv_4)
analysisdata_2 = Data(analysisdata)
rejson_4 = SerializeJson(
    ObjectInfo=objectinfo_2,
    Units=units_3,
    AnalysisData=analysisdata_2,
    ToolpathDataRange=toolpathdatarange_2,
    Toolpath=toolpath_2,
    IncludeNullAndEmptyProperties=True)
filter_26 = StreamFilter(Gate=is_encoding_possible_3, Stream1=rejson_4)
context_print_2 = ContextPrint(ToolpathObject=filter_26)

# ==== cluster Cluster
default_value = ClusterInput()  # Default Value
values = ClusterInput()  # Values
domain = ClusterInput()  # Domain
name = ClusterInput()  # Name
bnd = Bounds(Numbers=flatten(values))
dedomain = DeconstructDomain(Domain=bnd)  # -> Start, End
merge = Merge(Data1=dedomain.Start, Data2=dedomain.End)

# ---- group: Valid Domain
panel = Panel("{0} values are out of bound ({1}), a default value of {2} was given.")
inc = Includes(Value=flatten(merge), Domain=domain)  # -> Includes, Deviation
txt = Text(domain)
format = Format(Format=panel, Culture=127, Data0=name, Data1=txt, Data2=default_value)
mm = MassMultiplication(Input=inc.Includes)  # -> Result, PartialResults
filter = StreamFilter(Gate=mm.Result, Stream0=format)

# ---- group: Valid Domain / Default
filter_2 = StreamFilter(Gate=mm.Result, Stream0=default_value, Stream1=values)

# ----
message = ClusterOutput(filter)  # Message

# ---- group: Variable
num = Number(bnd)
item = ListItem(List=flatten(values), Index=0, Wrap=True)
larger = LargerThan(FirstNumber=num, SecondNumber="0")  # -> LargerThan, OrEqualTo
bool = Boolean(larger.LargerThan)

# ----
int = Integer(item)

# ---- group: Variable (continued)
filter_3 = StreamFilter(Gate=larger.LargerThan, Stream0=int, Stream1=bnd)

# ----
filter_4 = StreamFilter(Gate=bool, Stream1=filter_2)
data = Data(filter_3)
nominal_value = ClusterOutput(data)  # Nominal Value
values_2 = ClusterOutput(filter_4)  # Values
bool_2 = ClusterOutput(bool)

# ==== cluster Cluster_2
domain = ClusterInput()  # Domain
name = ClusterInput()  # Name
num = ClusterInput()
digits = ClusterInput()  # Digits
num_2 = Number(num)
int = Integer(digits)
bnd = Bounds(Numbers=flatten(num_2))
dedomain = DeconstructDomain(Domain=bnd)  # -> Start, End
merge = Merge(Data1=dedomain.Start, Data2=dedomain.End)

# ---- group: Valid Domain
inc = Includes(Value=flatten(merge), Domain=domain)  # -> Includes, Deviation
txt = Text(domain)
format = Format(Format="{0} values are out of the common bound ({1}).", Culture=127, Data0=name, Data1=txt)
mm = MassMultiplication(Input=inc.Includes)  # -> Result, PartialResults
filter = StreamFilter(Gate=mm.Result, Stream0=format)

# ----
repeat = RepeatData(Data="0", Length=int)
concat = Concatenate(FragmentA="{0:0.", FragmentB=repeat, FragmentC="}")

# ---- group: Variable
dedomain_2 = DeconstructDomain(Domain=bnd)  # -> Start, End
c_script = CSharpScript(x=dedomain_2.Start, z=dedomain_2.End, y=concat)  # -> out, B, A; inputs x: Double, z: Double, y: String
# ---------- c_script: C# ----------
    if (x != z){
      A = String.Format(y, (double) x) + " To " + String.Format(y, (double) z);
      B = true;
    }
    if (x == z) {
      A = String.Format(y, (double) x);
      B = false;
    }
# ---------- end c_script ----------

# ----
filter_2 = StreamFilter(Gate=c_script.B, Stream1=concat)
filter_3 = StreamFilter(Gate=c_script.B, Stream1=num_2)
data = Data(c_script.A)
format_2 = Format(Format=filter_2, Culture=127, Data0=filter_3)
nominal_value = ClusterOutput(data)  # Nominal Value
values = ClusterOutput(format_2)  # Values
B = ClusterOutput(c_script.B)
message = ClusterOutput(filter)  # Message

# ==== cluster Cluster_3
default_value = ClusterInput()  # Default Value
digits = ClusterInput()  # Digits
values = ClusterInput()  # Values
domain = ClusterInput()  # Domain
name = ClusterInput()  # Name
num = Number(values)
int = Integer(digits)
bnd = Bounds(Numbers=flatten(num))
dedomain = DeconstructDomain(Domain=bnd)  # -> Start, End
merge = Merge(Data1=dedomain.Start, Data2=dedomain.End)

# ---- group: Valid Domain
panel = Panel("{0} values are out of bound ({1}), a default value of {2} was given.")
inc = Includes(Value=flatten(merge), Domain=domain)  # -> Includes, Deviation
txt = Text(domain)
format = Format(Format=panel, Culture=127, Data0=name, Data1=txt, Data2=default_value)
mm = MassMultiplication(Input=inc.Includes)  # -> Result, PartialResults
filter = StreamFilter(Gate=mm.Result, Stream0=format)

# ----
repeat = RepeatData(Data="0", Length=int)
join = TextJoin(Text=repeat)
concat = Concatenate(FragmentA="{0:0.", FragmentB=join, FragmentC="}")

# ---- group: Variable
dedomain_2 = DeconstructDomain(Domain=bnd)  # -> Start, End
c_script = CSharpScript(x=dedomain_2.Start, z=dedomain_2.End, y=concat)  # -> out, B, A; inputs x: Double, z: Double, y: String; same code as c_script

# ---- group: Valid Domain / Default
filter_2 = StreamFilter(Gate=mm.Result, Stream0=default_value, Stream1=num)

# ----
filter_3 = StreamFilter(Gate=c_script.B, Stream1=concat)
filter_4 = StreamFilter(Gate=c_script.B, Stream1=filter_2)
data = Data(c_script.A)
format_2 = Format(Format=filter_3, Culture=127, Data0=filter_4)
nominal_value = ClusterOutput(data)  # Nominal Value
values_2 = ClusterOutput(format_2)  # Values
B = ClusterOutput(c_script.B)
message = ClusterOutput(filter)  # Message

# ==== cluster Cluster_4
domain = ClusterInput()  # Domain
name = ClusterInput()  # Name
value = ClusterInput()  # Value
num = ClusterInput()
num_2 = Number(num)
bnd = Bounds(Numbers=flatten(num_2))
dedomain = DeconstructDomain(Domain=bnd)  # -> Start, End
merge = Merge(Data1=dedomain.Start, Data2=dedomain.End)
inc = Includes(Value=flatten(merge), Domain=domain)  # -> Includes, Deviation
txt = Text(domain)
format = Format(Format="{0} values are out of the common bound ({1}).", Culture=127, Data0=name, Data1=txt)
mm = MassMultiplication(Input=inc.Includes)  # -> Result, PartialResults
item = ListItem(List=flatten(value), Index=0, Wrap=True)
dedomain_2 = DeconstructDomain(Domain=bnd)  # -> Start, End
c_script = CSharpScript(u=item, x=dedomain_2.Start, z=dedomain_2.End)  # -> out, B; inputs x: Double, z: Double
# ---------- c_script: C# ----------
    if (x != z){
      B = true;
    }
    if (x == z) {
      B = false;
    }
# ---------- end c_script ----------
filter = StreamFilter(Gate=mm.Result, Stream0=format)
filter_2 = StreamFilter(Gate=c_script.B, Stream1=value)
filter_3 = StreamFilter(Gate=c_script.B, Stream0=item, Stream1="Variable")
data = Data(filter_3)
nominal_value = ClusterOutput(data)  # Nominal Value
values = ClusterOutput(filter_2)  # Values
message = ClusterOutput(filter)  # Message
B = ClusterOutput(c_script.B)

# ==== cluster RenumberPaths
data = ClusterInput()
data_2 = Data(simplify(data))
tstat = TreeStatistics(Tree=data_2)  # -> Paths, Length, Count
branch = TreeBranch(Tree=data_2, Path=tstat.Paths, MaintainPaths=False)
B = ClusterOutput(branch)
