# Grasshopper definition Helix_tool_Hops.gh (Grasshopper 1.0.8)

number_slider = Slider(5, range=0..10)
toolpath_points_grafted = GetGeometry(AnnotationTypeFilter=0, AtLeast=1, AtMost=1, DeleteInput=True, Filter=1073741825, TreeAccess=True)
layer_widths = GetNumber(AtLeast=1, AtMost=1, Maximum=1.797693135e+308, Minimum=-1.797693135e+308, Prompt="Layer widths", TreeAccess=True)
layer_heights = GetNumber(AtLeast=1, AtMost=1, Maximum=1.797693135e+308, Minimum=-1.797693135e+308, Prompt="Layer heights", TreeAccess=True)
nb_of_transition_layers = GetInteger(number_slider, {"5"}, selected=[], AtLeast=1, AtMost=1, Maximum=2147483647, Minimum=-2147483648, TreeAccess=False)
flat_last_layer = GetBoolean(Toggle(True), AtLeast=1, AtMost=1, FalseValue="False", TreeAccess=False, TrueValue="True")
renumber_paths = RenumberPaths(data=toolpath_points_grafted)
renumber_paths_2 = RenumberPaths(data=layer_heights)
renumber_paths_3 = RenumberPaths(data=layer_widths)
deconstruct_plane = DeconstructPlane(Plane=renumber_paths)  # -> Origin, XAxis, YAxis, ZAxis
number_of_transition_layers_min_1 = Number(renumber_paths_2)
bool = Boolean(flat_last_layer)
number_of_transition_layers_min_1_2 = Number(renumber_paths_3)
number_of_transition_layers_min_1_3 = Number(nb_of_transition_layers)
toolpath_points_grafted_2 = Point(deconstruct_plane.Origin)
lng = ListLength(List=flatten(number_of_transition_layers_min_1))
lng_2 = ListLength(List=flatten(number_of_transition_layers_min_1_2))
pline = PolyLine(Vertices=toolpath_points_grafted_2, Closed=False)
item = ListItem(List=flatten(number_of_transition_layers_min_1_3), Index=0, Wrap=True)
list_item = ListItem(List=flatten(bool), Index=0, Wrap=True)
number_slider_2 = Slider(1, range=0..1)
larger = LargerThan(FirstNumber=lng, SecondNumber="1")  # -> LargerThan, OrEqualTo
larger_2 = LargerThan(FirstNumber=lng_2, SecondNumber="1")  # -> LargerThan, OrEqualTo
null = NullItem(Item=item)  # -> NullFlags, InvalidFlags, Description

item_2 = ListItem(List=flatten(pline), Index=0, Wrap=True)
flip = FlipCurve(Curve=pline, Guide=item_2)  # -> Curve, Flag

null_2 = NullItem(Item=list_item)  # -> NullFlags, InvalidFlags, Description
not_a_single_value = Boolean(larger.LargerThan)
not_a_single_value_2 = Boolean(larger_2.LargerThan)
filter = StreamFilter(Gate=null.NullFlags, Stream0=number_of_transition_layers_min_1_3, Stream1=number_slider)
stream_filter = StreamFilter(Gate=null_2.NullFlags, Stream0=list_item, Stream1=number_slider_2)
filter_2 = StreamFilter(Gate=not_a_single_value, Stream0=deconstruct_plane.Origin)
max = Maximum(A=filter, B=Slider(1, range=0..10))
filter_3 = StreamFilter(Gate=not_a_single_value_2, Stream0=deconstruct_plane.Origin)
max_2 = Maximum(A=stream_filter, B=Slider(0, range=0..100))
explode = Explode(Curve=flip.Curve, Recursive=True)  # -> Segments, Vertices
lng_3 = ListLength(List=filter_2)
lng_4 = ListLength(List=filter_3)
min = Minimum(A=max_2, B=number_slider_2)

# ---- group: Add last curve
tree_statistics = TreeStatistics(Tree=simplify(flip.Curve))  # -> Paths, Length, Count
subtraction = Subtraction(A="-1", B=1)
list_item_2 = ListItem(List=tree_statistics.Paths, Index="-1", Wrap=True)
list_item_3 = ListItem(List=tree_statistics.Paths, Index=subtraction, Wrap=True)
tree_branch = TreeBranch(Tree=simplify(flip.Curve), Path=list_item_3, MaintainPaths=True)
tree_branch_2 = TreeBranch(Tree=simplify(explode.Vertices), Path=list_item_2, MaintainPaths=True)
crv_cp = CurveClosestPoint(Point=tree_branch_2, Curve=tree_branch)  # -> Point, Parameter, Distance
vec2pt = Vector2Pt(PointA=crv_cp.Point, PointB=tree_branch_2, Unitize=False)  # -> Vector, Length
move = Move(Geometry=tree_branch_2, Motion=vec2pt.Vector)  # -> Geometry, Transform
pline_2 = PolyLine(Vertices=move.Geometry, Closed=False)
insert_items = InsertItems(List=flatten(flip.Curve), Item=pline_2, Indices="-1", Wrap=True)
cull_i = CullIndex(List=insert_items, Indices="0", Wrap=True)  # -> simplify(graft(List))

# ----
minimum = Minimum(A=max, B=tree_statistics.Count)
repeat = RepeatData(Data=number_of_transition_layers_min_1, Length=lng_3)
repeat_2 = RepeatData(Data=number_of_transition_layers_min_1_2, Length=lng_4)
filter_4 = StreamFilter(Gate=not_a_single_value, Stream0=repeat, Stream1=number_of_transition_layers_min_1)
filter_5 = StreamFilter(Gate=not_a_single_value_2, Stream0=repeat_2, Stream1=number_of_transition_layers_min_1_2)
lh = Number(filter_4)
lw = Number(filter_5)

# ---- group: Find position on curve
crv_cp_2 = CurveClosestPoint(Point=explode.Vertices, Curve=flip.Curve)  # -> Point, Parameter, Distance
len = Length(Curve=flip.Curve)
lenp = LengthParameter(Curve=flip.Curve, Parameter=crv_cp_2.Parameter)  # -> Length, Length_2
division = Division(A=lenp.Length, B=len)

# ----
series = Series(Start="1", Step=1, Count=minimum)
addition = Addition(A=min, B=1)
division_2 = Division(A=series, B=minimum)
lng_5 = ListLength(List=division)
panel = Panel("0")
multiplication = Multiplication(A=minimum, B=addition)
list_item_4 = ListItem(List=division_2, Index=0, Wrap=True)
lng_6 = ListLength(List=flatten(lng_5))
subtraction_2 = Subtraction(A=multiplication, B=minimum)
addition_2 = Addition(A=list_item_4, B="1")
subtraction_3 = Subtraction(A=lng_6, B=subtraction_2)
subtraction_4 = Subtraction(A=lng_6, B=multiplication)
series_2 = Series(Start=0, Step=1, Count=minimum)
dom = ConstructDomain(DomainStart="0", DomainEnd=division_2)
series_3 = Series(Start=minimum, Step=1, Count=subtraction_4)
dom_2 = ConstructDomain(DomainStart="1", DomainEnd=addition_2)
dom_3 = ConstructDomain(DomainStart=addition_2, DomainEnd="1")
series_4 = Series(Start=subtraction_3, Step=1, Count=subtraction_2)
dom_4 = ConstructDomain(DomainStart=division_2, DomainEnd="1")

# ---- group: Find next point to project
crv_cp_3 = CurveClosestPoint(Point=explode.Vertices, Curve=cull_i)  # -> Point, Parameter, Distance
vec2pt_2 = Vector2Pt(PointA=explode.Vertices, PointB=crv_cp_3.Point, Unitize=False)  # -> simplify(Vector), Length
eval = EvaluateCurve(Curve=cull_i, Parameter=crv_cp_3.Parameter)  # -> Point, Tangent, Angle
xy = XYPlane(Origin=Point(0, 0, 0))
project = Project(Geometry=eval.Tangent, Plane=xy)  # -> Geometry, Transform
pl = PlaneNormal(Origin=explode.Vertices, ZAxis=project.Geometry)
project_2 = Project(Geometry=vec2pt_2.Vector, Plane=pl)  # -> Geometry, Transform
angle = Angle(VectorA=vec2pt_2.Vector, VectorB=project_2.Geometry)  # -> Angle, Reflex
cos = Cosine(Value=angle.Angle)
division_3 = Division(A=vec2pt_2.Length, B=cos)
amp = Amplitude(Vector=project_2.Geometry, Amplitude=division_3)

# ----
subtraction_5 = Subtraction(A=subtraction_4, B=1)
division_4 = Division(A="1", B=subtraction_5)
series_5 = Series(Start=0, Step=division_4, Count=subtraction_4)  # -> graft(Series)
stream_filter_2 = StreamFilter(Gate=min, Stream1=series_5)
multiplication_2 = Multiplication(A=amp, B=division)
deconstruct_vector = DeconstructVector(Vector=amp)  # -> XComponent, YComponent, ZComponent
lh_2 = Number(lh)
branch = TreeBranch(Tree=simplify(explode.Vertices), Path=series_4, MaintainPaths=True)
branch_2 = TreeBranch(Tree=simplify(amp), Path=series_4, MaintainPaths=True)
branch_3 = TreeBranch(Tree=simplify(division), Path=series_4, MaintainPaths=True)
branch_4 = TreeBranch(Tree=simplify(lh_2), Path=series_4, MaintainPaths=True)
branch_5 = TreeBranch(Tree=simplify(amp), Path=series_3, MaintainPaths=True)
branch_6 = TreeBranch(Tree=simplify(division), Path=series_4, MaintainPaths=True)

branch_7 = TreeBranch(Tree=simplify(amp), Path=series_2, MaintainPaths=True)
branch_8 = TreeBranch(Tree=simplify(explode.Vertices), Path=series_2, MaintainPaths=True)
branch_9 = TreeBranch(Tree=simplify(division), Path=series_2, MaintainPaths=True)

branch_10 = TreeBranch(Tree=simplify(explode.Vertices), Path=series_3, MaintainPaths=True)
branch_11 = TreeBranch(Tree=simplify(multiplication_2), Path=series_3, MaintainPaths=True)
branch_12 = TreeBranch(Tree=simplify(lh_2), Path=series_3, MaintainPaths=True)

branch_13 = TreeBranch(Tree=simplify(lh_2), Path=series_2, MaintainPaths=True)
addition_3 = Addition(A="1", B=division_4)
multiplication_3 = Multiplication(A=stream_filter_2, B=branch_5)
remap = RemapNumbers(Value=branch_9, Source=Domain(0, 1), Target=graft(dom))  # -> Mapped, Clipped
remap_2 = RemapNumbers(Value=branch_9, Source=Domain(0, 1), Target=dom_2)  # -> Mapped, Clipped
remap_3 = RemapNumbers(Value=branch_3, Source=Domain(0, 1), Target=graft(dom_4))  # -> Mapped, Clipped
remap_4 = RemapNumbers(Value=branch_6, Source=Domain(0, 1), Target=dom_3)  # -> Mapped, Clipped
multiplication_4 = Multiplication(A=branch_12, B=addition_3)
multiplication_5 = Multiplication(A=branch_7, B=remap.Mapped)
addition_4 = Addition(A=multiplication_3, B=branch_11)
multiplication_6 = Multiplication(A=branch_2, B=remap_3.Mapped)
number = Number("0.01")
stream_filter_3 = StreamFilter(Gate=min, Stream0=branch_12, Stream1=multiplication_4)
number_2 = Number("0.01")
maximum = Maximum(A=remap_2.Mapped, B=number)
maximum_2 = Maximum(A=remap_4.Mapped, B=number_2)
addition_5 = Addition(A=branch_2, B=multiplication_6)
move_2 = Move(Geometry=branch_8, Motion=multiplication_5)  # -> Geometry, Transform
stream_filter_4 = StreamFilter(Gate=min, Stream0=branch_11, Stream1=addition_4)
multiplication_7 = Multiplication(A=maximum, B=branch_13)
multiplication_8 = Multiplication(A=maximum_2, B=branch_4)
stream_filter_5 = StreamFilter(Gate=min, Stream0=multiplication_6, Stream1=addition_5)
move_3 = Move(Geometry=branch_10, Motion=stream_filter_4)  # -> Geometry, Transform
move_4 = Move(Geometry=branch, Motion=stream_filter_5)  # -> Geometry, Transform
merge = Merge(Data1=simplify(move_2.Geometry), Data2=simplify(move_3.Geometry), Data3=simplify(move_4.Geometry))
merge_2 = Merge(Data1=simplify(multiplication_7), Data2=simplify(stream_filter_3), Data3=simplify(multiplication_8))
number_slider_3 = Slider(5, range=0..10)

# ---- group: Remove dupliates
cullpt = CullDuplicates(Points=merge, Tolerance=number_slider_3, CullMode=1)  # -> Points, Indices, Valence
pline_3 = PolyLine(Vertices=cullpt.Points, Closed=False)  # -> flatten(Polyline)
lng_7 = ListLength(List=pline_3)
end = EndPoints(Curve=pline_3)  # -> Start, End
shift = ShiftList(List=end.Start, Shift=1, Wrap=False)
repeat_3 = RepeatData(Data="-1", Length=lng_7)  # -> graft(Data)
ln = Line(StartPoint=end.End, EndPoint=shift)
larger_3 = LargerThan(FirstNumber=ln, SecondNumber=number_slider_3)  # -> LargerThan, OrEqualTo
cull = CullPattern(List=graft(repeat_3), CullPattern=invert(graft(larger_3.LargerThan)))
cull_i_2 = CullIndex(List=cullpt.Points, Indices=cull, Wrap=True)  # -> simplify(List)

# ----
list_item_5 = ListItem(List=deconstruct_plane.XAxis, Index=cullpt.Indices, Wrap=True)
item_3 = ListItem(List=merge_2, Index=cullpt.Indices, Wrap=True)
list_item_6 = ListItem(List=deconstruct_plane.YAxis, Index=cullpt.Indices, Wrap=True)
item_4 = ListItem(List=lw, Index=cullpt.Indices, Wrap=True)
panel_2 = Panel("Toolpath modified to an helix path with {0} layers transistion.")
panel_3 = Panel("Toolpath modified to an helix path with flat finish and {0} layers transistion.")
filter_6 = StreamFilter(Gate=min, Stream0=panel_2, Stream1=panel_3)
cull_i_3 = CullIndex(List=list_item_5, Indices=cull, Wrap=True)  # -> simplify(List)
format = Format(Format=filter_6, Culture=127, Data0=minimum)
cull_i_4 = CullIndex(List=list_item_6, Indices=cull, Wrap=True)  # -> simplify(List)
cull_i_5 = CullIndex(List=item_3, Indices=cull, Wrap=True)  # -> simplify(List)
cull_i_6 = CullIndex(List=item_4, Indices=cull, Wrap=True)  # -> simplify(List)
construct_plane = ConstructPlane(Origin=cull_i_2, XAxis=cull_i_3, YAxis=cull_i_4)
item_5 = ListItem(List=flatten(construct_plane), Index=0, Wrap=True)
null_3 = NullItem(Item=item_5)  # -> NullFlags, InvalidFlags, Description
pline_4 = PolyLine(Vertices=flatten(cull_i_2), Closed=False)
layer_height_mm = Number(cull_i_5)
layer_width_mm = Number(cull_i_6)
filter_7 = StreamFilter(Gate=null_3.NullFlags, Stream0=format)
helix_planes = Plane(construct_plane)
context_print = ContextPrint(LayerHeight=layer_height_mm)
status = Text(filter_7)
context_print_2 = ContextPrint(LayerWidth=layer_width_mm)
panel_4 = Panel(status)
context_bake = ContextBake(HelixPlanes=helix_planes)
context_print_3 = ContextPrint(Status=status)

# ==== cluster RenumberPaths
data = ClusterInput()  # Data to renumber
tree_statistics = TreeStatistics(Tree=data)  # -> Paths, Length, Count
series = Series(Start=0, Step=1, Count=tree_statistics.Count)
replace_paths = ReplacePaths(Data=data, Search=tree_statistics.Paths, Replace=series)
renumbered_data = ClusterOutput(replace_paths)
