# Grasshopper definition Pufferfish_test.gh (Grasshopper 1.0.8)
# plug-ins: Pufferfish

get_number = GetNumber(AtLeast=1, AtMost=1, Maximum=1.797693135e+308, Minimum=-1.797693135e+308, TreeAccess=False)
get_number_2 = GetNumber(AtLeast=1, AtMost=1, Maximum=1.797693135e+308, Minimum=-1.797693135e+308, TreeAccess=False)
twn2nums = TweenTwoNumbers(NumberA=get_number_2, NumberB=get_number, Factor=0.5)
context_print = ContextPrint(Text=twn2nums)
