# Grasshopper definition Pufferfish_test_2.gh (Grasshopper 1.0.8)
# plug-ins: Pufferfish

_2 = GetNumber(AtLeast=1, AtMost=1, Maximum=1.797693135e+308, Minimum=-1.797693135e+308, TreeAccess=False)
_1 = GetNumber(AtLeast=1, AtMost=1, Maximum=1.797693135e+308, Minimum=-1.797693135e+308, TreeAccess=False)
twn2nums = TweenTwoNumbers(NumberA=_1, NumberB=_2, Factor=0.5)
context_print = ContextPrint(Text=twn2nums)
