# Grasshopper definition Toolpath_Analysis_hops_PWH.gh (Grasshopper 1.0.8)
# Copyright: @felipe__penagos
# plug-ins: jSwan, RhinoCodePluginGH

txt = Text("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")
get_string = GetString(AtLeast=1, AtMost=1, TreeAccess=False)
gate = StreamGate(Stream=get_string, Gate="0")  # -> Target0, Target1
# Deserialize
dejson = DeserializeJson(JSON=gate.Target0, OutputsLocked=True)  # -> ObjectInfo, ToolpathDataRange, Toolpath
toolpathdatarange = Data(dejson.ToolpathDataRange)
dejsonkv = DeserializeKeysAndValues(JSON=dejson.Toolpath)  # -> Key, simplify(Value)
dejsonkv_2 = DeserializeKeysAndValues(JSON=toolpathdatarange, Keys="LayerHeights")  # -> Key, simplify(Value)
dejsonkv_3 = DeserializeKeysAndValues(JSON=toolpathdatarange, Keys="Zones")  # -> Key, simplify(Value)
dejsonkv_4 = DeserializeKeysAndValues(JSON=toolpathdatarange, Keys="MaterialFlowRates")  # -> Key, simplify(Value)
dejsonkv_5 = DeserializeKeysAndValues(JSON=toolpathdatarange, Keys="PrimaryProportions")  # -> Key, simplify(Value)
dejsonkv_6 = DeserializeKeysAndValues(JSON=toolpathdatarange, Keys="SecondaryProportions")  # -> Key, simplify(Value)
dejsonkv_7 = DeserializeKeysAndValues(JSON=dejsonkv.Value, Keys="Positions")  # -> Key, simplify(Value)
dejsonkv_8 = DeserializeKeysAndValues(JSON=dejsonkv.Value, Keys="NormalVectors")  # -> Key, simplify(Value)
dejsonkv_9 = DeserializeKeysAndValues(JSON=dejsonkv.Value, Keys="LayerWidths")  # -> Key, simplify(Value)
dejsonkv_10 = DeserializeKeysAndValues(JSON=dejsonkv.Value, Keys="LayerHeights")  # -> Key, simplify(Value)
dejsonkv_11 = DeserializeKeysAndValues(JSON=dejsonkv.Value, Keys="Zones")  # -> Key, simplify(Value)
dejsonkv_12 = DeserializeKeysAndValues(JSON=dejsonkv.Value, Keys="MaterialFlowRates")  # -> Key, simplify(Value)
dejsonkv_13 = DeserializeKeysAndValues(JSON=dejsonkv.Value, Keys="PrimaryProportions")  # -> Key, simplify(Value)
dejsonkv_14 = DeserializeKeysAndValues(JSON=dejsonkv.Value, Keys="SecondaryProportions")  # -> Key, simplify(Value)
dejsonkv_15 = DeserializeKeysAndValues(JSON=toolpathdatarange, Keys="NormalVectors")  # -> Key, simplify(Value)
dejsonkv_16 = DeserializeKeysAndValues(JSON=toolpathdatarange, Keys="LayerWidths")  # -> Key, simplify(Value)
dejson_2 = DeserializeJson(JSON=dejsonkv_7.Value, OutputsLocked=False)  # -> simplify(Array)
dejson_3 = DeserializeJson(JSON=dejsonkv_8.Value, OutputsLocked=False)  # -> simplify(Array)
dejson_4 = DeserializeJson(JSON=dejsonkv_9.Value, OutputsLocked=False)  # -> simplify(Array)
dejson_5 = DeserializeJson(JSON=dejsonkv_10.Value, OutputsLocked=False)  # -> simplify(Array)
dejson_6 = DeserializeJson(JSON=dejsonkv_11.Value, OutputsLocked=False)  # -> simplify(Array)
dejson_7 = DeserializeJson(JSON=dejsonkv_12.Value, OutputsLocked=False)  # -> simplify(Array)
dejson_8 = DeserializeJson(JSON=dejsonkv_13.Value, OutputsLocked=False)  # -> simplify(Array)
dejson_9 = DeserializeJson(JSON=dejsonkv_14.Value, OutputsLocked=False)  # -> simplify(Array)
item = ListItem(List=flatten(dejson_4), Index=0, Wrap=True)
item_2 = ListItem(List=flatten(dejson_5), Index=0, Wrap=True)
item_3 = ListItem(List=flatten(dejson_3), Index=0, Wrap=True)
item_4 = ListItem(List=flatten(dejson_6), Index=0, Wrap=True)
item_5 = ListItem(List=flatten(dejson_7), Index=0, Wrap=True)
item_6 = ListItem(List=flatten(dejson_8), Index=0, Wrap=True)
item_7 = ListItem(List=flatten(dejson_9), Index=0, Wrap=True)
null = NullItem(Item=item)  # -> NullFlags, InvalidFlags, Description
null_2 = NullItem(Item=item_2)  # -> NullFlags, InvalidFlags, Description
null_3 = NullItem(Item=item_3)  # -> NullFlags, InvalidFlags, Description
null_4 = NullItem(Item=item_4)  # -> NullFlags, InvalidFlags, Description
null_5 = NullItem(Item=item_5)  # -> NullFlags, InvalidFlags, Description
null_6 = NullItem(Item=item_6)  # -> NullFlags, InvalidFlags, Description
null_7 = NullItem(Item=item_7)  # -> NullFlags, InvalidFlags, Description
filter = StreamFilter(Gate=null.NullFlags, Stream0=dejson_4, Stream1=dejsonkv_16.Value)  # -> simplify(Stream)
filter_2 = StreamFilter(Gate=null_2.NullFlags, Stream0=dejson_5, Stream1=dejsonkv_2.Value)  # -> simplify(Stream)
filter_3 = StreamFilter(Gate=null_3.NullFlags, Stream0=dejson_3, Stream1=dejsonkv_15.Value)
filter_4 = StreamFilter(Gate=null_4.NullFlags, Stream0=dejson_6, Stream1=dejsonkv_3.Value)  # -> simplify(Stream)
filter_5 = StreamFilter(Gate=null_5.NullFlags, Stream0=dejson_7, Stream1=dejsonkv_4.Value)  # -> simplify(Stream)
filter_6 = StreamFilter(Gate=null_6.NullFlags, Stream0=dejson_8, Stream1=dejsonkv_5.Value)  # -> simplify(Stream)
filter_7 = StreamFilter(Gate=null_7.NullFlags, Stream0=dejson_9, Stream1=dejsonkv_6.Value)  # -> simplify(Stream)
split = TextSplit(Text=filter_3, Separators=",")
int = Integer(filter_4)
num = Number(filter_6)
num_2 = Number(filter_5)
num_3 = Number(filter_7)
rep = ReplaceText(Text=filter, Find=".", Replace=",", RecursiveReplace=False)
rep_2 = ReplaceText(Text=filter_2, Find=".", Replace=",", RecursiveReplace=False)
rep_3 = ReplaceText(Text=split, Find=".", Replace=",", RecursiveReplace=False)
c_script = CSharpScript(x=rep)  # -> out, a; inputs x: tree of String
# ---------- c_script: C# ----------
// Grasshopper Script Instance
#region Usings
using System;
using System.Linq;
using System.Collections;
using System.Collections.Generic;
using System.Drawing;

using Rhino;
using Rhino.Geometry;

using Grasshopper;
using Grasshopper.Kernel;
using Grasshopper.Kernel.Data;
using Grasshopper.Kernel.Types;
#endregion

public class Script_Instance : GH_ScriptInstance
{
    #region Notes
    /* 
      Members:
        RhinoDoc RhinoDocument
        GH_Document GrasshopperDocument
        IGH_Component Component
        int Iteration

      Methods (Virtual & overridable):
        Print(string text)
        Print(string format, params object[] args)
        Reflect(object obj)
        Reflect(object obj, string method_name)
    */
    #endregion

    private void RunScript(DataTree<string> x, ref object a)
    {
 
   DataTree<double> Converted = new DataTree<double>();


      for(int i = 0; i < x.BranchCount ;i++)
      {
        for(int j = 0; j < x.Branch(i).Count;j++)
          Converted.Add(Convert.ToDouble(x.Branch(i)[j]), new GH_Path(i));
      }
      a = Converted;
    }
        
    
}
# ---------- end c_script ----------
c_script_2 = CSharpScript(x=rep_3)  # -> out, a; inputs x: tree of String; same code as c_script
c_script_3 = CSharpScript(x=rep_2)  # -> out, a; inputs x: tree of String; same code as c_script
item_8 = ListItem(List=c_script_2.a, Index=0, Wrap=True)  # -> Item, Item1, Item2
vec = VectorXYZ(XComponent=item_8.Item, YComponent=item_8.Item1, ZComponent=item_8.Item2)  # -> Vector, Length
pl = PlaneNormal(Origin=dejson_2, ZAxis=vec.Vector)  # -> simplify(Plane)
layer_heights = Number(c_script_3.a)
layer_widths = Number(c_script.a)
planes = Plane(pl)
cluster = Cluster_2(planes=planes, check_mode="0", layer_widths=layer_widths, layer_heights=layer_heights)  # -> colours_2, tags, warnings_for_speckle, warnings_keys_for_speckle, visualisation_data
colours = Text(cluster.colours_2)
txt_2 = Text(cluster.tags)
tags = ContextPrint(Colours=colours)
tags_2 = ContextPrint(Text=txt_2)

# ==== cluster Cluster_2
check_mode = ClusterInput()
layer_widths = ClusterInput()
planes = ClusterInput()
layer_heights = ClusterInput()
layer_heights_2 = Number(layer_heights)
layer_widths_2 = Number(layer_widths)
object_name = Text()
flowrate = Number("2")
zones = Integer("2")
ad1 = Number("2")
ad2 = Number("2")
planes_2 = Plane(planes)
designer = Text()
renumber_paths = RenumberPaths(data=flowrate)
renumber_paths_2 = RenumberPaths(data=ad2)
renumber_paths_3 = RenumberPaths(data=ad1)
renumber_paths_4 = RenumberPaths(data=zones)
renumber_paths_5 = RenumberPaths(data=layer_heights_2)
renumber_paths_6 = RenumberPaths(data=planes_2)
renumber_paths_7 = RenumberPaths(data=layer_widths_2)
panel = Panel("""Mode : Quick analysis (-1)
Mode : Default analysis (0)
Mode : Advanced analysis (1)
Mode : Advanced analysis (1)""")
integer = Integer(check_mode)
printing_material = Number()
flow_rate_l_min = Number(renumber_paths)
list_item = ListItem(List=flatten(integer), Index=0, Wrap=True)
item = ListItem(List=flatten(flow_rate_l_min), Index=0, Wrap=True)
item_2 = ListItem(List=flatten(printing_material), Index=0, Wrap=True)
null = NullItem(Item=list_item)  # -> NullFlags, InvalidFlags, Description

item_3 = ListItem(List=flatten(renumber_paths_6), Index=0, Wrap=True)
item_4 = ListItem(List=flatten(renumber_paths_7), Index=0, Wrap=True)
item_5 = ListItem(List=flatten(renumber_paths_5), Index=0, Wrap=True)
null_2 = NullItem(Item=item_5)  # -> NullFlags, InvalidFlags, Description
null_3 = NullItem(Item=item_4)  # -> NullFlags, InvalidFlags, Description
null_4 = NullItem(Item=item_3)  # -> NullFlags, InvalidFlags, Description
or = GateOr(A=null_4.NullFlags, B=null_3.NullFlags, C=null_2.NullFlags)
filter = StreamFilter(Gate=or, Stream0=renumber_paths_6)
filter_2 = StreamFilter(Gate=or, Stream0=renumber_paths_5)
filter_3 = StreamFilter(Gate=or, Stream0=renumber_paths_7)

null_5 = NullItem(Item=item_2)  # -> NullFlags, InvalidFlags, Description
stream_filter = StreamFilter(Gate=null.NullFlags, Stream0=list_item, Stream1="0")
null_6 = NullItem(Item=item)  # -> NullFlags, InvalidFlags, Description
num = Number("1")
filter_4 = StreamFilter(Gate=null_5.NullFlags, Stream0=item_2, Stream1="0")
multiplication = Multiplication(A=stream_filter, B=2)
filter_5 = StreamFilter(Gate=null_6.NullFlags, Stream0=flow_rate_l_min, Stream1=num)
max = Maximum(A=stream_filter, B="-1")
min = Minimum(A=max, B="2")
addition = Addition(A=min, B=1)

tree_statistics = TreeStatistics(Tree=filter)  # -> Paths, Length, Count
series = Series(Start=0, Step=1, Count=tree_statistics.Count)
replace_paths = ReplacePaths(Data=filter, Search=tree_statistics.Paths, Replace=series)

list_item_2 = ListItem(List=panel, Index=addition, Wrap=True)

tree_statistics_2 = TreeStatistics(Tree=filter_3)  # -> Paths, Length, Count
series_2 = Series(Start=0, Step=1, Count=tree_statistics_2.Count)
replace_paths_2 = ReplacePaths(Data=filter_3, Search=tree_statistics_2.Paths, Replace=series_2)

lng = ListLength(List=flatten(replace_paths_2))
check_mode_2 = Data(addition)

tree_statistics_3 = TreeStatistics(Tree=filter_2)  # -> Paths, Length, Count
series_3 = Series(Start=0, Step=1, Count=tree_statistics_3.Count)
replace_paths_3 = ReplacePaths(Data=filter_2, Search=tree_statistics_3.Paths, Replace=series_3)

lng_2 = ListLength(List=flatten(replace_paths_3))
smaller = SmallerThan(FirstNumber=lng_2, SecondNumber="1.1")  # -> SmallerThan, OrEqualTo
smaller_2 = SmallerThan(FirstNumber=lng, SecondNumber="1.1")  # -> SmallerThan, OrEqualTo
panel_2 = Panel("Planes, widths or heights do not have the same tree structure.")
number = Number("0.01")

# ---- group: No check
similar = Similarity(FirstNumber=check_mode_2, SecondNumber="0", Threshold=0.1)  # -> Similarity, AbsoluteDifference
similar_2 = Similarity(FirstNumber=check_mode_2, SecondNumber="2", Threshold=0.1)  # -> Similarity, AbsoluteDifference
similar_3 = Similarity(FirstNumber=check_mode_2, SecondNumber="1", Threshold=0.1)  # -> Similarity, AbsoluteDifference
or_2 = GateOr(A=similar_3.Similarity, B=similar_2.Similarity, C=similar.Similarity)
filter_6 = StreamFilter(Gate=or_2, Stream1=replace_paths)  # -> simplify(Stream)

# ----
larger_than = LargerThan(FirstNumber=flatten(replace_paths_3), SecondNumber=number)  # -> LargerThan, OrEqualTo
larger_than_2 = LargerThan(FirstNumber=flatten(replace_paths_2), SecondNumber=number)  # -> LargerThan, OrEqualTo

# ---- group: Check List structure
tstat = TreeStatistics(Tree=replace_paths)  # -> Paths, Length, Count
smaller_3 = SmallerThan(FirstNumber=tstat.Count, SecondNumber="1.1")  # -> SmallerThan, OrEqualTo
filter_7 = StreamFilter(Gate=smaller_3.SmallerThan, Stream0=replace_paths_3)
filter_8 = StreamFilter(Gate=smaller_3.SmallerThan, Stream0=replace_paths_2)
filter_9 = StreamFilter(Gate=smaller_3.SmallerThan, Stream0=replace_paths)

# ---- group: Routine check
similar_4 = Similarity(FirstNumber=check_mode_2, SecondNumber="2", Threshold=0.1)  # -> Similarity, AbsoluteDifference
similar_5 = Similarity(FirstNumber=check_mode_2, SecondNumber="1", Threshold=0.1)  # -> Similarity, AbsoluteDifference
or_3 = GateOr(A=similar_5.Similarity, B=similar_4.Similarity)
filter_10 = StreamFilter(Gate=or_3, Stream1=filter_9)  # -> simplify(Stream)

# ----
gate_and = GateAnd(A=larger_than_2.LargerThan, B=larger_than.LargerThan)
mass_multiplication = MassMultiplication(Input=gate_and)  # -> Result, PartialResults
deplane = DeconstructPlane(Plane=replace_paths)  # -> Origin, XAxis, YAxis, ZAxis

# ---- group: Advanced check
similar_6 = Similarity(FirstNumber=check_mode_2, SecondNumber="2", Threshold=0.1)  # -> Similarity, AbsoluteDifference
filter_11 = StreamFilter(Gate=similar_6.Similarity, Stream1=filter_9)  # -> simplify(Stream)

# ----
and = GateAnd(A=mass_multiplication.Result, B=or_2)
filter_12 = StreamFilter(Gate=or_2, Stream1=deplane.ZAxis)  # -> simplify(Stream)
stream_gate = StreamGate(Stream=replace_paths_3, Gate=mass_multiplication.Result)  # -> Target0, Target1
stream_gate_2 = StreamGate(Stream=replace_paths_2, Gate=mass_multiplication.Result)  # -> Target0, Target1
filter_13 = StreamFilter(Gate=similar_6.Similarity, Stream1=filter_8)  # -> simplify(Stream)
pdecon = Deconstruct(Point=filter_12)  # -> XComponent, YComponent, ZComponent
pt = Point(flatten(deplane.Origin))

# ---- group: Advanced check
similar_7 = Similarity(FirstNumber=check_mode_2, SecondNumber="2", Threshold=0.1)  # -> Similarity, AbsoluteDifference
filter_14 = StreamFilter(Gate=similar_7.Similarity, Stream1=pt)  # -> simplify(Stream)

# ----
pt_2 = Point(simplify(deplane.Origin))
abs = Absolute(Value=filter_12)
Z = UnitZ(Factor=1)
plfit = PlaneFit(Points=pt_2)  # -> Plane, Deviation
subd_points = Relay()
angle = Angle(VectorA=abs, VectorB=Z)  # -> Angle, Reflex
pt_3 = Point(flatten(deplane.Origin))
list_item_3 = ListItem(List=flatten(pt), Index=0, Wrap=True)
project = Project(Geometry=pt_2, Plane=plfit.Plane)  # -> Geometry, Transform
filter_15 = StreamFilter(Gate=similar_7.Similarity, Stream0=simplify(filter_10), Stream1=simplify(subd_points))
deg = Degrees(Radians=angle.Angle)
pline = PolyLine(Vertices=flatten(project.Geometry), Closed=False)
null_item = NullItem(Item=list_item_3)  # -> NullFlags, InvalidFlags, Description
multiplication_2 = Multiplication(A=replace_paths_2, B=replace_paths_3)
filter_16 = StreamFilter(Gate=or_3, Stream1=replace_paths_2)  # -> simplify(Stream)

# ---- group: Start point
pdecon_2 = Deconstruct(Point=pt_3)  # -> XComponent, YComponent, ZComponent
item_6 = ListItem(List=pt_3, Index=0, Wrap=True)
sort = SortList(Keys=pdecon_2.ZComponent, ValuesA=pt_3)  # -> Keys, ValuesA
item_7 = ListItem(List=sort.Keys, Index=0, Wrap=True)
pdecon_3 = Deconstruct(Point=item_6)  # -> XComponent, YComponent, ZComponent
panel_3 = Panel("5")
panel_4 = Panel("Start point is not the lowest point, are you sure ?")

# ---- group: Point d'approche
tree_branch = TreeBranch(Tree=deplane.Origin, Path="0", MaintainPaths=True)
project_2 = Project(Geometry=tree_branch, Plane=PlaneXY(0, 0, 0))  # -> Geometry, Transform
project_3 = Project(Geometry=item_6, Plane=PlaneXY(0, 0, 0))  # -> Geometry, Transform
convex_hull = ConvexHull(Points=project_2.Geometry, Plane=PlaneXY(0, 0, 0))  # -> Hull, HullZ, Indices
curve_closest_point = CurveClosestPoint(Point=project_3.Geometry, Curve=convex_hull.Hull)  # -> Point, Parameter, Distance
panel_5 = Panel("Start point seems hardly accessible, will you be able to cut cleanly the approach layer ?")
larger_than_3 = LargerThan(FirstNumber=curve_closest_point.Distance, SecondNumber=Slider(30, range=0..100))  # -> LargerThan, OrEqualTo
filter_17 = StreamFilter(Gate=larger_than_3.LargerThan, Stream1=panel_5)

# ----
filter_18 = StreamFilter(Gate=or_3, Stream1=replace_paths_3)  # -> simplify(Stream)
stream_filter_2 = StreamFilter(Gate=null_item.NullFlags, Stream0=filter_5, Stream1="0")

# ---- group: Take out singularities
cluster = Cluster(relay=multiplication_2)

# ----
cluster_2 = Cluster(relay=replace_paths_2)

flowrate_l_min = Number(stream_filter_2)
lng_3 = ListLength(List=flatten(flowrate_l_min))
cull_i = CullIndex(List=flatten(flowrate_l_min), Indices="0", Wrap=True)
larger = LargerThan(FirstNumber=lng_3, SecondNumber="1")  # -> LargerThan, OrEqualTo
filter_19 = StreamFilter(Gate=larger.LargerThan, Stream0=flowrate_l_min, Stream1=cull_i)

layer_widths_mm = Number(replace_paths_2)
layer_heights_mm = Number(replace_paths_3)
deplane_2 = DeconstructPlane(Plane=filter_10)  # -> Origin, XAxis, YAxis, ZAxis
sort_2 = SortList(Keys=flatten(cluster_2))  # -> Keys, ValuesA
subtraction = Subtraction(A=pdecon_3.ZComponent, B=item_7)
item_8 = ListItem(List=sort_2.Keys, Index=0, Wrap=True)  # -> Item1, Item
panel_6 = Panel("""Concrete NAG3
Concrete NAW3
VICAT
Concrete + aggregrates
Platre""")
densité_matériau = Panel("""2.3
2.3
2.45
2.3
1.7""")
densité_premix = Panel("""2.1
2.1
2.1
2.1
1.2""")
larger_2 = LargerThan(FirstNumber=subtraction, SecondNumber=panel_3)  # -> LargerThan, OrEqualTo
pline_2 = PolyLine(Vertices=pt, Closed=False)
multiplication_3 = Multiplication(A=layer_widths_mm, B=layer_heights_mm)  # -> flatten(Result)
item_9 = ListItem(List=panel_6, Index=filter_4, Wrap=True)
item_10 = ListItem(List=densité_matériau, Index=filter_4, Wrap=True)
item_11 = ListItem(List=densité_premix, Index=filter_4, Wrap=True)
mod = Modulus(A=item_8.Item, B="2")
lng_4 = ListLength(List=filter_14)
filter_20 = StreamFilter(Gate=larger_2.LargerThan, Stream1=panel_4)
lng_5 = ListLength(List=multiplication_3)
subtraction_2 = Subtraction(A=item_8.Item, B=mod)
panel_7 = Panel(item_9)
series_4 = Series(Start=0, Step=1, Count=lng_4)
panel_8 = Panel("Some points will cause Robot reading frequency problem, try spacing the points or lowering the robot speed.")
material_density_kg_l = Number(item_11)
material_density_kg_l_2 = Number(item_10)
larger_3 = LargerThan(FirstNumber=lng_5, SecondNumber=1.1)  # -> LargerThan, OrEqualTo
explode = Explode(Curve=pline_2, Recursive=True)  # -> Segments, Vertices
eval = EvaluateCurve(Curve=pline_2, Parameter=series_4)  # -> Point, Tangent, Angle
cull_index = CullIndex(List=multiplication_3, Indices="0", Wrap=True)
len = Length(Curve=explode.Segments)
filter_21 = StreamFilter(Gate=larger_3.LargerThan, Stream0=multiplication_3, Stream1=cull_index)
multiplication_4 = Multiplication(A=layer_widths_mm, B=layer_heights_mm)

# ---- group: Orientation change
flatten_tree = FlattenTree(Tree=deg, Path="{0}")
cull_index_2 = CullIndex(List=flatten_tree, Indices="-1", Wrap=True)
cull_index_3 = CullIndex(List=flatten_tree, Indices="0", Wrap=True)
subtraction_3 = Subtraction(A=cull_index_2, B=cull_index_3)
absolute = Absolute(Value=subtraction_3)
panel_9 = Panel("0")
insert_items = InsertItems(List=absolute, Item=panel_9, Indices=panel_9, Wrap=True)
unflatten_tree = UnflattenTree(Tree=insert_items, Guide=pt_2)
angle_change = Number(unflatten_tree)

# ----
tstat_2 = TreeStatistics(Tree=pt_2)  # -> Paths, Length, Count
multiplication_5 = Multiplication(A=len, B=filter_21)
pdecon_4 = Deconstruct(Point=pt)  # -> XComponent, YComponent, ZComponent
num_2 = Number("10^6")
num_3 = Number("60")
larger_4 = LargerThan(FirstNumber=tstat_2.Count, SecondNumber=1)  # -> LargerThan, OrEqualTo
sort_3 = SortList(Keys=pdecon_4.ZComponent)  # -> Keys, ValuesA
multiplication_6 = Multiplication(A=multiplication_4, B=num_3)
multiplication_7 = Multiplication(A=flowrate_l_min, B=num_2)
list_item_4 = ListItem(List=flatten(cluster), Index=0, Wrap=True)
num_4 = Number("10^-6")
item_12 = ListItem(List=sort_3.Keys, Index=0, Wrap=True)  # -> Item1, Item

# ---- group: Speeds
division = Division(A=multiplication_7, B=multiplication_6)

# ----
vz_mm_min = Number(layer_heights_mm)

# ---- group: volume (L)
multiplication_8 = Multiplication(A=multiplication_5, B=num_4)

# ----
panel_10 = Panel("Some points have a local stability problem (Air printing). Try increasing layer width or reducing the slope on these points.")
null_item_2 = NullItem(Item=list_item_4)  # -> NullFlags, InvalidFlags, Description
subtraction_4 = Subtraction(A=item_12.Item1, B=item_12.Item)
expression = Expression(h=vz_mm_min, rho=material_density_kg_l_2, Expression="rho*9.81*h")

# ---- group: Temps (min)
division_2 = Division(A=multiplication_8, B=filter_19)

# ----
ins = InsertItems(List=division_2, Item="0", Indices="0", Wrap=True)
ma = MassAddition(Input=multiplication_8)  # -> Result, PartialResults

# ---- group: Accelerations
flatten_tree_2 = FlattenTree(Tree=division, Path="{0}")
cull_index_4 = CullIndex(List=flatten_tree_2, Indices="0", Wrap=True)
cull_index_5 = CullIndex(List=flatten_tree_2, Indices="-1", Wrap=True)
cull_index_6 = CullIndex(List=flatten_tree_2, Indices="0", Wrap=True)
subtraction_5 = Subtraction(A=cull_index_5, B=cull_index_6)
division_3 = Division(A=flatten(len), B=cull_index_4)
absolute_2 = Absolute(Value=subtraction_5)
division_4 = Division(A=absolute_2, B=division_3)
insert_items_2 = InsertItems(List=division_4, Item="0", Indices="0", Wrap=True)
lng_6 = ListLength(List=flatten(flatten_tree_2))
unflatten_tree_2 = UnflattenTree(Tree=insert_items_2, Guide=pt_2)
larger_5 = LargerThan(FirstNumber=lng_6, SecondNumber="1")  # -> LargerThan, OrEqualTo
filter_22 = StreamFilter(Gate=larger_5.LargerThan, Stream0="0", Stream1=unflatten_tree_2)
accelerations_mm_s_2 = Number(filter_22)

# ----
item_13 = ListItem(List=flatten(renumber_paths_3), Index=0, Wrap=True)
unflatten = UnflattenTree(Tree=ins, Guide=pt_2)
item_14 = ListItem(List=flatten(renumber_paths_2), Index=0, Wrap=True)
ma_2 = MassAddition(Input=division_2)  # -> Result, PartialResults
division_5 = Division(A=subtraction_4, B=ma_2.Result)

# ---- group: poids (kg)
multiplication_9 = Multiplication(A=ma.Result, B=material_density_kg_l_2)

# ----
multiplication_10 = Multiplication(A=ma.Result, B=material_density_kg_l)
null_7 = NullItem(Item=item_13)  # -> NullFlags, InvalidFlags, Description
ma_3 = MassAddition(Input=unflatten)  # -> Result, PartialResults
null_8 = NullItem(Item=item_14)  # -> NullFlags, InvalidFlags, Description
len_2 = Length(Curve=explode.Segments)  # disabled
stream_filter_3 = StreamFilter(Gate=null_item_2.NullFlags, Stream0="0")
panel_11 = Panel("1")  # disabled
division_6 = Division(A=division, B=replace_paths_3)
multiplication_11 = Multiplication(A=ma_3.Result, B="60")
insert_items_3 = InsertItems(List=len_2, Item=panel_11, Indices=panel_9, Wrap=True)  # disabled
unit_z = UnitZ(Factor=1)

average = Average(Input=flatten(expression))
bnd = Bounds(Numbers=flatten(expression))
multiplication_12 = Multiplication(A=average, B=0.01)
num_5 = Number(bnd)
dedomain = DeconstructDomain(Domain=bnd)  # -> Start, End
larger_6 = LargerThan(FirstNumber=num_5, SecondNumber=multiplication_12)  # -> LargerThan, OrEqualTo
filter_23 = StreamFilter(Gate=larger_6.LargerThan, Stream0="Yield Stress : {0:0} Pa", Stream1="Yield Stress : {1:0} to {2:0} Pa")
format = Format(Format=filter_23, Culture=127, Data0=average, Data1=dedomain.Start, Data2=dedomain.End)

average_2 = Average(Input=flatten(renumber_paths_2))
bnd_2 = Bounds(Numbers=flatten(renumber_paths_2))
multiplication_13 = Multiplication(A=average_2, B=0.01)
num_6 = Number(bnd_2)
larger_7 = LargerThan(FirstNumber=num_6, SecondNumber=multiplication_13)  # -> LargerThan, OrEqualTo
dedomain_2 = DeconstructDomain(Domain=bnd_2)  # -> Start, End
filter_24 = StreamFilter(Gate=larger_7.LargerThan, Stream0="AD2 : {0:0.00} mL/L", Stream1="AD2 : {1:0.00} to {2:0.00} mL/L")
format_2 = Format(Format=filter_24, Culture=127, Data0=average_2, Data1=dedomain_2.Start, Data2=dedomain_2.End)

average_3 = Average(Input=flatten(filter_5))
bnd_3 = Bounds(Numbers=flatten(filter_5))
multiplication_14 = Multiplication(A=average_3, B=0.01)
num_7 = Number(bnd_3)
larger_8 = LargerThan(FirstNumber=num_7, SecondNumber=multiplication_14)  # -> LargerThan, OrEqualTo
dedomain_3 = DeconstructDomain(Domain=bnd_3)  # -> Start, End
filter_25 = StreamFilter(Gate=larger_8.LargerThan, Stream0="Flowrate : {0:0.00} L/min", Stream1="Flowrate : {1:0.00} to {2:0.00} L/min")
format_3 = Format(Format=filter_25, Culture=127, Data0=average_3, Data1=dedomain_3.Start, Data2=dedomain_3.End)

average_4 = Average(Input=flatten(renumber_paths_3))
bnd_4 = Bounds(Numbers=flatten(renumber_paths_3))
multiplication_15 = Multiplication(A=average_4, B=0.01)
num_8 = Number(bnd_4)
larger_9 = LargerThan(FirstNumber=num_8, SecondNumber=multiplication_15)  # -> LargerThan, OrEqualTo
dedomain_4 = DeconstructDomain(Domain=bnd_4)  # -> Start, End
filter_26 = StreamFilter(Gate=larger_9.LargerThan, Stream0="AD1 : {0:0.00} mL/L", Stream1="AD1 : {1:0.00} to {2:0.00} mL/L")
format_4 = Format(Format=filter_26, Culture=127, Data0=average_4, Data1=dedomain_4.Start, Data2=dedomain_4.End)

printing_time_per_layer_s = Number(multiplication_11)
unflatten_tree_3 = UnflattenTree(Tree=insert_items_3, Guide=pt_2)  # disabled

average_5 = Average(Input=flatten(division))
bnd_5 = Bounds(Numbers=flatten(division))
multiplication_16 = Multiplication(A=average_5, B=0.01)
num_9 = Number(bnd_5)
larger_10 = LargerThan(FirstNumber=num_9, SecondNumber=multiplication_16)  # -> LargerThan, OrEqualTo
dedomain_5 = DeconstructDomain(Domain=bnd_5)  # -> Start, End
filter_27 = StreamFilter(Gate=larger_10.LargerThan, Stream0="Robot speed : {0:0.0} mm/s", Stream1="Robot speed : {1:0.0} to {2:0.0} mm/s")
format_5 = Format(Format=filter_27, Culture=127, Data0=average_5, Data1=dedomain_5.Start, Data2=dedomain_5.End)

bnd_6 = Bounds(Numbers=flatten(printing_time_per_layer_s))
division_7 = Division(A=angle_change, B=unflatten_tree_3)  # disabled
dedomain_6 = DeconstructDomain(Domain=bnd_6)  # -> Start, End
bar_graph = BarGraph(angle_change, BarColor=RGB(255, 0, 90))

average_6 = Average(Input=flatten(ma.Result))
format_6 = Format(Format="Volume : {0:0.0} L", Culture=127, Data0=average_6)

similar_8 = Similarity(FirstNumber=dedomain_6.Start, SecondNumber=dedomain_6.End, Threshold="5")  # -> Similarity, AbsoluteDifference

average_7 = Average(Input=flatten(multiplication_10))
format_7 = Format(Format="Premix quantity : {0:0.0} kg", Culture=127, Data0=average_7)

smtime = ConstructSmoothTime(Days=0, Hours=0, Minutes=0, Seconds=dedomain_6.End)
smtime_2 = ConstructSmoothTime(Days=0, Hours=0, Minutes=0, Seconds=dedomain_6.Start)

average_8 = Average(Input=flatten(multiplication_9))
format_8 = Format(Format="Weight : {0:0.0} kg", Culture=127, Data0=average_8)

smtime_3 = ConstructSmoothTime(Days=0, Hours=0, Minutes=ma_2.Result, Seconds=0)

average_9 = Average(Input=flatten(division_5))
format_9 = Format(Format="Vertical speed (Vz) : {0:0.0} mm/min", Culture=127, Data0=average_9)

concat = Concatenate(FragmentA=smtime_2, FragmentC=" to ", FragmentB=smtime)
concatenate = Concatenate(FragmentA="Printing time : ", FragmentB=smtime_3)
filter_28 = StreamFilter(Gate=similar_8.Similarity, Stream0=concat, Stream1=smtime)
filter_29 = StreamFilter(Gate=larger_4.LargerThan, Stream0="N/A", Stream1=filter_28)
concatenate_2 = Concatenate(FragmentA="Time between layers : ", FragmentB=filter_29)
tree_branch_2 = TreeBranch(Tree=replace_paths_3, Path="0", MaintainPaths=True)
filter_30 = StreamFilter(Gate=null_7.NullFlags, Stream0=format_4)
filter_31 = StreamFilter(Gate=null_8.NullFlags, Stream0=format_2)
filter_32 = StreamFilter(Gate=or_3, Stream1=deg)
lng_7 = ListLength(List=flatten(replace_paths_3))
larger_11 = LargerThan(FirstNumber=lng_7, SecondNumber="1")  # -> LargerThan, OrEqualTo

# ---- group: Tearing
max_tearing = Slider(30, range=0..100)
larger_than_4 = LargerThan(FirstNumber=division_6, SecondNumber=max_tearing)  # -> LargerThan, OrEqualTo
cull_pattern = CullPattern(List=pt_2, CullPattern=larger_than_4.LargerThan)
panel_12 = Panel("Some points have a Tearing problem (>30 s-1). Try lowering robot speed or increasing layer height on these points.")
list_item_5 = ListItem(List=flatten(cull_pattern), Index=0, Wrap=True)
null_item_3 = NullItem(Item=list_item_5)  # -> NullFlags, InvalidFlags, Description
stream_filter_4 = StreamFilter(Gate=null_item_3.NullFlags, Stream0=panel_12)

# ----
Z_2 = UnitZ(Factor=1)  # disabled
neg = Negative(Value=Z_2)  # disabled

# ---- group: Zone check
panel_13 = Panel("10")  # disabled
panel_14 = Panel("0")  # disabled
construct_domain = ConstructDomain(DomainStart=panel_14, DomainEnd=panel_13)  # disabled
integer_2 = Integer(renumber_paths_4)  # disabled
includes = Includes(Value=flatten(integer_2), Domain=construct_domain)  # -> Includes, Deviation; disabled
panel_15 = Panel("Zones are out of Bound, give a value of 0, 1 or 2")  # disabled
mass_multiplication_2 = MassMultiplication(Input=includes.Includes)  # -> Result, PartialResults; disabled
stream_filter_5 = StreamFilter(Gate=mass_multiplication_2.Result, Stream0=panel_15)  # disabled

# ----
list_length = ListLength(List=filter_10)
filter_33 = StreamFilter(Gate=similar_7.Similarity, Stream1=simplify(subd_points))  # disabled
list_length_2 = ListLength(List=replace_paths)
contact_points = Relay()
ma_4 = MassAddition(Input=tstat.Length)  # -> Result, PartialResults
swatch = ColourSwatch(SwatchColor=RGB(64, 64, 64))
concat_2 = Concatenate(FragmentA="Object name : ", FragmentB=object_name)
concat_3 = Concatenate(FragmentA="Number of points : ", FragmentB=ma_4.Result)
concat_4 = Concatenate(FragmentA="Number of layers : ", FragmentB=tstat.Count)
filter_34 = StreamFilter(Gate=or, Stream0=concat_3)
filter_35 = StreamFilter(Gate=or, Stream0=concat_4)
filter_36 = StreamFilter(Gate=or, Stream0=concat_2)
text = Text(ColourSwatch(SwatchColor=RGB(68, 42, 156)))
text_2 = Text(ColourSwatch(SwatchColor=RGB(255, 255, 255)))
text_3 = Text(ColourSwatch(SwatchColor=RGB(255, 179, 79)))
text_4 = Text(ColourSwatch(SwatchColor=RGB(255, 79, 79)))

# ---- group: Informations color
entwine = Entwine(Branch00=text, Branch01=text_2, Branch02=text_2, FlattenInputs=True)  # -> simplify(Result)

# ---- group: Informations
entwine_2 = Entwine(Branch00=list_item_2, Branch01=filter_36, FlattenInputs=True)  # -> simplify(Result)

# ----
clean_all = CleanAll(T=entwine)  # -> flatten(T_2)
clean_all_2 = CleanAll(T=entwine_2)  # -> flatten(T_2)
list_length_3 = ListLength(List=filter_17)
list_length_4 = ListLength(List=stream_filter_5)
list_length_5 = ListLength(List=filter_20)
repeat_data = RepeatData(Data=text_3, Length=list_length_3)
repeat_data_2 = RepeatData(Data=text_3, Length=list_length_4)
repeat_data_3 = RepeatData(Data=text_4, Length=list_length_5)

# ---- group: Check tree structure
tstat_3 = TreeStatistics(Tree=replace_paths_2)  # -> Paths, Length, Count
tstat_4 = TreeStatistics(Tree=replace_paths)  # -> Paths, Length, Count
tstat_5 = TreeStatistics(Tree=replace_paths_3)  # -> Paths, Length, Count
similarity = Similarity(FirstNumber=tstat_4.Count, SecondNumber=tstat_3.Count, Threshold=0.1)  # -> Similarity, AbsoluteDifference
similarity_2 = Similarity(FirstNumber=tstat_4.Length, SecondNumber=tstat_3.Length, Threshold=0.1)  # -> Similarity, AbsoluteDifference
similarity_3 = Similarity(FirstNumber=tstat_4.Length, SecondNumber=tstat_5.Length, Threshold=0.1)  # -> Similarity, AbsoluteDifference
similarity_4 = Similarity(FirstNumber=tstat_4.Count, SecondNumber=tstat_5.Count, Threshold=0.1)  # -> Similarity, AbsoluteDifference
mm = MassMultiplication(Input=similarity_2.Similarity)  # -> Result, PartialResults
mm_2 = MassMultiplication(Input=similarity_3.Similarity)  # -> Result, PartialResults
mm_3 = MassMultiplication(Input=similarity.Similarity)  # -> Result, PartialResults
mm_4 = MassMultiplication(Input=similarity_4.Similarity)  # -> Result, PartialResults

# ----
or_4 = GateOr(A=smaller_2.SmallerThan, B=mm.Result)
or_5 = GateOr(A=smaller_2.SmallerThan, B=mm_3.Result)
or_6 = GateOr(A=smaller.SmallerThan, B=mm_2.Result)
or_7 = GateOr(A=smaller.SmallerThan, B=mm_4.Result)

# ---- group: Check tree structure (continued)
gate_and_2 = GateAnd(A=or_4, B=or_6, D=or_5, E=or_7)

# ----
stream_filter_6 = StreamFilter(Gate=gate_and_2, Stream0=panel_2)
list_length_6 = ListLength(List=stream_filter_6)
repeat_data_4 = RepeatData(Data=text_3, Length=list_length_6)

# ---- group: W/H ratio
division_8 = Division(A=stream_gate_2.Target1, B=stream_gate.Target1)
average_10 = Average(Input=flatten(division_8))
sort_4 = SortList(Keys=flatten(division_8))  # -> Keys, ValuesA
item_15 = ListItem(List=sort_4.Keys, Index=0, Wrap=True)  # -> Item1, Item

# ----
format_10 = Format(Format="{0:0.0}", Culture=127, Data0=item_15.Item)
format_11 = Format(Format="{0:0.0}", Culture=127, Data0=item_15.Item1)

# ---- group: Double point check
panel_16 = Panel("-1")
shift = ShiftList(List=flatten(filter_6), Shift=1, Wrap=False)
cull_i_2 = CullIndex(List=flatten(filter_6), Indices=panel_16, Wrap=True)
dist = Distance(PointA=cull_i_2, PointB=shift)
abs_2 = Absolute(Value=dist)
sort_5 = SortList(Keys=abs_2)  # -> Keys, ValuesA
item_16 = ListItem(List=sort_5.Keys, Index=0, Wrap=True)
panel_17 = Panel("1")

# ----
format_12 = Format(Format="{0:0.0}", Culture=127, Data0=item_16)
list_item_6 = ListItem(List=flatten(format_12), Index=0, Wrap=True)

# ---- group: Double point check (continued)
concat_5 = Concatenate(FragmentA="Min distance between points : ", FragmentB=format_12, FragmentC=" mm")
smaller_4 = SmallerThan(FirstNumber=format_12, SecondNumber=panel_17)  # -> SmallerThan, OrEqualTo
panel_18 = Panel(concat_5)
filter_37 = StreamFilter(Gate=smaller_4.SmallerThan, Stream1="Distance between points < 1 mm ! Remove duplicate points")

# ----
null_item_4 = NullItem(Item=list_item_6)  # -> NullFlags, InvalidFlags, Description
smaller_5 = SmallerThan(FirstNumber=format_12, SecondNumber="0.05")  # -> SmallerThan, OrEqualTo
multiplication_17 = Multiplication(A=smaller_5.SmallerThan, B=2)
stream_filter_7 = StreamFilter(Gate=null_item_4.NullFlags, Stream0=panel_18)
smaller_6 = SmallerThan(FirstNumber=abs_2, SecondNumber=panel_17)  # -> SmallerThan, OrEqualTo
pt_4 = Point(cull_i_2)

# ---- group: Check reading frequency
robot_max_reading_frequency = Panel("25")
cull_i_3 = CullIndex(List=flatten(division), Indices=panel_16, Wrap=True)
division_9 = Division(A=cull_i_3, B=dist)
number_2 = Number(robot_max_reading_frequency)
larger_than_5 = LargerThan(FirstNumber=division_9, SecondNumber=number_2)  # -> LargerThan, OrEqualTo
cull_pattern_2 = CullPattern(List=pt_4, CullPattern=larger_than_5.LargerThan)

# ----
list_item_7 = ListItem(List=flatten(cull_pattern_2), Index=0, Wrap=True)
null_item_5 = NullItem(Item=list_item_7)  # -> NullFlags, InvalidFlags, Description
max_2 = Maximum(A=smaller_4.SmallerThan, B=multiplication_17)
cull = CullPattern(List=pt_4, CullPattern=smaller_6.SmallerThan)
null_item_6 = NullItem(Item=max_2)  # -> NullFlags, InvalidFlags, Description
filter_38 = StreamFilter(Gate=or_2, Stream0="Min distance between points : Not checked", Stream1=stream_filter_7)
stream_filter_8 = StreamFilter(Gate=null_item_5.NullFlags, Stream0=panel_8)
filter_39 = StreamFilter(Gate=or, Stream0=filter_38)
stream_filter_9 = StreamFilter(Gate=null_item_6.NullFlags, Stream0=max_2, Stream1="2")

# ---- group: Head orientation
average_11 = Average(Input=flatten(deg))
sort_6 = SortList(Keys=flatten(deg))  # -> Keys, ValuesA
item_17 = ListItem(List=sort_6.Keys, Index=0, Wrap=True)  # -> Item1, Item
similarity_5 = Similarity(FirstNumber=average_11, SecondNumber="0", Threshold=0.1)  # -> Similarity, AbsoluteDifference
panel_19 = Panel(" to ")
null_item_7 = NullItem(Item=average_11)  # -> NullFlags, InvalidFlags, Description
panel_20 = Panel("°")

# ----
format_13 = Format(Format="{0:0.0}", Culture=127, Data0=item_17.Item)
format_14 = Format(Format="{0:0.0}", Culture=127, Data0=item_17.Item1)
concat_6 = Concatenate(FragmentB=format_13, FragmentC=panel_19, FragmentD=format_14)
non_oriented = Boolean(similarity_5.Similarity)
stream_filter_10 = StreamFilter(Gate=null_item_7.NullFlags, Stream0=panel_20, Stream1="Not checked")
bool = Boolean(invert(similarity_5.Similarity))

# ---- group: Head orientation (continued)
filter_40 = StreamFilter(Gate=similarity_5.Similarity, Stream1=concat_6)
stream_filter_11 = StreamFilter(Gate=null_item_7.NullFlags, Stream0=bool, Stream1="0")
concat_7 = Concatenate(FragmentA="Head orientation :  ", FragmentE=format_14, FragmentB=stream_filter_10)
panel_21 = Panel(concat_7)

# ---- group: Width check
sort_7 = SortList(Keys=flatten(replace_paths_2))  # -> Keys, ValuesA
average_12 = Average(Input=flatten(replace_paths_2))
item_18 = ListItem(List=sort_7.Keys, Index=0, Wrap=True)  # -> Item1, Item
similarity_6 = Similarity(FirstNumber=average_12, SecondNumber=item_18.Item1, Threshold=0.1)  # -> Similarity, AbsoluteDifference
panel_22 = Panel("Layer width : ")
panel_23 = Panel(" mm")

# ---- group: W/H ratio (continued)
# Informations: Variable width : From .. to .. or Fixed width
# Variable heigth: From .. to .. or Fixed height
# Variable orientation: From .. to .. or non orientated
# Max slope
# Modes : speed, slope, width, height, start end,
similarity_7 = Similarity(FirstNumber=average_10, SecondNumber=item_18.Item1, Threshold=0.1)  # -> Similarity, AbsoluteDifference
smaller_7 = SmallerThan(FirstNumber=format_10, SecondNumber="3")  # -> SmallerThan, OrEqualTo
smaller_8 = SmallerThan(FirstNumber=format_10, SecondNumber="2")  # -> SmallerThan, OrEqualTo
larger_12 = LargerThan(FirstNumber=format_11, SecondNumber="6")  # -> LargerThan, OrEqualTo
# Auto checks: min distance between points
# Plane normal negatif
# W/H ratio
# Nozzle recommandation
# Check slope
# check width compensation at some points ?
# check intersections
# preview start end , check if start point is not lowest
# check deviation > recommand HAL toolpath preview
# check longueur max sans deviation
# check contact points
# check slope vs orientation
# check orientation smoothness
concat_8 = Concatenate(FragmentA="Width/Height ratio : ", FragmentB=format_10, FragmentC=" to ", FragmentD=format_11)
larger_13 = LargerThan(FirstNumber=format_11, SecondNumber="5")  # -> LargerThan, OrEqualTo
concat_9 = Concatenate(FragmentA="Width/Height ratio : ", FragmentB=format_10)
filter_41 = StreamFilter(Gate=similarity_7.Similarity, Stream0=concat_8, Stream1=concat_9)
or_8 = GateOr(A=smaller_8.SmallerThan, B=larger_12.LargerThan)
or_9 = GateOr(A=smaller_7.SmallerThan, B=larger_13.LargerThan)
multiplication_18 = Multiplication(A=or_8, B=2)
panel_24 = Panel(filter_41)
max_3 = Maximum(A=or_9, B=multiplication_18)

# ----
format_15 = Format(Format="{0:0.0}", Culture=127, Data0=item_18.Item1)
format_16 = Format(Format="{0:0.0}", Culture=127, Data0=item_18.Item)
bool_2 = Boolean(invert(similarity_6.Similarity))
stream_filter_12 = StreamFilter(Gate=mass_multiplication.Result, Stream0="2", Stream1=max_3)
list_item_8 = ListItem(List=flatten(stream_filter_12), Index=0, Wrap=True)
# To do: treat non grafted cases
# Add ratio preview
# Add 40° color to angles
# Replacing Closest point component (faster)
# correct ratio number ( To from)
# Replace color wheel with rainbow gradient
# Warnings: Did you compensate layer width ?
# Did you overlap at contact points ?
# Slope is > ... : you should do a printability simulation
# Is plan orientation following the slope orientation ?
# Did you check printing order ?
stream_filter_13 = StreamFilter(Gate=mass_multiplication.Result, Stream0="Width or Height values < 0.01 mm found", Stream1=panel_24)
null_item_8 = NullItem(Item=list_item_8)  # -> NullFlags, InvalidFlags, Description
stream_filter_14 = StreamFilter(Gate=null_item_8.NullFlags, Stream0=stream_filter_12)
fixed_width = Boolean(similarity_6.Similarity)

# ---- group: Width check
construct_domain_2 = ConstructDomain(DomainStart="15", DomainEnd="45")
merge = Merge(Data1=item_18.Item1, Data2=item_18.Item)
includes_2 = Includes(Value=flatten(merge), Domain=construct_domain_2)  # -> Includes, Deviation
mass_multiplication_3 = MassMultiplication(Input=includes_2.Includes)  # -> Result, PartialResults
stream_filter_15 = StreamFilter(Gate=mass_multiplication_3.Result, Stream0="Layer widths have an uncommon value, are you sure ?")

# ----
list_length_7 = ListLength(List=stream_filter_15)
repeat_data_5 = RepeatData(Data=text_3, Length=list_length_7)

# ---- group: Height check
sort_8 = SortList(Keys=flatten(replace_paths_3))  # -> Keys, ValuesA
average_13 = Average(Input=flatten(replace_paths_3))
item_19 = ListItem(List=sort_8.Keys, Index=0, Wrap=True)  # -> Item1, Item
similarity_8 = Similarity(FirstNumber=average_13, SecondNumber=item_19.Item1, Threshold=0.1)  # -> Similarity, AbsoluteDifference
panel_25 = Panel("Layer height : ")
panel_26 = Panel(" mm")

# ----
format_17 = Format(Format="{0:0.0}", Culture=127, Data0=item_19.Item1)
format_18 = Format(Format="{0:0.0}", Culture=127, Data0=item_19.Item)
bool_3 = Boolean(invert(similarity_8.Similarity))

# ---- group: Height check
construct_domain_3 = ConstructDomain(DomainStart="5", DomainEnd="12")
merge_2 = Merge(Data1=item_19.Item1, Data2=item_19.Item)
includes_3 = Includes(Value=flatten(merge_2), Domain=construct_domain_3)  # -> Includes, Deviation
mass_multiplication_4 = MassMultiplication(Input=includes_3.Includes)  # -> Result, PartialResults
stream_filter_16 = StreamFilter(Gate=mass_multiplication_4.Result, Stream0="Layer heights have an uncommon value, are you sure ?")

# ----
list_length_8 = ListLength(List=stream_filter_16)
repeat_data_6 = RepeatData(Data=text_3, Length=list_length_8)

# ---- group: Self-intersection
panel_27 = Panel("Self-intersections found : did you adjust crossing sections ?")
cx = CurveSelf(Curve=pline)  # -> Points, Params

# ----
list_item_9 = ListItem(List=flatten(cx.Points), Index=0, Wrap=True)
eval_2 = EvaluateCurve(Curve=pline_2, Parameter=cx.Params)  # -> Point, Tangent, Angle

# ---- group: Self-intersection (continued)
null_9 = NullItem(Item=list_item_9)  # -> NullFlags, InvalidFlags, Description
filter_42 = StreamFilter(Gate=null_9.NullFlags, Stream0=panel_27)
pt_5 = Point(eval_2.Point)

# ---- group: Z orientation check
panel_28 = Panel("0.01")

# ----
num_10 = Number(panel_28)

# ---- group: Z orientation check (continued)
larger_14 = LargerThan(FirstNumber=pdecon.ZComponent, SecondNumber=num_10)  # -> LargerThan, OrEqualTo
mm_5 = MassMultiplication(Input=flatten(larger_14.LargerThan))  # -> Result, PartialResults
cull_pattern_3 = CullPattern(List=deplane.Origin, CullPattern=invert(larger_14.LargerThan))  # -> flatten(List)
filter_43 = StreamFilter(Gate=mm_5.Result, Stream0="Some Planes have negative Z !")
panel_29 = Panel(filter_43)

# ---- group: Slope
tstat_6 = TreeStatistics(Tree=simplify(filter_10))  # -> Paths, Length, Count
cull_i_4 = CullIndex(List=tstat_6.Paths, Indices="-1", Wrap=True)
cull_i_5 = CullIndex(List=tstat_6.Paths, Indices="0", Wrap=True)
item_20 = ListItem(List=tstat_6.Paths, Index="0", Wrap=True)
branch = TreeBranch(Tree=simplify(filter_10), Path=item_20, MaintainPaths=True)
num_11 = Number("0")
crossref = CrossReference(ListA=branch, ListB=num_11, CrossMode=1)  # -> ListA, ListB
flatten = FlattenTree(Tree=crossref.ListB, Path=item_20)

# ----
branch_2 = TreeBranch(Tree=deplane_2.Origin, Path=cull_i_4, MaintainPaths=False)  # -> simplify(Branch)
branch_3 = TreeBranch(Tree=deplane_2.Origin, Path=cull_i_5, MaintainPaths=True)
pline_3 = PolyLine(Vertices=branch_2, Closed=False)  # -> simplify(Polyline)
branch_4 = TreeBranch(Tree=deplane.ZAxis, Path=cull_i_5, MaintainPaths=True)
branch_5 = TreeBranch(Tree=replace_paths_3, Path=cull_i_5, MaintainPaths=True)
filter_44 = StreamFilter(Gate=larger_11.LargerThan, Stream0=replace_paths_3, Stream1=branch_5)

# ---- group: Nozzle
sort_9 = SortList(Keys=flatten(cluster))  # -> Keys, ValuesA
item_21 = ListItem(List=sort_9.Keys, Index=0, Wrap=True)  # -> Item1, Item
expression_2 = Expression(s=item_21.Item1, Expression="(s*4/π)^0.5")
panel_30 = Panel("2")
panel_31 = Panel("Recommended nozzle diameter :  ")

# ----
mod_2 = Modulus(A=expression_2, B=panel_30)
subtraction_6 = Subtraction(A=expression_2, B=mod_2)
addition_2 = Addition(A=subtraction_6, B=panel_30)
merge_3 = Merge(Data1=flatten(addition_2), Data2=flatten(subtraction_2))

panel_32 = Panel("No optimal nozzle found, you should lower the W/H ratio bounds")
smaller_than = SmallerThan(FirstNumber=subtraction_2, SecondNumber=addition_2)  # -> SmallerThan, OrEqualTo
stream_filter_17 = StreamFilter(Gate=smaller_than.SmallerThan, Stream1=panel_32)

sort_10 = SortList(Keys=merge_3)  # -> Keys, ValuesA
item_22 = ListItem(List=sort_10.Keys, Index=0, Wrap=True)  # -> Item1, Item
stream_filter_18 = StreamFilter(Gate=smaller_than.SmallerThan, Stream0=item_22.Item1, Stream1=item_22.Item)
concat_10 = Concatenate(FragmentA=panel_31, FragmentB=item_22.Item, FragmentC=" to ", FragmentD=stream_filter_18, FragmentE=" mm")

# ---- group: Nozzle (continued)
panel_33 = Panel(concat_10)

# ----
stream_filter_19 = StreamFilter(Gate=null_item_2.NullFlags, Stream0=panel_33)
stream_filter_20 = StreamFilter(Gate=smaller_than.SmallerThan, Stream0=stream_filter_3, Stream1="1")
list_length_9 = ListLength(List=stream_filter_17)
repeat_data_7 = RepeatData(Data=text_4, Length=list_length_9)

# ---- group: Width check (continued)
concat_11 = Concatenate(FragmentB=format_16, FragmentC=" to ", FragmentD=format_15)
filter_45 = StreamFilter(Gate=similarity_6.Similarity, Stream0=concat_11, Stream1=format_15)

# ----
concat_12 = Concatenate(FragmentA=panel_22, FragmentD=filter_45, FragmentE=panel_23)

# ---- group: Width check (continued)
panel_34 = Panel(concat_12)

# ---- group: Height check (continued)
concat_13 = Concatenate(FragmentB=format_18, FragmentC=" to ", FragmentD=format_17)
filter_46 = StreamFilter(Gate=similarity_8.Similarity, Stream0=concat_13, Stream1=format_17)

# ----
concat_14 = Concatenate(FragmentA=panel_25, FragmentD=filter_46, FragmentE=panel_26)

# ---- group: Height check (continued)
panel_35 = Panel(concat_14)

# ---- group: Shrinkage test
longueur_max_fissures = Slider(1000, range=0..1000)
angle_déviation_max = Slider(1, range=0..10)
deg_2 = Degrees(Radians=eval.Angle)
larger_15 = LargerThan(FirstNumber=deg_2, SecondNumber=angle_déviation_max)  # -> LargerThan, OrEqualTo
panel_36 = Panel("Potential shrinkage detected.")

# ----
cull_2 = CullPattern(List=series_4, CullPattern=larger_15.LargerThan)

# ---- group: Shrinkage test (continued)
shatter = Shatter(Curve=pline_2, Parameters=cull_2)
len_3 = Length(Curve=shatter)
larger_16 = LargerThan(FirstNumber=len_3, SecondNumber=longueur_max_fissures)  # -> LargerThan, OrEqualTo
cull_3 = CullPattern(List=shatter, CullPattern=larger_16.LargerThan)

# ----
explode_2 = Explode(Curve=cull_3, Recursive=True)  # -> Segments, flatten(Vertices)
list_item_10 = ListItem(List=flatten(cull_3), Index=0, Wrap=True)
null_item_9 = NullItem(Item=list_item_10)  # -> NullFlags, InvalidFlags, Description
stream_filter_21 = StreamFilter(Gate=null_item_9.NullFlags, Stream0=panel_36)

# ---- group: Slope (continued)
crv_cp = CurveClosestPoint(Point=branch_3, Curve=reparameterize(pline_3))  # -> Point, Parameter, Distance
vec2pt = Vector2Pt(PointA=crv_cp.Point, PointB=branch_3, Unitize=False)  # -> Vector, Length

# ----
eval_3 = EvaluateCurve(Curve=reparameterize(pline_3), Parameter=crv_cp.Parameter)  # -> Point, Tangent, Angle
xy = XYPlane(Origin=Point(0, 0, 0))
project_4 = Project(Geometry=eval_3.Tangent, Plane=branch_4)  # -> Geometry, Transform
pl = PlaneNormal(Origin=branch_3, ZAxis=project_4.Geometry)
project_5 = Project(Geometry=vec2pt.Vector, Plane=pl)  # -> Geometry, Transform

list_item_11 = ListItem(List=project_5.Geometry, Index=0, Wrap=True)  # -> Item2, Item1, Item, Item1_2
replace_items = ReplaceItems(List=project_5.Geometry, Item=list_item_11.Item2, Indices="-1", Wrap=True)
replace_items_2 = ReplaceItems(List=replace_items, Item=list_item_11.Item1_2, Indices="0", Wrap=True)
angle_2 = Angle(VectorA=branch_4, VectorB=replace_items_2)  # -> Angle, Reflex
angle_3 = Angle(VectorA=unit_z, VectorB=replace_items_2)  # -> Angle, Reflex
merge_4 = Merge(Data1=simplify(angle_2.Angle), Data2=simplify(flatten))

# ---- group: Slope (continued)
deg_3 = Degrees(Radians=angle_3.Angle)

# ----
merge_5 = Merge(Data1=simplify(deg_3), Data2=simplify(flatten))

# ---- group: Critère local
rad = Radians(Degrees=merge_5)
sin = Sine(Value=merge_4)
division_10 = Division(A=filter_18, B=2)
multiplication_19 = Multiplication(A=vec2pt.Length, B=sin)
ratio_de_cordon_en_l_air = Slider(0.49, range=0..1)
addition_3 = Addition(A=division_10, B=multiplication_19)
division_11 = Division(A=addition_3, B=filter_16)
larger_17 = LargerThan(FirstNumber=division_11, SecondNumber=ratio_de_cordon_en_l_air)  # -> LargerThan, OrEqualTo
cull_4 = CullPattern(List=branch_3, CullPattern=larger_17.LargerThan)

# ----
list_item_12 = ListItem(List=flatten(cull_4), Index=0, Wrap=True)
null_item_10 = NullItem(Item=list_item_12)  # -> NullFlags, InvalidFlags, Description
stream_filter_22 = StreamFilter(Gate=null_item_10.NullFlags, Stream0=panel_10)

# ---- group: Flying points
max_slope_warning = Slider(45, range=0..100)
larger_than_6 = LargerThan(FirstNumber=merge_5, SecondNumber=max_slope_warning)  # -> LargerThan, OrEqualTo
cull_pattern_4 = CullPattern(List=deplane_2.Origin, CullPattern=larger_than_6.LargerThan)
list_item_13 = ListItem(List=flatten(cull_pattern_4), Index=0, Wrap=True)
null_item_11 = NullItem(Item=list_item_13)  # -> NullFlags, InvalidFlags, Description
stream_filter_23 = StreamFilter(Gate=null_item_11.NullFlags, Stream0="Some points have a high slope (>45°).")

# ---- group: Spread
etalement_min = Slider(10, range=0..100)
etalement_max = Slider(30, range=0..100)
dom = ConstructDomain(DomainStart=etalement_min, DomainEnd=etalement_max)
subtraction_7 = Subtraction(A=etalement_max, B=etalement_min)
range = Range(Domain=dom, Steps=subtraction_7)
expression_3 = Expression(x=range, Expression="1.565*x² - 83.534*x + 1142.6")
consec = ConsecutiveDomains(Numbers=expression_3, Additive=False)
consec_2 = ConsecutiveDomains(Numbers=range, Additive=False)
inc = Includes(Value=dedomain.Start, Domain=consec)  # -> Includes, Deviation
inc_2 = Includes(Value=dedomain.End, Domain=consec)  # -> Includes, Deviation
cull_5 = CullPattern(List=consec_2, CullPattern=inc.Includes)
cull_6 = CullPattern(List=consec_2, CullPattern=inc_2.Includes)
dedomain_7 = DeconstructDomain(Domain=cull_5)  # -> Start, End
dedomain_8 = DeconstructDomain(Domain=cull_6)  # -> Start, End

# ----
merge_6 = Merge(
    Data1=simplify(dedomain_7.Start),
    Data2=simplify(dedomain_7.End),
    Data3=simplify(dedomain_8.Start),
    Data4=simplify(dedomain_8.End))
sort_11 = SortList(Keys=merge_6)  # -> Keys, ValuesA
item_23 = ListItem(List=sort_11.Keys, Index=0, Wrap=True)  # -> Item1, Item
smaller_9 = SmallerThan(FirstNumber=item_23.Item, SecondNumber="15.9")  # -> SmallerThan, OrEqualTo
larger_18 = LargerThan(FirstNumber=item_23.Item1, SecondNumber="20.1")  # -> LargerThan, OrEqualTo

# ---- group: Spread (continued)
format_19 = Format(Format="Concrete target spread : {1:0} to {2:0} cm", Culture=127, Data1=item_23.Item, Data2=item_23.Item1)

# ----
or_10 = GateOr(A=smaller_9.SmallerThan, B=larger_18.LargerThan)
entwine_3 = Entwine(
    Branch00=format_6,
    Branch01=format_8,
    Branch02=format_7,
    Branch03=format_3,
    Branch04=concatenate,
    Branch05=concatenate_2,
    Branch06=format_5,
    Branch07=format_9,
    Branch08=filter_30,
    Branch09=filter_31,
    Branch010=format,
    Branch011=format_19,
    FlattenInputs=True)  # -> flatten(Result)
printing_info = Panel(entwine_3)
entwine_4 = Entwine(Branch01="-- Printing informations --", Branch02=entwine_3, FlattenInputs=True)
clean_all_3 = CleanAll(T=entwine_4)  # -> flatten(T_2)

# ---- group: Length
ma_5 = MassAddition(Input=len)  # -> Result, PartialResults
panel_37 = Panel("1000")

# ----
num_12 = Number(panel_37)

# ---- group: Length (continued)
division_12 = Division(A=ma_5.PartialResults, B=num_12)

# ---- group: Delta orientation
max_slope_warning_2 = Slider(11, range=0..100)
larger_than_7 = LargerThan(FirstNumber=angle_change, SecondNumber=max_slope_warning_2)  # -> LargerThan, OrEqualTo
cull_pattern_5 = CullPattern(List=pt_2, CullPattern=larger_than_7.LargerThan)
panel_38 = Panel("Head orientation changes too fast at some points (Δ>{0}°)")
list_item_14 = ListItem(List=flatten(cull_pattern_5), Index=0, Wrap=True)
null_item_12 = NullItem(Item=list_item_14)  # -> NullFlags, InvalidFlags, Description

# ----
format_20 = Format(Format=panel_38, Culture=127, Data0=max_slope_warning_2)

# ---- group: Delta orientation (continued)
stream_filter_24 = StreamFilter(Gate=null_item_12.NullFlags, Stream0=format_20)

# ---- group: First layer Height check
tree_branch_3 = TreeBranch(Tree=deplane.ZAxis, Path="0", MaintainPaths=True)
tree_branch_4 = TreeBranch(Tree=deplane.Origin, Path="0", MaintainPaths=True)
reverse = Reverse(Vector=tree_branch_3)
amplitude = Amplitude(Vector=reverse, Amplitude=tree_branch_2)
move = Move(Geometry=tree_branch_4, Motion=amplitude)  # -> Geometry, Transform
plane_fit = PlaneFit(Points=move.Geometry)  # -> Plane, Deviation
panel_39 = Panel("""0
0.25
1
20""")
format_21 = Format(Format="{0:0.0}", Culture=127, Data0=plane_fit.Deviation)
consecutive_domains = ConsecutiveDomains(Numbers=panel_39, Additive=False)
includes_4 = Includes(Value=format_21, Domain=consecutive_domains)  # -> Includes, Deviation
list_length_10 = ListLength(List=consecutive_domains)
series_5 = Series(Start=0, Step=1, Count=list_length_10)
cull_pattern_6 = CullPattern(List=series_5, CullPattern=includes_4.Includes)
panel_40 = Panel("First layer heights & planes do not constitute a planar base (Δ = ")
concatenate_3 = Concatenate(Fragment_A=panel_40, A=format_21, Fragment_B=" mm)")
stream_filter_25 = StreamFilter(Gate=cull_pattern_6, Stream1=concatenate_3, Stream2=concatenate_3)

# ----
stream_filter_26 = StreamFilter(Gate=cull_pattern_6, Stream1=cull_pattern_6, Stream2=cull_pattern_6)

# ---- group: First layer Height check (continued)
fl_check_colour = Integer(stream_filter_26)

# ---- group: Warnings
# Contact points advices : print first the segments you dont want to move + overlap layer width using formula x = (1-pi/4)*H
subtraction_8 = Subtraction(A=filter_32, B=merge_5)
abs_3 = Absolute(Value=subtraction_8)
panel_41 = Panel("Contact points detected ! See them on 'Warnings' Preview mode")
null_10 = NullItem()  # -> NullFlags, InvalidFlags, Description
item_24 = ListItem(List=null_10.NullFlags, Index=0, Wrap=True)
filter_47 = StreamFilter(Gate=item_24, Stream0=panel_41)
panel_42 = Panel(filter_47)
panel_43 = Panel("Slope detected, you should compensate layer widths regarding to the slope or orient plane normals.")

sort_12 = SortList(Keys=flatten(abs_3))  # -> Keys, ValuesA
item_25 = ListItem(List=sort_12.Keys, Index=0, Wrap=True)  # -> Item1, Item

# ----
format_22 = Format(Format="{0:0.0}", Culture=127, Data0=item_25.Item1)

# ---- group: Warnings (continued)
concat_15 = Concatenate(FragmentA="Planes orientations are not following the slope (Δmax = ", FragmentB=format_22, FragmentC="°).")
panel_44 = Panel(concat_15)

# ---- group: Height check
dprod = DotProduct(VectorA=replace_items_2, VectorB=branch_4, Unitize=False)
subtraction_9 = Subtraction(A=filter_44, B=dprod)
abs_4 = Absolute(Value=subtraction_9)
num_13 = Number("0.25")
larger_19 = LargerThan(FirstNumber=abs_4, SecondNumber=num_13)  # -> LargerThan, OrEqualTo
lng_8 = ListLength(List=flatten(abs_4))
sort_13 = SortList(Keys=flatten(abs_4))  # -> reverse(Keys), ValuesA
item_26 = ListItem(List=sort_13.Keys, Index=0, Wrap=True)
panel_45 = Panel("{0:0.0} % of layer heights do not match points position (Δmax = {1:0.0} mm)")

# ----
line = LineSDL(Start=branch_3, Direction=neg, Length=subtraction_9)  # disabled
cull_7 = CullPattern(List=abs_4, CullPattern=larger_19.LargerThan)
cull_8 = CullPattern(List=branch_3, CullPattern=larger_19.LargerThan)  # -> flatten(List)

# ---- group: Height check (continued)
lng_9 = ListLength(List=flatten(cull_7))
division_13 = Division(A=lng_9, B=lng_8)
multiplication_20 = Multiplication(A=division_13, B=100)
format_23 = Format(Format=panel_45, Culture=127, Data0=multiplication_20, Data1=item_26)
list_item_15 = ListItem(List=flatten(cull_7), Index=0, Wrap=True)
null_item_13 = NullItem(Item=list_item_15)  # -> NullFlags, InvalidFlags, Description
stream_filter_27 = StreamFilter(Gate=null_item_13.NullFlags, Stream0=format_23)

# ----
entwine_5 = Entwine(
    Branch00=object_name,
    Branch01=replace_paths,
    Branch02=list_length_2,
    Branch03=replace_paths_2,
    Branch04=replace_paths_3,
    Branch05=integer_2,
    Branch06=deplane.Origin,
    Branch07=pline_2,
    Branch08=list_length,
    Branch09=division,
    Branch010=merge_5,
    Branch011=deg,
    Branch012=accelerations_mm_s_2,
    Branch013=flow_rate_l_min,
    Branch014=renumber_paths_3,
    Branch015=renumber_paths_2,
    Branch016=cull,
    Branch017=contact_points,
    Branch018=filter_33,
    Branch019=pt_5,
    Branch020=explode_2.Vertices,
    Branch021=cull_4,
    Branch022=cull_pattern_2,
    Branch023=cull_pattern_4,
    Branch024=cull_pattern_3,
    Branch025=cull_pattern_5,
    Branch026=cull_pattern,
    Branch027=cull_8,
    FlattenInputs=True)
entwine_6 = Entwine(
    Branch01=cull,
    Branch02=contact_points,
    Branch03=pt_5,
    Branch04=explode_2.Vertices,
    Branch05=cull_4,
    Branch06=cull_pattern_2,
    Branch07=cull_pattern_4,
    Branch08=cull_pattern_3,
    Branch09=cull_pattern_5,
    Branch010=cull_pattern,
    Branch011=cull_8,
    FlattenInputs=True)
visualisation_data = ClusterOutput(entwine_5)
list_length_11 = ListLength(List=entwine_6)
larger_than_8 = LargerThan(FirstNumber=list_length_11, SecondNumber="0")  # -> LargerThan, OrEqualTo
mass_addition = MassAddition(Input=flatten(larger_than_8.LargerThan))  # -> Result, PartialResults

range_2 = Range(Domain=Domain(0, 1), Steps=mass_addition.Result)
cull_i_6 = CullIndex(List=range_2, Indices="0", Wrap=True)
gradient = Gradient(
    LowerLimit=0,
    UpperLimit=1,
    Parameter=cull_i_6,
    stops=[0: RGB(243, 57, 0), 0.1: RGB(236, 27, 60), 0.2: RGB(210, 0, 118), 0.3: RGB(103, 0, 120), 0.4: RGB(39, 72, 161), 0.5: RGB(1, 192, 229), 0.6: RGB(18, 178, 90), 0.7: RGB(79, 186, 8), 0.8: RGB(220, 237, 32), 0.9: RGB(247, 159, 20), 1: RGB(243, 57, 0)])

text_5 = Text(flatten(gradient))
text_6 = Text(flatten(gradient))
merge_7 = Merge(Data1=text_6, Data2=simplify(entwine_6))
list_length_12 = ListLength(List=merge_7)
warnings_keys_for_speckle = ClusterOutput(list_length_12)
warnings_for_speckle = ClusterOutput(merge_7)

# ---- group: Warnings
sort_14 = SortList(Keys=flatten(merge_5))  # -> Keys, ValuesA
item_27 = ListItem(List=sort_14.Keys, Index=0, Wrap=True)  # -> Item1, Item

format_24 = Format(Format="{0:0.0}", Culture=127, Data0=item_27.Item1)
larger_20 = LargerThan(FirstNumber=format_24, SecondNumber="10")  # -> LargerThan, OrEqualTo
larger_21 = LargerThan(FirstNumber=format_22, SecondNumber="0.1")  # -> LargerThan, OrEqualTo
larger_22 = LargerThan(FirstNumber=format_24, SecondNumber="40")  # -> LargerThan, OrEqualTo
larger_23 = LargerThan(FirstNumber=format_24, SecondNumber="30")  # -> LargerThan, OrEqualTo
multiplication_21 = Multiplication(A=larger_22.LargerThan, B=2)
list_item_16 = ListItem(List=flatten(item_27.Item1), Index=0, Wrap=True)
max_4 = Maximum(A=larger_23.LargerThan, B=multiplication_21)
null_item_14 = NullItem(Item=list_item_16)  # -> NullFlags, InvalidFlags, Description
filter_48 = StreamFilter(Gate=larger_21.LargerThan, Stream1=panel_44)  # disabled
stream_filter_28 = StreamFilter(Gate=null_item_14.NullFlags, Stream0=max_4)

# ----
null_item_15 = NullItem(Item=larger_20.LargerThan)  # -> NullFlags, InvalidFlags, Description
stream_filter_29 = StreamFilter(Gate=null_item_15.NullFlags, Stream0=larger_20.LargerThan, Stream1="0")

# ---- group: Warnings (continued)
concat_16 = Concatenate(FragmentA="Max slope : ", FragmentB=format_24, FragmentC="°")
panel_46 = Panel(concat_16)

# ----
gate_and_3 = GateAnd(A=fixed_width, B=stream_filter_29)

# ---- group: Warnings (continued)
filter_49 = StreamFilter(Gate=gate_and_3, Stream1=panel_43)
stream_filter_30 = StreamFilter(Gate=null_item_14.NullFlags, Stream0=panel_46)

# ---- group: Informations color
entwine_7 = Entwine(
    Branch00="0",
    Branch01="0",
    Branch02=stream_filter_11,
    Branch03=bool_2,
    Branch04=bool_3,
    Branch05=stream_filter_9,
    Branch06=stream_filter_14,
    Branch07=stream_filter_28,
    Branch08=stream_filter_20,
    FlattenInputs=True)  # -> simplify(Result)

# ---- group: Informations
entwine_8 = Entwine(
    Branch00="-- Object informations --",
    Branch01=filter_35,
    Branch02=filter_34,
    Branch03=panel_21,
    Branch04=panel_34,
    Branch05=panel_35,
    Branch06=filter_39,
    Branch07=stream_filter_13,
    Branch08=stream_filter_30,
    Branch09=stream_filter_19,
    FlattenInputs=True)  # -> simplify(Result)

# ----
clean_all_4 = CleanAll(T=entwine_7)  # -> flatten(T_2)
clean_all_5 = CleanAll(T=entwine_8)  # -> flatten(T_2)
list_length_13 = ListLength(List=filter_48)
list_length_14 = ListLength(List=filter_49)

# ---- group: Warnings
entwine_9 = Entwine(
    Branch01="-- Warnings --",
    Branch02=filter_20,
    Branch03=filter_48,
    Branch04=filter_49,
    Branch05=stream_filter_17,
    Branch06=stream_filter_6,
    Branch07=stream_filter_5,
    Branch08=stream_filter_15,
    Branch09=stream_filter_16,
    Branch010=filter_17,
    Branch011=stream_filter_25,
    Branch014=filter_37,
    Branch015=panel_42,
    Branch016=filter_42,
    Branch017=stream_filter_21,
    Branch018=stream_filter_22,
    Branch019=stream_filter_8,
    Branch020=stream_filter_23,
    Branch021=panel_29,
    Branch022=stream_filter_24,
    Branch023=stream_filter_4,
    Branch024=stream_filter_27,
    FlattenInputs=True)  # -> simplify(Result)

# ----
repeat_data_8 = RepeatData(Data=text_2, Length=list_length_13)
repeat_data_9 = RepeatData(Data=text_3, Length=list_length_14)

merge_8 = Merge(Data1=text_2, Data2=text_3, Data3=text_4)
item_28 = ListItem(List=merge_8, Index=clean_all_4, Wrap=True)

list_item_17 = ListItem(List=merge_8, Index=fl_check_colour, Wrap=True)
clean_all_6 = CleanAll(T=entwine_9)  # -> flatten(T_2)

# ---- group: Printing infos variable colors
item_29 = ListItem(List=merge_8, Index=larger_8.LargerThan, Wrap=True)
item_30 = ListItem(List=merge_8, Index=larger_9.LargerThan, Wrap=True)
item_31 = ListItem(List=merge_8, Index=larger_7.LargerThan, Wrap=True)
item_32 = ListItem(List=merge_8, Index=or_10, Wrap=True)
list_length_15 = ListLength(List=entwine_3)
merge_9 = Merge(Data1=flatten(item_29), Data2=flatten(item_30), Data3=flatten(item_31), Data4=flatten(item_32))
repeat_data_10 = RepeatData(Data=text_2, Length=list_length_15)
panel_47 = Panel("""3
8
9
11""")
replace = ReplaceItems(List=repeat_data_10, Item=merge_9, Indices=panel_47, Wrap=False)

# ---- group: Warinings color
entwine_10 = Entwine(
    Branch01=repeat_data_3,
    Branch04=repeat_data_8,
    Branch05=repeat_data_9,
    Branch07=repeat_data_7,
    Branch08=repeat_data_4,
    Branch09=repeat_data_2,
    Branch010=repeat_data_5,
    Branch011=repeat_data_6,
    Branch015=repeat_data,
    Branch017=list_item_17,
    Branch020=text_5,
    FlattenInputs=True)  # -> simplify(Result)

# ----
clean_all_7 = CleanAll(T=entwine_10)  # -> flatten(T_2)
merge_10 = Merge(
    Data1=flatten(clean_all),
    Data2=flatten(text),
    Data3=flatten(item_28),
    Data4=flatten(text_2),
    Data5=flatten(text),
    Data6=flatten(clean_all_7),
    Data7=flatten(text_2),
    Data8=flatten(text),
    Data9=flatten(replace))
merge_11 = Merge(Data1=clean_all_2, Data2=clean_all_5, Data3=clean_all_6, Data4=clean_all_3)
filter_50 = StreamFilter(Gate=or, Stream0=merge_10)
colours = Data(filter_50)
# -- BASE --
# 
# 
# Base name : base1500x1000_2
# 
# -- OBJECT GEOMETRY --
# 
# 
# Object name : Gaby02_47mmsec_7dLmin
# Variable width (28 - 38.8 mm)
# Variable height (5 - 12.5 mm)
# Number of layers : 134
# Number of object points : 3818
# Number of session points : 3822
# Total length : 76 m
# Material consumption : 19 L (44 kg)
# Premix quantity : 40 kg
# Closest points : 19 mm
# 
# -- SYSTEM CALCULATIONS --
# 
# 
# Flow rate : 0.7 L/min
# Total printing time : 0 h 28 min
# Nominal robot speed : 47 mm/s
# Robot speed range : 25 - 60 mm/s (53 - 128 %)
# Time between layers : 6.2 - 24.6 s
# Vertical speed : 37.2 mm/min (12.7 - 73 mm/min)
# 
# -- RAFT --
# 
# 
# No raft selected
colours_2 = ClusterOutput(colours)
tags = ClusterOutput(merge_11)

# ==== cluster CleanAll: Clean All
T = ClusterInput()
clean = CleanTree(RemoveNulls="True", RemoveInvalid="True", RemoveEmpty="True", Tree=T)
T_2 = ClusterOutput(clean)

# ==== cluster Cluster
relay = ClusterInput()
flatten = FlattenTree(Tree=relay, Path="{0}")
number_slider = Slider(20, range=0..100)
bnd = Bounds(Numbers=flatten)
num = Number(bnd)
dedomain = DeconstructDomain(Domain=bnd)  # -> Start, End
division = Division(A=num, B=number_slider)
series = Series(Start=dedomain.Start, Step=division, Count=number_slider)
consec = ConsecutiveDomains(Numbers=series, Additive=False)  # -> graft(Domains)
inc = Includes(Value=flatten, Domain=consec)  # -> Includes, Deviation
cull = CullPattern(List=flatten, CullPattern=inc.Includes)
lng = ListLength(List=cull)
sort_list = SortList(Keys=flatten(lng))  # -> reverse(Keys), ValuesValuesA
min = Slider(0.01, range=0..0.1)
list_item = ListItem(List=sort_list.Keys, Index=0, Wrap=True)
multiplication = Multiplication(A=list_item, B=min)
smaller = SmallerThan(FirstNumber=lng, SecondNumber=multiplication)  # -> SmallerThan, OrEqualTo
cull_2 = CullPattern(List=cull, CullPattern=invert(smaller.SmallerThan))
bounds = Bounds(Numbers=flatten(cull_2))
deconstruct_domain = DeconstructDomain(Domain=bounds)  # -> Start, End
maximum = Maximum(A=relay, B=deconstruct_domain.Start)
minimum = Minimum(A=maximum, B=deconstruct_domain.End)
result = ClusterOutput(minimum)

# ==== cluster RenumberPaths
data = ClusterInput()  # Data to renumber
tree_statistics = TreeStatistics(Tree=data)  # -> Paths, Length, Count
series = Series(Start=0, Step=1, Count=tree_statistics.Count)
replace_paths = ReplacePaths(Data=data, Search=tree_statistics.Paths, Replace=series)
renumbered_data = ClusterOutput(replace_paths)
