# Grasshopper definition Toolpath_Analysis_text.gh (Grasshopper 1.0.8)
# Copyright: @felipe__penagos
# Copyright: Reserved

xobject = GetString(AtLeast=1, AtMost=1, TreeAccess=False)
value_list = ValueList({"Only calculations": -1, "Default analysis": 0, "Advanced analysis": 1}, selected="Default analysis")
reload = Button()
txt = Text(xobject)
cluster = Cluster_2(check_mode=value_list, toolpath_object=txt, reload=reload)  # -> colours_2, tags, warnings_for_speckle, warnings_keys_for_speckle, visualisation_data
txt_2 = Text(cluster.tags)
txt_3 = Text(cluster.colours_2)
context_print = ContextPrint(Colours=txt_3)
context_print_2 = ContextPrint(Text=txt_2)

# ==== cluster Cluster_2
check_mode = ClusterInput()
toolpath_object = ClusterInput()
reload = ClusterInput()
boolean = Boolean(reload)
toolpath_object_decoder_v0_0_2 = ToolpathObjectDecoderV002(S=toolpath_object, reload=boolean)  # -> planes, layer_widths, layer_heights, zones, flow_rate, primary_proportion, secondary_proportion, x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
layer_heights = Number(toolpath_object_decoder_v0_0_2.layer_heights)
layer_widths = Number(toolpath_object_decoder_v0_0_2.layer_widths)
object_name = Text(flatten(toolpath_object_decoder_v0_0_2.objectname_2))
flowrate = Number(toolpath_object_decoder_v0_0_2.flow_rate)
zones = Integer(toolpath_object_decoder_v0_0_2.zones)
ad1 = Number(toolpath_object_decoder_v0_0_2.primary_proportion)
ad2 = Number(toolpath_object_decoder_v0_0_2.secondary_proportion)
planes = Plane(toolpath_object_decoder_v0_0_2.planes)
designer = Text(flatten(toolpath_object_decoder_v0_0_2.designer_2))
renumber_paths = RenumberPaths(data=flowrate)
renumber_paths_2 = RenumberPaths(data=ad2)
renumber_paths_3 = RenumberPaths(data=ad1)
renumber_paths_4 = RenumberPaths(data=zones)
renumber_paths_5 = RenumberPaths(data=layer_heights)
renumber_paths_6 = RenumberPaths(data=planes)
renumber_paths_7 = RenumberPaths(data=layer_widths)
panel = Panel("""Mode : Quick analysis (-1)
Mode : Default analysis (0)
Mode : Advanced analysis (1)
Mode : Advanced analysis (1)""")
integer = Integer(check_mode)
printing_material = Number()
flow_rate_l_min = Number(renumber_paths)
list_item = ListItem(List=flatten(integer), Index=0, Wrap=True)
item = ListItem(List=flatten(flow_rate_l_min), Index=0, Wrap=True)
item_2 = ListItem(List=flatten(printing_material), Index=0, Wrap=True)
null = NullItem(Item=list_item)  # -> NullFlags, InvalidFlags, Description

item_3 = ListItem(List=flatten(renumber_paths_6), Index=0, Wrap=True)
item_4 = ListItem(List=flatten(renumber_paths_7), Index=0, Wrap=True)
item_5 = ListItem(List=flatten(renumber_paths_5), Index=0, Wrap=True)
null_2 = NullItem(Item=item_5)  # -> NullFlags, InvalidFlags, Description
null_3 = NullItem(Item=item_4)  # -> NullFlags, InvalidFlags, Description
null_4 = NullItem(Item=item_3)  # -> NullFlags, InvalidFlags, Description
or = GateOr(A=null_4.NullFlags, B=null_3.NullFlags, C=null_2.NullFlags)
filter = StreamFilter(Gate=or, Stream0=renumber_paths_6)
filter_2 = StreamFilter(Gate=or, Stream0=renumber_paths_5)
filter_3 = StreamFilter(Gate=or, Stream0=renumber_paths_7)

null_5 = NullItem(Item=item_2)  # -> NullFlags, InvalidFlags, Description
stream_filter = StreamFilter(Gate=null.NullFlags, Stream0=list_item, Stream1="0")
null_6 = NullItem(Item=item)  # -> NullFlags, InvalidFlags, Description
num = Number("1")
filter_4 = StreamFilter(Gate=null_5.NullFlags, Stream0=item_2, Stream1="0")
multiplication = Multiplication(A=stream_filter, B=2)
filter_5 = StreamFilter(Gate=null_6.NullFlags, Stream0=flow_rate_l_min, Stream1=num)
max = Maximum(A=stream_filter, B="-1")
min = Minimum(A=max, B="2")
addition = Addition(A=min, B=1)

tree_statistics = TreeStatistics(Tree=filter)  # -> Paths, Length, Count
series = Series(Start=0, Step=1, Count=tree_statistics.Count)
replace_paths = ReplacePaths(Data=filter, Search=tree_statistics.Paths, Replace=series)

list_item_2 = ListItem(List=panel, Index=addition, Wrap=True)

tree_statistics_2 = TreeStatistics(Tree=filter_3)  # -> Paths, Length, Count
series_2 = Series(Start=0, Step=1, Count=tree_statistics_2.Count)
replace_paths_2 = ReplacePaths(Data=filter_3, Search=tree_statistics_2.Paths, Replace=series_2)

lng = ListLength(List=flatten(replace_paths_2))
check_mode_2 = Data(addition)

tree_statistics_3 = TreeStatistics(Tree=filter_2)  # -> Paths, Length, Count
series_3 = Series(Start=0, Step=1, Count=tree_statistics_3.Count)
replace_paths_3 = ReplacePaths(Data=filter_2, Search=tree_statistics_3.Paths, Replace=series_3)

lng_2 = ListLength(List=flatten(replace_paths_3))
smaller = SmallerThan(FirstNumber=lng_2, SecondNumber="1.1")  # -> SmallerThan, OrEqualTo
smaller_2 = SmallerThan(FirstNumber=lng, SecondNumber="1.1")  # -> SmallerThan, OrEqualTo
panel_2 = Panel("Planes, widths or heights do not have the same tree structure.")
number = Number("0.01")

# ---- group: No check
similar = Similarity(FirstNumber=check_mode_2, SecondNumber="0", Threshold=0.1)  # -> Similarity, AbsoluteDifference
similar_2 = Similarity(FirstNumber=check_mode_2, SecondNumber="2", Threshold=0.1)  # -> Similarity, AbsoluteDifference
similar_3 = Similarity(FirstNumber=check_mode_2, SecondNumber="1", Threshold=0.1)  # -> Similarity, AbsoluteDifference
or_2 = GateOr(A=similar_3.Similarity, B=similar_2.Similarity, C=similar.Similarity)
filter_6 = StreamFilter(Gate=or_2, Stream1=replace_paths)  # -> simplify(Stream)

# ----
larger_than = LargerThan(FirstNumber=flatten(replace_paths_3), SecondNumber=number)  # -> LargerThan, OrEqualTo
larger_than_2 = LargerThan(FirstNumber=flatten(replace_paths_2), SecondNumber=number)  # -> LargerThan, OrEqualTo

# ---- group: Check List structure
tstat = TreeStatistics(Tree=replace_paths)  # -> Paths, Length, Count
smaller_3 = SmallerThan(FirstNumber=tstat.Count, SecondNumber="1.1")  # -> SmallerThan, OrEqualTo
filter_7 = StreamFilter(Gate=smaller_3.SmallerThan, Stream0=replace_paths_3)
filter_8 = StreamFilter(Gate=smaller_3.SmallerThan, Stream0=replace_paths_2)
filter_9 = StreamFilter(Gate=smaller_3.SmallerThan, Stream0=replace_paths)

# ---- group: Routine check
similar_4 = Similarity(FirstNumber=check_mode_2, SecondNumber="2", Threshold=0.1)  # -> Similarity, AbsoluteDifference
similar_5 = Similarity(FirstNumber=check_mode_2, SecondNumber="1", Threshold=0.1)  # -> Similarity, AbsoluteDifference
or_3 = GateOr(A=similar_5.Similarity, B=similar_4.Similarity)
filter_10 = StreamFilter(Gate=or_3, Stream1=filter_9)  # -> simplify(Stream)

# ----
gate_and = GateAnd(A=larger_than_2.LargerThan, B=larger_than.LargerThan)
mass_multiplication = MassMultiplication(Input=gate_and)  # -> Result, PartialResults
deplane = DeconstructPlane(Plane=replace_paths)  # -> Origin, XAxis, YAxis, ZAxis

# ---- group: Advanced check
similar_6 = Similarity(FirstNumber=check_mode_2, SecondNumber="2", Threshold=0.1)  # -> Similarity, AbsoluteDifference
filter_11 = StreamFilter(Gate=similar_6.Similarity, Stream1=filter_9)  # -> simplify(Stream)

# ---- group: Contact points / Add transition lines
tree_statistics_4 = TreeStatistics(Tree=filter_11)  # -> Paths, Length, Count; disabled
panel_3 = Panel("-1")  # disabled
list_item_3 = ListItem(List=filter_11, Index=panel_3, Wrap=True)  # disabled
panel_4 = Panel("1")  # disabled
subtraction = Subtraction(A=tree_statistics_4.Count, B=panel_4)  # disabled
cull_index = CullIndex(List=flatten(list_item_3), Indices=panel_3, Wrap=True)  # -> simplify(graft(List)); disabled
series_4 = Series(Start=panel_4, Step=1, Count=subtraction)  # disabled
panel_5 = Panel("0")  # disabled
tree_branch = TreeBranch(Tree=filter_11, Path=series_4, MaintainPaths=True)  # disabled
panel_6 = Panel("0")  # disabled
tree_branch_2 = TreeBranch(Tree=filter_11, Path=panel_6, MaintainPaths=True)  # disabled
insert_items = InsertItems(List=tree_branch, Item=cull_index, Indices=panel_5, Wrap=False)  # -> simplify(List); disabled
merge = Merge(Data1=tree_branch_2, Data2=insert_items)  # disabled

# ----
and = GateAnd(A=mass_multiplication.Result, B=or_2)
filter_12 = StreamFilter(Gate=or_2, Stream1=deplane.ZAxis)  # -> simplify(Stream)
stream_gate = StreamGate(Stream=replace_paths_3, Gate=mass_multiplication.Result)  # -> Target0, Target1
stream_gate_2 = StreamGate(Stream=replace_paths_2, Gate=mass_multiplication.Result)  # -> Target0, Target1
filter_13 = StreamFilter(Gate=similar_6.Similarity, Stream1=filter_8)  # -> simplify(Stream)
pdecon = Deconstruct(Point=filter_12)  # -> XComponent, YComponent, ZComponent
pt = Point(flatten(deplane.Origin))

# ---- group: Advanced check
similar_7 = Similarity(FirstNumber=check_mode_2, SecondNumber="2", Threshold=0.1)  # -> Similarity, AbsoluteDifference
filter_14 = StreamFilter(Gate=similar_7.Similarity, Stream1=pt)  # -> simplify(Stream)

# ----
pt_2 = Point(simplify(deplane.Origin))
abs = Absolute(Value=filter_12)
Z = UnitZ(Factor=1)
plfit = PlaneFit(Points=pt_2)  # -> Plane, Deviation
angle = Angle(VectorA=abs, VectorB=Z)  # -> Angle, Reflex
pt_3 = Point(flatten(deplane.Origin))
list_item_4 = ListItem(List=flatten(pt), Index=0, Wrap=True)
project = Project(Geometry=pt_2, Plane=plfit.Plane)  # -> Geometry, Transform
deg = Degrees(Radians=angle.Angle)
pline = PolyLine(Vertices=flatten(project.Geometry), Closed=False)
null_item = NullItem(Item=list_item_4)  # -> NullFlags, InvalidFlags, Description
multiplication_2 = Multiplication(A=replace_paths_2, B=replace_paths_3)
filter_15 = StreamFilter(Gate=or_3, Stream1=replace_paths_2)  # -> simplify(Stream)

# ---- group: Start point
pdecon_2 = Deconstruct(Point=pt_3)  # -> XComponent, YComponent, ZComponent
item_6 = ListItem(List=pt_3, Index=0, Wrap=True)
sort = SortList(Keys=pdecon_2.ZComponent, ValuesA=pt_3)  # -> Keys, ValuesA
item_7 = ListItem(List=sort.Keys, Index=0, Wrap=True)
pdecon_3 = Deconstruct(Point=item_6)  # -> XComponent, YComponent, ZComponent
panel_7 = Panel("5")
panel_8 = Panel("Start point is not the lowest point, are you sure ?")

# ---- group: Point d'approche
tree_branch_3 = TreeBranch(Tree=deplane.Origin, Path="0", MaintainPaths=True)
project_2 = Project(Geometry=tree_branch_3, Plane=PlaneXY(0, 0, 0))  # -> Geometry, Transform
project_3 = Project(Geometry=item_6, Plane=PlaneXY(0, 0, 0))  # -> Geometry, Transform
convex_hull = ConvexHull(Points=project_2.Geometry, Plane=PlaneXY(0, 0, 0))  # -> Hull, HullZ, Indices
curve_closest_point = CurveClosestPoint(Point=project_3.Geometry, Curve=convex_hull.Hull)  # -> Point, Parameter, Distance
panel_9 = Panel("Start point seems hardly accessible, will you be able to cut cleanly the approach layer ?")
larger_than_3 = LargerThan(FirstNumber=curve_closest_point.Distance, SecondNumber=Slider(30, range=0..100))  # -> LargerThan, OrEqualTo
filter_16 = StreamFilter(Gate=larger_than_3.LargerThan, Stream1=panel_9)

# ----
filter_17 = StreamFilter(Gate=or_3, Stream1=replace_paths_3)  # -> simplify(Stream)

# ---- group: Contact points
pline_2 = PolyLine(Vertices=filter_11, Closed=Toggle(True))
len = Length(Curve=pline_2)
num_2 = Number("10")
division = Division(A=len, B=num_2)
divide = DivideCurve(Curve=pline_2, Count=division, Kinks=False)  # -> Points, Tangents, Parameters
division_2 = Division(A=filter_13, B=2)
item_8 = ListItem(List=division_2, Index=divide.Parameters, Wrap=True)

# ----
filter_18 = StreamFilter(Gate=similar_7.Similarity, Stream0=simplify(filter_10), Stream1=simplify(divide.Points))
stream_filter_2 = StreamFilter(Gate=null_item.NullFlags, Stream0=filter_5, Stream1="0")

# ---- group: Take out singularities
cluster = Cluster(relay=multiplication_2)

# ----
cluster_2 = Cluster(relay=replace_paths_2)

flowrate_l_min = Number(stream_filter_2)
lng_3 = ListLength(List=flatten(flowrate_l_min))
cull_i = CullIndex(List=flatten(flowrate_l_min), Indices="0", Wrap=True)
larger = LargerThan(FirstNumber=lng_3, SecondNumber="1")  # -> LargerThan, OrEqualTo
filter_19 = StreamFilter(Gate=larger.LargerThan, Stream0=flowrate_l_min, Stream1=cull_i)

layer_widths_mm = Number(replace_paths_2)
layer_heights_mm = Number(replace_paths_3)
deplane_2 = DeconstructPlane(Plane=filter_10)  # -> Origin, XAxis, YAxis, ZAxis
sort_2 = SortList(Keys=flatten(cluster_2))  # -> Keys, ValuesA
subtraction_2 = Subtraction(A=pdecon_3.ZComponent, B=item_7)
item_9 = ListItem(List=sort_2.Keys, Index=0, Wrap=True)  # -> Item1, Item
panel_10 = Panel("""Concrete NAG3
Concrete NAW3
VICAT
Concrete + aggregrates
Platre""")
densité_matériau = Panel("""2.3
2.3
2.45
2.3
1.7""")
densité_premix = Panel("""2.1
2.1
2.1
2.1
1.2""")
larger_2 = LargerThan(FirstNumber=subtraction_2, SecondNumber=panel_7)  # -> LargerThan, OrEqualTo
pline_3 = PolyLine(Vertices=pt, Closed=False)
multiplication_3 = Multiplication(A=layer_widths_mm, B=layer_heights_mm)  # -> flatten(Result)
item_10 = ListItem(List=panel_10, Index=filter_4, Wrap=True)
item_11 = ListItem(List=densité_matériau, Index=filter_4, Wrap=True)
item_12 = ListItem(List=densité_premix, Index=filter_4, Wrap=True)
mod = Modulus(A=item_9.Item, B="2")
lng_4 = ListLength(List=filter_14)
filter_20 = StreamFilter(Gate=larger_2.LargerThan, Stream1=panel_8)
lng_5 = ListLength(List=multiplication_3)
subtraction_3 = Subtraction(A=item_9.Item, B=mod)
panel_11 = Panel(item_10)
series_5 = Series(Start=0, Step=1, Count=lng_4)

# ---- group: Contact points
Z_2 = UnitZ(Factor=1)
num_3 = Number("1")
xprod = CrossProduct(VectorA=divide.Tangents, VectorB=Z_2, Unitize=True)  # -> Vector, Length
neg = Negative(Value=num_3)
multiplication_4 = Multiplication(A=xprod.Vector, B=item_8)
multiplication_5 = Multiplication(A=xprod.Vector, B=item_8, C=neg)
move = Move(Geometry=divide.Points, Motion=multiplication_4)  # -> Geometry, Transform
move_2 = Move(Geometry=divide.Points, Motion=multiplication_5)  # -> Geometry, Transform
lng_6 = ListLength(List=divide.Points)
rtree = CreateRTree(InputGeometry=move.Geometry)
# To do: treat non grafted cases
# Add ratio preview
# Add 40° color to angles
# Replacing Closest point component (faster)
# correct ratio number ( To from)
# Replace color wheel with rainbow gradient
rtree_2 = CreateRTree(InputGeometry=move_2.Geometry)
rtree_range = RTreePointsInRange(SearchPoints=divide.Points, SearchDistance=item_8, RTree=rtree)  # -> PointsWithinRange, IndicesWithinRange
rtree_range_2 = RTreePointsInRange(SearchPoints=divide.Points, SearchDistance=item_8, RTree=rtree_2)  # -> PointsWithinRange, IndicesWithinRange
series_6 = Series(Start=0, Step=1, Count=lng_6)  # -> graft(Series)
parameter_dif_treshold = Slider(5.4, range=0..20)
cull_i_2 = CullIndex(List=rtree_range_2.PointsWithinRange, Indices=0, Wrap=True)  # -> simplify(List)
cull_i_3 = CullIndex(List=rtree_range_2.IndicesWithinRange, Indices=0, Wrap=True)  # -> simplify(List)
repeat = RepeatData(Data=lng_6, Length=lng_6)  # -> graft(Data)
cull_i_4 = CullIndex(List=rtree_range.IndicesWithinRange, Indices=0, Wrap=True)  # -> simplify(List)
cull_i_5 = CullIndex(List=rtree_range.PointsWithinRange, Indices=0, Wrap=True)  # -> simplify(List)
lng_7 = ListLength(List=series_6)
subtraction_4 = Subtraction(A=series_6, B=cull_i_3)
subtraction_5 = Subtraction(A=series_6, B=cull_i_4)
subtraction_6 = Subtraction(A=repeat, B=parameter_dif_treshold)
abs_2 = Absolute(Value=subtraction_4)
subtraction_7 = Subtraction(A=repeat, B=parameter_dif_treshold)
abs_3 = Absolute(Value=subtraction_5)
larger_3 = LargerThan(FirstNumber=abs_2, SecondNumber=parameter_dif_treshold)  # -> LargerThan, OrEqualTo
smaller_4 = SmallerThan(FirstNumber=abs_2, SecondNumber=subtraction_6)  # -> SmallerThan, OrEqualTo
smaller_5 = SmallerThan(FirstNumber=abs_3, SecondNumber=subtraction_7)  # -> SmallerThan, OrEqualTo
larger_4 = LargerThan(FirstNumber=abs_3, SecondNumber=parameter_dif_treshold)  # -> LargerThan, OrEqualTo
and_2 = GateAnd(A=larger_3.LargerThan, B=smaller_4.SmallerThan)
cull = CullPattern(List=simplify(cull_i_2), CullPattern=simplify(and_2))  # -> simplify(List)
and_3 = GateAnd(A=larger_4.LargerThan, B=smaller_5.SmallerThan)
cull_2 = CullPattern(List=cull_i_5, CullPattern=and_3)  # -> simplify(List)
trim = TrimTree(Tree=simplify(cull), Depth=1)
trim_2 = TrimTree(Tree=simplify(cull_2), Depth=1)
cullpt = CullDuplicates(Points=trim, Tolerance=0.1, CullMode=1)  # -> Points, Indices, Valence
cullpt_2 = CullDuplicates(Points=trim_2, Tolerance=0.1, CullMode=1)  # -> Points, Indices, Valence

# ----
panel_12 = Panel("Some points will cause Robot reading frequency problem, try spacing the points or lowering the robot speed.")
material_density_kg_l = Number(item_12)
material_density_kg_l_2 = Number(item_11)
larger_5 = LargerThan(FirstNumber=lng_5, SecondNumber=1.1)  # -> LargerThan, OrEqualTo
explode = Explode(Curve=pline_3, Recursive=True)  # -> Segments, Vertices
eval = EvaluateCurve(Curve=pline_3, Parameter=series_5)  # -> Point, Tangent, Angle
cull_index_2 = CullIndex(List=multiplication_3, Indices="0", Wrap=True)
len_2 = Length(Curve=explode.Segments)
filter_21 = StreamFilter(Gate=larger_5.LargerThan, Stream0=multiplication_3, Stream1=cull_index_2)
multiplication_6 = Multiplication(A=layer_widths_mm, B=layer_heights_mm)

# ---- group: Orientation change
flatten_tree = FlattenTree(Tree=deg, Path="{0}")
cull_index_3 = CullIndex(List=flatten_tree, Indices="-1", Wrap=True)
cull_index_4 = CullIndex(List=flatten_tree, Indices="0", Wrap=True)
subtraction_8 = Subtraction(A=cull_index_3, B=cull_index_4)
absolute = Absolute(Value=subtraction_8)
panel_13 = Panel("0")
insert_items_2 = InsertItems(List=absolute, Item=panel_13, Indices=panel_13, Wrap=True)
unflatten_tree = UnflattenTree(Tree=insert_items_2, Guide=pt_2)
angle_change = Number(unflatten_tree)

# ----
tstat_2 = TreeStatistics(Tree=pt_2)  # -> Paths, Length, Count
multiplication_7 = Multiplication(A=len_2, B=filter_21)
pdecon_4 = Deconstruct(Point=pt)  # -> XComponent, YComponent, ZComponent
num_4 = Number("10^6")
num_5 = Number("60")
larger_6 = LargerThan(FirstNumber=tstat_2.Count, SecondNumber=1)  # -> LargerThan, OrEqualTo
sort_3 = SortList(Keys=pdecon_4.ZComponent)  # -> Keys, ValuesA
multiplication_8 = Multiplication(A=multiplication_6, B=num_5)
multiplication_9 = Multiplication(A=flowrate_l_min, B=num_4)
list_item_5 = ListItem(List=flatten(cluster), Index=0, Wrap=True)
num_6 = Number("10^-6")
item_13 = ListItem(List=sort_3.Keys, Index=0, Wrap=True)  # -> Item1, Item

# ---- group: Speeds
division_3 = Division(A=multiplication_9, B=multiplication_8)

# ----
vz_mm_min = Number(layer_heights_mm)

# ---- group: volume (L)
multiplication_10 = Multiplication(A=multiplication_7, B=num_6)

# ----
panel_14 = Panel("Some points have a local stability problem (Air printing). Try increasing layer width or reducing the slope on these points.")
null_item_2 = NullItem(Item=list_item_5)  # -> NullFlags, InvalidFlags, Description
subtraction_9 = Subtraction(A=item_13.Item1, B=item_13.Item)
expression = Expression(h=vz_mm_min, rho=material_density_kg_l_2, Expression="rho*9.81*h")

# ---- group: Temps (min)
division_4 = Division(A=multiplication_10, B=filter_19)

# ----
ins = InsertItems(List=division_4, Item="0", Indices="0", Wrap=True)
ma = MassAddition(Input=multiplication_10)  # -> Result, PartialResults

# ---- group: Accelerations
flatten_tree_2 = FlattenTree(Tree=division_3, Path="{0}")
cull_index_5 = CullIndex(List=flatten_tree_2, Indices="0", Wrap=True)
cull_index_6 = CullIndex(List=flatten_tree_2, Indices="-1", Wrap=True)
cull_index_7 = CullIndex(List=flatten_tree_2, Indices="0", Wrap=True)
subtraction_10 = Subtraction(A=cull_index_6, B=cull_index_7)
division_5 = Division(A=flatten(len_2), B=cull_index_5)
absolute_2 = Absolute(Value=subtraction_10)
division_6 = Division(A=absolute_2, B=division_5)
insert_items_3 = InsertItems(List=division_6, Item="0", Indices="0", Wrap=True)
lng_8 = ListLength(List=flatten(flatten_tree_2))
unflatten_tree_2 = UnflattenTree(Tree=insert_items_3, Guide=pt_2)
larger_7 = LargerThan(FirstNumber=lng_8, SecondNumber="1")  # -> LargerThan, OrEqualTo
filter_22 = StreamFilter(Gate=larger_7.LargerThan, Stream0="0", Stream1=unflatten_tree_2)
accelerations_mm_s_2 = Number(filter_22)

# ----
item_14 = ListItem(List=flatten(renumber_paths_3), Index=0, Wrap=True)
unflatten = UnflattenTree(Tree=ins, Guide=pt_2)
item_15 = ListItem(List=flatten(renumber_paths_2), Index=0, Wrap=True)
ma_2 = MassAddition(Input=division_4)  # -> Result, PartialResults
division_7 = Division(A=subtraction_9, B=ma_2.Result)

# ---- group: poids (kg)
multiplication_11 = Multiplication(A=ma.Result, B=material_density_kg_l_2)

# ----
multiplication_12 = Multiplication(A=ma.Result, B=material_density_kg_l)
null_7 = NullItem(Item=item_14)  # -> NullFlags, InvalidFlags, Description
ma_3 = MassAddition(Input=unflatten)  # -> Result, PartialResults
null_8 = NullItem(Item=item_15)  # -> NullFlags, InvalidFlags, Description
len_3 = Length(Curve=explode.Segments)  # disabled
stream_filter_3 = StreamFilter(Gate=null_item_2.NullFlags, Stream0="0")
panel_15 = Panel("1")  # disabled
division_8 = Division(A=division_3, B=replace_paths_3)
multiplication_13 = Multiplication(A=ma_3.Result, B="60")
insert_items_4 = InsertItems(List=len_3, Item=panel_15, Indices=panel_13, Wrap=True)  # disabled
unit_z = UnitZ(Factor=1)

average = Average(Input=flatten(expression))
bnd = Bounds(Numbers=flatten(expression))
multiplication_14 = Multiplication(A=average, B=0.01)
num_7 = Number(bnd)
dedomain = DeconstructDomain(Domain=bnd)  # -> Start, End
larger_8 = LargerThan(FirstNumber=num_7, SecondNumber=multiplication_14)  # -> LargerThan, OrEqualTo
filter_23 = StreamFilter(Gate=larger_8.LargerThan, Stream0="Yield Stress : {0:0} Pa", Stream1="Yield Stress : {1:0} to {2:0} Pa")
format = Format(Format=filter_23, Culture=127, Data0=average, Data1=dedomain.Start, Data2=dedomain.End)

average_2 = Average(Input=flatten(renumber_paths_2))
bnd_2 = Bounds(Numbers=flatten(renumber_paths_2))
multiplication_15 = Multiplication(A=average_2, B=0.01)
num_8 = Number(bnd_2)
larger_9 = LargerThan(FirstNumber=num_8, SecondNumber=multiplication_15)  # -> LargerThan, OrEqualTo
dedomain_2 = DeconstructDomain(Domain=bnd_2)  # -> Start, End
filter_24 = StreamFilter(Gate=larger_9.LargerThan, Stream0="AD2 : {0:0.00} mL/L", Stream1="AD2 : {1:0.00} to {2:0.00} mL/L")
format_2 = Format(Format=filter_24, Culture=127, Data0=average_2, Data1=dedomain_2.Start, Data2=dedomain_2.End)

average_3 = Average(Input=flatten(filter_5))
bnd_3 = Bounds(Numbers=flatten(filter_5))
multiplication_16 = Multiplication(A=average_3, B=0.01)
num_9 = Number(bnd_3)
larger_10 = LargerThan(FirstNumber=num_9, SecondNumber=multiplication_16)  # -> LargerThan, OrEqualTo
dedomain_3 = DeconstructDomain(Domain=bnd_3)  # -> Start, End
filter_25 = StreamFilter(Gate=larger_10.LargerThan, Stream0="Flowrate : {0:0.00} L/min", Stream1="Flowrate : {1:0.00} to {2:0.00} L/min")
format_3 = Format(Format=filter_25, Culture=127, Data0=average_3, Data1=dedomain_3.Start, Data2=dedomain_3.End)

average_4 = Average(Input=flatten(renumber_paths_3))
bnd_4 = Bounds(Numbers=flatten(renumber_paths_3))
multiplication_17 = Multiplication(A=average_4, B=0.01)
num_10 = Number(bnd_4)
larger_11 = LargerThan(FirstNumber=num_10, SecondNumber=multiplication_17)  # -> LargerThan, OrEqualTo
dedomain_4 = DeconstructDomain(Domain=bnd_4)  # -> Start, End
filter_26 = StreamFilter(Gate=larger_11.LargerThan, Stream0="AD1 : {0:0.00} mL/L", Stream1="AD1 : {1:0.00} to {2:0.00} mL/L")
format_4 = Format(Format=filter_26, Culture=127, Data0=average_4, Data1=dedomain_4.Start, Data2=dedomain_4.End)

printing_time_per_layer_s = Number(multiplication_13)
unflatten_tree_3 = UnflattenTree(Tree=insert_items_4, Guide=pt_2)  # disabled

average_5 = Average(Input=flatten(division_3))
bnd_5 = Bounds(Numbers=flatten(division_3))
multiplication_18 = Multiplication(A=average_5, B=0.01)
num_11 = Number(bnd_5)
larger_12 = LargerThan(FirstNumber=num_11, SecondNumber=multiplication_18)  # -> LargerThan, OrEqualTo
dedomain_5 = DeconstructDomain(Domain=bnd_5)  # -> Start, End
filter_27 = StreamFilter(Gate=larger_12.LargerThan, Stream0="Robot speed : {0:0.0} mm/s", Stream1="Robot speed : {1:0.0} to {2:0.0} mm/s")
format_5 = Format(Format=filter_27, Culture=127, Data0=average_5, Data1=dedomain_5.Start, Data2=dedomain_5.End)

cull_i_6 = CullIndex(List=rtree_range_2.IndicesWithinRange, Indices=0, Wrap=True)  # -> simplify(List)
cull_i_7 = CullIndex(List=rtree_range.IndicesWithinRange, Indices=0, Wrap=True)  # -> simplify(List)
bnd_6 = Bounds(Numbers=flatten(printing_time_per_layer_s))
division_9 = Division(A=angle_change, B=unflatten_tree_3)  # disabled
cull_3 = CullPattern(List=cull_i_7, CullPattern=and_3)  # -> simplify(List)
cull_4 = CullPattern(List=cull_i_6, CullPattern=and_2)  # -> simplify(List)
dedomain_6 = DeconstructDomain(Domain=bnd_6)  # -> Start, End
trim_3 = TrimTree(Tree=simplify(cull_3), Depth=1)
trim_4 = TrimTree(Tree=simplify(cull_4), Depth=1)
bar_graph = BarGraph(angle_change, BarColor=RGB(255, 0, 90))

average_6 = Average(Input=flatten(ma.Result))
format_6 = Format(Format="Volume : {0:0.0} L", Culture=127, Data0=average_6)

similar_8 = Similarity(FirstNumber=dedomain_6.Start, SecondNumber=dedomain_6.End, Threshold="5")  # -> Similarity, AbsoluteDifference

average_7 = Average(Input=flatten(multiplication_12))
format_7 = Format(Format="Premix quantity : {0:0.0} kg", Culture=127, Data0=average_7)

smtime = ConstructSmoothTime(Days=0, Hours=0, Minutes=0, Seconds=dedomain_6.End)
smtime_2 = ConstructSmoothTime(Days=0, Hours=0, Minutes=0, Seconds=dedomain_6.Start)

average_8 = Average(Input=flatten(multiplication_11))
format_8 = Format(Format="Weight : {0:0.0} kg", Culture=127, Data0=average_8)

smtime_3 = ConstructSmoothTime(Days=0, Hours=0, Minutes=ma_2.Result, Seconds=0)

average_9 = Average(Input=flatten(division_7))
format_9 = Format(Format="Vertical speed (Vz) : {0:0.0} mm/min", Culture=127, Data0=average_9)

list_item_6 = ListItem(List=trim_3, Index=cullpt_2.Indices, Wrap=True)
list_item_7 = ListItem(List=trim_4, Index=cullpt.Indices, Wrap=True)
concat = Concatenate(FragmentA=smtime_2, FragmentC=" to ", FragmentB=smtime)
concatenate = Concatenate(FragmentA="Printing time : ", FragmentB=smtime_3)
filter_28 = StreamFilter(Gate=similar_8.Similarity, Stream0=concat, Stream1=smtime)
filter_29 = StreamFilter(Gate=larger_6.LargerThan, Stream0="N/A", Stream1=filter_28)
concatenate_2 = Concatenate(FragmentA="Time between layers : ", FragmentB=filter_29)
merge_2 = Merge(Data1=simplify(list_item_6), Data2=simplify(list_item_7))
tree_branch_4 = TreeBranch(Tree=replace_paths_3, Path="0", MaintainPaths=True)
list_item_8 = ListItem(List=divide.Points, Index=merge_2, Wrap=True)
filter_30 = StreamFilter(Gate=null_7.NullFlags, Stream0=format_4)
filter_31 = StreamFilter(Gate=null_8.NullFlags, Stream0=format_2)
filter_32 = StreamFilter(Gate=or_3, Stream1=deg)
lng_9 = ListLength(List=flatten(replace_paths_3))
larger_13 = LargerThan(FirstNumber=lng_9, SecondNumber="1")  # -> LargerThan, OrEqualTo

# ---- group: Tearing
max_tearing = Slider(30, range=0..100)
larger_than_4 = LargerThan(FirstNumber=division_8, SecondNumber=max_tearing)  # -> LargerThan, OrEqualTo
cull_pattern = CullPattern(List=pt_2, CullPattern=larger_than_4.LargerThan)
panel_16 = Panel("Some points have a Tearing problem (>30 s-1). Try lowering robot speed or increasing layer height on these points.")
list_item_9 = ListItem(List=flatten(cull_pattern), Index=0, Wrap=True)
null_item_3 = NullItem(Item=list_item_9)  # -> NullFlags, InvalidFlags, Description
stream_filter_4 = StreamFilter(Gate=null_item_3.NullFlags, Stream0=panel_16)

# ----
Z_3 = UnitZ(Factor=1)  # disabled
neg_2 = Negative(Value=Z_3)  # disabled

# ---- group: Zone check
panel_17 = Panel("10")  # disabled
panel_18 = Panel("0")  # disabled
construct_domain = ConstructDomain(DomainStart=panel_18, DomainEnd=panel_17)  # disabled
integer_2 = Integer(renumber_paths_4)  # disabled
includes = Includes(Value=flatten(integer_2), Domain=construct_domain)  # -> Includes, Deviation; disabled
panel_19 = Panel("Zones are out of Bound, give a value of 0, 1 or 2")  # disabled
mass_multiplication_2 = MassMultiplication(Input=includes.Includes)  # -> Result, PartialResults; disabled
stream_filter_5 = StreamFilter(Gate=mass_multiplication_2.Result, Stream0=panel_19)  # disabled

# ----
list_length = ListLength(List=filter_10)
filter_33 = StreamFilter(Gate=similar_7.Similarity, Stream1=simplify(divide.Points))  # disabled
list_length_2 = ListLength(List=replace_paths)
ma_4 = MassAddition(Input=tstat.Length)  # -> Result, PartialResults
swatch = ColourSwatch(SwatchColor=RGB(64, 64, 64))
concat_2 = Concatenate(FragmentA="Object name : ", FragmentB=object_name)
concat_3 = Concatenate(FragmentA="Number of points : ", FragmentB=ma_4.Result)
concat_4 = Concatenate(FragmentA="Number of layers : ", FragmentB=tstat.Count)
filter_34 = StreamFilter(Gate=or, Stream0=concat_3)
filter_35 = StreamFilter(Gate=or, Stream0=concat_4)
filter_36 = StreamFilter(Gate=or, Stream0=concat_2)
text = Text(ColourSwatch(SwatchColor=RGB(68, 42, 156)))
text_2 = Text(ColourSwatch(SwatchColor=RGB(255, 255, 255)))
text_3 = Text(ColourSwatch(SwatchColor=RGB(255, 179, 79)))
text_4 = Text(ColourSwatch(SwatchColor=RGB(255, 79, 79)))

# ---- group: Informations color
entwine = Entwine(Branch00=text, Branch01=text_2, Branch02=text_2, FlattenInputs=True)  # -> simplify(Result)

# ---- group: Informations
entwine_2 = Entwine(Branch00=list_item_2, Branch01=filter_36, FlattenInputs=True)  # -> simplify(Result)

# ----
clean_all = CleanAll(T=entwine)  # -> flatten(T_2)
clean_all_2 = CleanAll(T=entwine_2)  # -> flatten(T_2)
list_length_3 = ListLength(List=filter_16)
list_length_4 = ListLength(List=stream_filter_5)
list_length_5 = ListLength(List=filter_20)
repeat_data = RepeatData(Data=text_3, Length=list_length_3)
repeat_data_2 = RepeatData(Data=text_3, Length=list_length_4)
repeat_data_3 = RepeatData(Data=text_4, Length=list_length_5)

# ---- group: Check tree structure
tstat_3 = TreeStatistics(Tree=replace_paths_2)  # -> Paths, Length, Count
tstat_4 = TreeStatistics(Tree=replace_paths)  # -> Paths, Length, Count
tstat_5 = TreeStatistics(Tree=replace_paths_3)  # -> Paths, Length, Count
similarity = Similarity(FirstNumber=tstat_4.Count, SecondNumber=tstat_3.Count, Threshold=0.1)  # -> Similarity, AbsoluteDifference
similarity_2 = Similarity(FirstNumber=tstat_4.Length, SecondNumber=tstat_3.Length, Threshold=0.1)  # -> Similarity, AbsoluteDifference
similarity_3 = Similarity(FirstNumber=tstat_4.Length, SecondNumber=tstat_5.Length, Threshold=0.1)  # -> Similarity, AbsoluteDifference
similarity_4 = Similarity(FirstNumber=tstat_4.Count, SecondNumber=tstat_5.Count, Threshold=0.1)  # -> Similarity, AbsoluteDifference
mm = MassMultiplication(Input=similarity_2.Similarity)  # -> Result, PartialResults
mm_2 = MassMultiplication(Input=similarity_3.Similarity)  # -> Result, PartialResults
mm_3 = MassMultiplication(Input=similarity.Similarity)  # -> Result, PartialResults
mm_4 = MassMultiplication(Input=similarity_4.Similarity)  # -> Result, PartialResults

# ----
or_4 = GateOr(A=smaller_2.SmallerThan, B=mm.Result)
or_5 = GateOr(A=smaller_2.SmallerThan, B=mm_3.Result)
or_6 = GateOr(A=smaller.SmallerThan, B=mm_2.Result)
or_7 = GateOr(A=smaller.SmallerThan, B=mm_4.Result)

# ---- group: Check tree structure (continued)
gate_and_2 = GateAnd(A=or_4, B=or_6, D=or_5, E=or_7)

# ----
stream_filter_6 = StreamFilter(Gate=gate_and_2, Stream0=panel_2)
list_length_6 = ListLength(List=stream_filter_6)
repeat_data_4 = RepeatData(Data=text_3, Length=list_length_6)

# ---- group: W/H ratio
division_10 = Division(A=stream_gate_2.Target1, B=stream_gate.Target1)
average_10 = Average(Input=flatten(division_10))
sort_4 = SortList(Keys=flatten(division_10))  # -> Keys, ValuesA
item_16 = ListItem(List=sort_4.Keys, Index=0, Wrap=True)  # -> Item1, Item

# ----
format_10 = Format(Format="{0:0.0}", Culture=127, Data0=item_16.Item)
format_11 = Format(Format="{0:0.0}", Culture=127, Data0=item_16.Item1)

# ---- group: Double point check
panel_20 = Panel("-1")
shift = ShiftList(List=flatten(filter_6), Shift=1, Wrap=False)
cull_i_8 = CullIndex(List=flatten(filter_6), Indices=panel_20, Wrap=True)
dist = Distance(PointA=cull_i_8, PointB=shift)
abs_4 = Absolute(Value=dist)
sort_5 = SortList(Keys=abs_4)  # -> Keys, ValuesA
item_17 = ListItem(List=sort_5.Keys, Index=0, Wrap=True)
panel_21 = Panel("1")

# ----
format_12 = Format(Format="{0:0.0}", Culture=127, Data0=item_17)
list_item_10 = ListItem(List=flatten(format_12), Index=0, Wrap=True)

# ---- group: Double point check (continued)
concat_5 = Concatenate(FragmentA="Min distance between points : ", FragmentB=format_12, FragmentC=" mm")
smaller_6 = SmallerThan(FirstNumber=format_12, SecondNumber=panel_21)  # -> SmallerThan, OrEqualTo
panel_22 = Panel(concat_5)
filter_37 = StreamFilter(Gate=smaller_6.SmallerThan, Stream1="Distance between points < 1 mm ! Remove duplicate points")

# ----
null_item_4 = NullItem(Item=list_item_10)  # -> NullFlags, InvalidFlags, Description
smaller_7 = SmallerThan(FirstNumber=format_12, SecondNumber="0.05")  # -> SmallerThan, OrEqualTo
multiplication_19 = Multiplication(A=smaller_7.SmallerThan, B=2)
stream_filter_7 = StreamFilter(Gate=null_item_4.NullFlags, Stream0=panel_22)
smaller_8 = SmallerThan(FirstNumber=abs_4, SecondNumber=panel_21)  # -> SmallerThan, OrEqualTo
pt_4 = Point(cull_i_8)

# ---- group: Check reading frequency
robot_max_reading_frequency = Panel("25")
cull_i_9 = CullIndex(List=flatten(division_3), Indices=panel_20, Wrap=True)
division_11 = Division(A=cull_i_9, B=dist)
number_2 = Number(robot_max_reading_frequency)
larger_than_5 = LargerThan(FirstNumber=division_11, SecondNumber=number_2)  # -> LargerThan, OrEqualTo
cull_pattern_2 = CullPattern(List=pt_4, CullPattern=larger_than_5.LargerThan)

# ----
list_item_11 = ListItem(List=flatten(cull_pattern_2), Index=0, Wrap=True)
null_item_5 = NullItem(Item=list_item_11)  # -> NullFlags, InvalidFlags, Description
max_2 = Maximum(A=smaller_6.SmallerThan, B=multiplication_19)
cull_5 = CullPattern(List=pt_4, CullPattern=smaller_8.SmallerThan)
null_item_6 = NullItem(Item=max_2)  # -> NullFlags, InvalidFlags, Description
filter_38 = StreamFilter(Gate=or_2, Stream0="Min distance between points : Not checked", Stream1=stream_filter_7)
stream_filter_8 = StreamFilter(Gate=null_item_5.NullFlags, Stream0=panel_12)
filter_39 = StreamFilter(Gate=or, Stream0=filter_38)
stream_filter_9 = StreamFilter(Gate=null_item_6.NullFlags, Stream0=max_2, Stream1="2")

# ---- group: Head orientation
average_11 = Average(Input=flatten(deg))
sort_6 = SortList(Keys=flatten(deg))  # -> Keys, ValuesA
item_18 = ListItem(List=sort_6.Keys, Index=0, Wrap=True)  # -> Item1, Item
similarity_5 = Similarity(FirstNumber=average_11, SecondNumber="0", Threshold=0.1)  # -> Similarity, AbsoluteDifference
panel_23 = Panel(" to ")
null_item_7 = NullItem(Item=average_11)  # -> NullFlags, InvalidFlags, Description
panel_24 = Panel("°")

# ----
format_13 = Format(Format="{0:0.0}", Culture=127, Data0=item_18.Item)
format_14 = Format(Format="{0:0.0}", Culture=127, Data0=item_18.Item1)
concat_6 = Concatenate(FragmentB=format_13, FragmentC=panel_23, FragmentD=format_14)
non_oriented = Boolean(similarity_5.Similarity)
stream_filter_10 = StreamFilter(Gate=null_item_7.NullFlags, Stream0=panel_24, Stream1="Not checked")
bool = Boolean(invert(similarity_5.Similarity))

# ---- group: Head orientation (continued)
filter_40 = StreamFilter(Gate=similarity_5.Similarity, Stream1=concat_6)
stream_filter_11 = StreamFilter(Gate=null_item_7.NullFlags, Stream0=bool, Stream1="0")
concat_7 = Concatenate(FragmentA="Head orientation :  ", FragmentE=format_14, FragmentB=stream_filter_10)
panel_25 = Panel(concat_7)

# ---- group: Width check
sort_7 = SortList(Keys=flatten(replace_paths_2))  # -> Keys, ValuesA
average_12 = Average(Input=flatten(replace_paths_2))
item_19 = ListItem(List=sort_7.Keys, Index=0, Wrap=True)  # -> Item1, Item
similarity_6 = Similarity(FirstNumber=average_12, SecondNumber=item_19.Item1, Threshold=0.1)  # -> Similarity, AbsoluteDifference
panel_26 = Panel("Layer width : ")
panel_27 = Panel(" mm")

# ---- group: W/H ratio (continued)
# Informations: Variable width : From .. to .. or Fixed width
# Variable heigth: From .. to .. or Fixed height
# Variable orientation: From .. to .. or non orientated
# Max slope
# Modes : speed, slope, width, height, start end,
similarity_7 = Similarity(FirstNumber=average_10, SecondNumber=item_19.Item1, Threshold=0.1)  # -> Similarity, AbsoluteDifference
smaller_9 = SmallerThan(FirstNumber=format_10, SecondNumber="3")  # -> SmallerThan, OrEqualTo
smaller_10 = SmallerThan(FirstNumber=format_10, SecondNumber="2")  # -> SmallerThan, OrEqualTo
larger_14 = LargerThan(FirstNumber=format_11, SecondNumber="6")  # -> LargerThan, OrEqualTo
# Auto checks: min distance between points
# Plane normal negatif
# W/H ratio
# Nozzle recommandation
# Check slope
# check width compensation at some points ?
# check intersections
# preview start end , check if start point is not lowest
# check deviation > recommand HAL toolpath preview
# check longueur max sans deviation
# check contact points
# check slope vs orientation
# check orientation smoothness
concat_8 = Concatenate(FragmentA="Width/Height ratio : ", FragmentB=format_10, FragmentC=" to ", FragmentD=format_11)
larger_15 = LargerThan(FirstNumber=format_11, SecondNumber="5")  # -> LargerThan, OrEqualTo
concat_9 = Concatenate(FragmentA="Width/Height ratio : ", FragmentB=format_10)
filter_41 = StreamFilter(Gate=similarity_7.Similarity, Stream0=concat_8, Stream1=concat_9)
or_8 = GateOr(A=smaller_10.SmallerThan, B=larger_14.LargerThan)
or_9 = GateOr(A=smaller_9.SmallerThan, B=larger_15.LargerThan)
multiplication_20 = Multiplication(A=or_8, B=2)
panel_28 = Panel(filter_41)
max_3 = Maximum(A=or_9, B=multiplication_20)

# ----
format_15 = Format(Format="{0:0.0}", Culture=127, Data0=item_19.Item1)
format_16 = Format(Format="{0:0.0}", Culture=127, Data0=item_19.Item)
bool_2 = Boolean(invert(similarity_6.Similarity))
stream_filter_12 = StreamFilter(Gate=mass_multiplication.Result, Stream0="2", Stream1=max_3)
list_item_12 = ListItem(List=flatten(stream_filter_12), Index=0, Wrap=True)
# Warnings: Did you compensate layer width ?
# Did you overlap at contact points ?
# Slope is > ... : you should do a printability simulation
# Is plan orientation following the slope orientation ?
# Did you check printing order ?
stream_filter_13 = StreamFilter(Gate=mass_multiplication.Result, Stream0="Width or Height values < 0.01 mm found", Stream1=panel_28)
null_item_8 = NullItem(Item=list_item_12)  # -> NullFlags, InvalidFlags, Description
stream_filter_14 = StreamFilter(Gate=null_item_8.NullFlags, Stream0=stream_filter_12)
fixed_width = Boolean(similarity_6.Similarity)

# ---- group: Width check
construct_domain_2 = ConstructDomain(DomainStart="15", DomainEnd="45")
merge_3 = Merge(Data1=item_19.Item1, Data2=item_19.Item)
includes_2 = Includes(Value=flatten(merge_3), Domain=construct_domain_2)  # -> Includes, Deviation
mass_multiplication_3 = MassMultiplication(Input=includes_2.Includes)  # -> Result, PartialResults
stream_filter_15 = StreamFilter(Gate=mass_multiplication_3.Result, Stream0="Layer widths have an uncommon value, are you sure ?")

# ----
list_length_7 = ListLength(List=stream_filter_15)
repeat_data_5 = RepeatData(Data=text_3, Length=list_length_7)

# ---- group: Height check
sort_8 = SortList(Keys=flatten(replace_paths_3))  # -> Keys, ValuesA
average_13 = Average(Input=flatten(replace_paths_3))
item_20 = ListItem(List=sort_8.Keys, Index=0, Wrap=True)  # -> Item1, Item
similarity_8 = Similarity(FirstNumber=average_13, SecondNumber=item_20.Item1, Threshold=0.1)  # -> Similarity, AbsoluteDifference
panel_29 = Panel("Layer height : ")
panel_30 = Panel(" mm")

# ----
format_17 = Format(Format="{0:0.0}", Culture=127, Data0=item_20.Item1)
format_18 = Format(Format="{0:0.0}", Culture=127, Data0=item_20.Item)
bool_3 = Boolean(invert(similarity_8.Similarity))

# ---- group: Height check
construct_domain_3 = ConstructDomain(DomainStart="5", DomainEnd="12")
merge_4 = Merge(Data1=item_20.Item1, Data2=item_20.Item)
includes_3 = Includes(Value=flatten(merge_4), Domain=construct_domain_3)  # -> Includes, Deviation
mass_multiplication_4 = MassMultiplication(Input=includes_3.Includes)  # -> Result, PartialResults
stream_filter_16 = StreamFilter(Gate=mass_multiplication_4.Result, Stream0="Layer heights have an uncommon value, are you sure ?")

# ----
list_length_8 = ListLength(List=stream_filter_16)
repeat_data_6 = RepeatData(Data=text_3, Length=list_length_8)

# ---- group: Self-intersection
panel_31 = Panel("Self-intersections found : did you adjust crossing sections ?")
cx = CurveSelf(Curve=pline)  # -> Points, Params

# ----
list_item_13 = ListItem(List=flatten(cx.Points), Index=0, Wrap=True)
eval_2 = EvaluateCurve(Curve=pline_3, Parameter=cx.Params)  # -> Point, Tangent, Angle

# ---- group: Self-intersection (continued)
null_9 = NullItem(Item=list_item_13)  # -> NullFlags, InvalidFlags, Description
filter_42 = StreamFilter(Gate=null_9.NullFlags, Stream0=panel_31)
pt_5 = Point(eval_2.Point)

# ---- group: Z orientation check
panel_32 = Panel("0.01")

# ----
num_12 = Number(panel_32)

# ---- group: Z orientation check (continued)
larger_16 = LargerThan(FirstNumber=pdecon.ZComponent, SecondNumber=num_12)  # -> LargerThan, OrEqualTo
mm_5 = MassMultiplication(Input=flatten(larger_16.LargerThan))  # -> Result, PartialResults
cull_pattern_3 = CullPattern(List=deplane.Origin, CullPattern=invert(larger_16.LargerThan))  # -> flatten(List)
filter_43 = StreamFilter(Gate=mm_5.Result, Stream0="Some Planes have negative Z !")
panel_33 = Panel(filter_43)

# ---- group: Slope
tstat_6 = TreeStatistics(Tree=simplify(filter_10))  # -> Paths, Length, Count
cull_i_10 = CullIndex(List=tstat_6.Paths, Indices="-1", Wrap=True)
cull_i_11 = CullIndex(List=tstat_6.Paths, Indices="0", Wrap=True)
item_21 = ListItem(List=tstat_6.Paths, Index="0", Wrap=True)
branch = TreeBranch(Tree=simplify(filter_10), Path=item_21, MaintainPaths=True)
num_13 = Number("0")
crossref = CrossReference(ListA=branch, ListB=num_13, CrossMode=1)  # -> ListA, ListB
flatten = FlattenTree(Tree=crossref.ListB, Path=item_21)

# ----
branch_2 = TreeBranch(Tree=deplane_2.Origin, Path=cull_i_10, MaintainPaths=False)  # -> simplify(Branch)
branch_3 = TreeBranch(Tree=deplane_2.Origin, Path=cull_i_11, MaintainPaths=True)
pline_4 = PolyLine(Vertices=branch_2, Closed=False)  # -> simplify(Polyline)
branch_4 = TreeBranch(Tree=deplane.ZAxis, Path=cull_i_11, MaintainPaths=True)
branch_5 = TreeBranch(Tree=replace_paths_3, Path=cull_i_11, MaintainPaths=True)
filter_44 = StreamFilter(Gate=larger_13.LargerThan, Stream0=replace_paths_3, Stream1=branch_5)

# ---- group: Nozzle
sort_9 = SortList(Keys=flatten(cluster))  # -> Keys, ValuesA
item_22 = ListItem(List=sort_9.Keys, Index=0, Wrap=True)  # -> Item1, Item
expression_2 = Expression(s=item_22.Item1, Expression="(s*4/π)^0.5")
panel_34 = Panel("2")
panel_35 = Panel("Recommended nozzle diameter :  ")

# ----
mod_2 = Modulus(A=expression_2, B=panel_34)
subtraction_11 = Subtraction(A=expression_2, B=mod_2)
addition_2 = Addition(A=subtraction_11, B=panel_34)
merge_5 = Merge(Data1=flatten(addition_2), Data2=flatten(subtraction_3))

panel_36 = Panel("No optimal nozzle found, you should lower the W/H ratio bounds")
smaller_than = SmallerThan(FirstNumber=subtraction_3, SecondNumber=addition_2)  # -> SmallerThan, OrEqualTo
stream_filter_17 = StreamFilter(Gate=smaller_than.SmallerThan, Stream1=panel_36)

sort_10 = SortList(Keys=merge_5)  # -> Keys, ValuesA
item_23 = ListItem(List=sort_10.Keys, Index=0, Wrap=True)  # -> Item1, Item
stream_filter_18 = StreamFilter(Gate=smaller_than.SmallerThan, Stream0=item_23.Item1, Stream1=item_23.Item)
concat_10 = Concatenate(FragmentA=panel_35, FragmentB=item_23.Item, FragmentC=" to ", FragmentD=stream_filter_18, FragmentE=" mm")

# ---- group: Nozzle (continued)
panel_37 = Panel(concat_10)

# ----
stream_filter_19 = StreamFilter(Gate=null_item_2.NullFlags, Stream0=panel_37)
stream_filter_20 = StreamFilter(Gate=smaller_than.SmallerThan, Stream0=stream_filter_3, Stream1="1")
list_length_9 = ListLength(List=stream_filter_17)
repeat_data_7 = RepeatData(Data=text_4, Length=list_length_9)

# ---- group: Width check (continued)
concat_11 = Concatenate(FragmentB=format_16, FragmentC=" to ", FragmentD=format_15)
filter_45 = StreamFilter(Gate=similarity_6.Similarity, Stream0=concat_11, Stream1=format_15)

# ----
concat_12 = Concatenate(FragmentA=panel_26, FragmentD=filter_45, FragmentE=panel_27)

# ---- group: Width check (continued)
panel_38 = Panel(concat_12)

# ---- group: Height check (continued)
concat_13 = Concatenate(FragmentB=format_18, FragmentC=" to ", FragmentD=format_17)
filter_46 = StreamFilter(Gate=similarity_8.Similarity, Stream0=concat_13, Stream1=format_17)

# ----
concat_14 = Concatenate(FragmentA=panel_29, FragmentD=filter_46, FragmentE=panel_30)

# ---- group: Height check (continued)
panel_39 = Panel(concat_14)

# ---- group: Shrinkage test
longueur_max_fissures = Slider(1000, range=0..1000)
angle_déviation_max = Slider(1, range=0..10)
deg_2 = Degrees(Radians=eval.Angle)
larger_17 = LargerThan(FirstNumber=deg_2, SecondNumber=angle_déviation_max)  # -> LargerThan, OrEqualTo
panel_40 = Panel("Potential shrinkage detected.")

# ----
cull_6 = CullPattern(List=series_5, CullPattern=larger_17.LargerThan)

# ---- group: Shrinkage test (continued)
shatter = Shatter(Curve=pline_3, Parameters=cull_6)
len_4 = Length(Curve=shatter)
larger_18 = LargerThan(FirstNumber=len_4, SecondNumber=longueur_max_fissures)  # -> LargerThan, OrEqualTo
cull_7 = CullPattern(List=shatter, CullPattern=larger_18.LargerThan)

# ----
explode_2 = Explode(Curve=cull_7, Recursive=True)  # -> Segments, flatten(Vertices)
list_item_14 = ListItem(List=flatten(cull_7), Index=0, Wrap=True)
null_item_9 = NullItem(Item=list_item_14)  # -> NullFlags, InvalidFlags, Description
stream_filter_21 = StreamFilter(Gate=null_item_9.NullFlags, Stream0=panel_40)

# ---- group: Slope (continued)
crv_cp = CurveClosestPoint(Point=branch_3, Curve=reparameterize(pline_4))  # -> Point, Parameter, Distance
vec2pt = Vector2Pt(PointA=crv_cp.Point, PointB=branch_3, Unitize=False)  # -> Vector, Length

# ----
eval_3 = EvaluateCurve(Curve=reparameterize(pline_4), Parameter=crv_cp.Parameter)  # -> Point, Tangent, Angle
xy = XYPlane(Origin=Point(0, 0, 0))
project_4 = Project(Geometry=eval_3.Tangent, Plane=branch_4)  # -> Geometry, Transform
pl = PlaneNormal(Origin=branch_3, ZAxis=project_4.Geometry)
project_5 = Project(Geometry=vec2pt.Vector, Plane=pl)  # -> Geometry, Transform

list_item_15 = ListItem(List=project_5.Geometry, Index=0, Wrap=True)  # -> Item2, Item1, Item, Item1_2
replace_items = ReplaceItems(List=project_5.Geometry, Item=list_item_15.Item2, Indices="-1", Wrap=True)
replace_items_2 = ReplaceItems(List=replace_items, Item=list_item_15.Item1_2, Indices="0", Wrap=True)
angle_2 = Angle(VectorA=branch_4, VectorB=replace_items_2)  # -> Angle, Reflex
angle_3 = Angle(VectorA=unit_z, VectorB=replace_items_2)  # -> Angle, Reflex
merge_6 = Merge(Data1=simplify(angle_2.Angle), Data2=simplify(flatten))

# ---- group: Slope (continued)
deg_3 = Degrees(Radians=angle_3.Angle)

# ----
merge_7 = Merge(Data1=simplify(deg_3), Data2=simplify(flatten))

# ---- group: Critère local
rad = Radians(Degrees=merge_7)
sin = Sine(Value=merge_6)
division_12 = Division(A=filter_17, B=2)
multiplication_21 = Multiplication(A=vec2pt.Length, B=sin)
ratio_de_cordon_en_l_air = Slider(0.49, range=0..1)
addition_3 = Addition(A=division_12, B=multiplication_21)
division_13 = Division(A=addition_3, B=filter_15)
larger_19 = LargerThan(FirstNumber=division_13, SecondNumber=ratio_de_cordon_en_l_air)  # -> LargerThan, OrEqualTo
cull_8 = CullPattern(List=branch_3, CullPattern=larger_19.LargerThan)

# ----
list_item_16 = ListItem(List=flatten(cull_8), Index=0, Wrap=True)
null_item_10 = NullItem(Item=list_item_16)  # -> NullFlags, InvalidFlags, Description
stream_filter_22 = StreamFilter(Gate=null_item_10.NullFlags, Stream0=panel_14)

# ---- group: Flying points
max_slope_warning = Slider(45, range=0..100)
larger_than_6 = LargerThan(FirstNumber=merge_7, SecondNumber=max_slope_warning)  # -> LargerThan, OrEqualTo
cull_pattern_4 = CullPattern(List=deplane_2.Origin, CullPattern=larger_than_6.LargerThan)
list_item_17 = ListItem(List=flatten(cull_pattern_4), Index=0, Wrap=True)
null_item_11 = NullItem(Item=list_item_17)  # -> NullFlags, InvalidFlags, Description
stream_filter_23 = StreamFilter(Gate=null_item_11.NullFlags, Stream0="Some points have a high slope (>45°).")

# ---- group: Spread
etalement_min = Slider(10, range=0..100)
etalement_max = Slider(30, range=0..100)
dom = ConstructDomain(DomainStart=etalement_min, DomainEnd=etalement_max)
subtraction_12 = Subtraction(A=etalement_max, B=etalement_min)
range = Range(Domain=dom, Steps=subtraction_12)
expression_3 = Expression(x=range, Expression="1.565*x² - 83.534*x + 1142.6")
consec = ConsecutiveDomains(Numbers=expression_3, Additive=False)
consec_2 = ConsecutiveDomains(Numbers=range, Additive=False)
inc = Includes(Value=dedomain.Start, Domain=consec)  # -> Includes, Deviation
inc_2 = Includes(Value=dedomain.End, Domain=consec)  # -> Includes, Deviation
cull_9 = CullPattern(List=consec_2, CullPattern=inc.Includes)
cull_10 = CullPattern(List=consec_2, CullPattern=inc_2.Includes)
dedomain_7 = DeconstructDomain(Domain=cull_9)  # -> Start, End
dedomain_8 = DeconstructDomain(Domain=cull_10)  # -> Start, End

# ----
merge_8 = Merge(
    Data1=simplify(dedomain_7.Start),
    Data2=simplify(dedomain_7.End),
    Data3=simplify(dedomain_8.Start),
    Data4=simplify(dedomain_8.End))
sort_11 = SortList(Keys=merge_8)  # -> Keys, ValuesA
item_24 = ListItem(List=sort_11.Keys, Index=0, Wrap=True)  # -> Item1, Item
smaller_11 = SmallerThan(FirstNumber=item_24.Item, SecondNumber="15.9")  # -> SmallerThan, OrEqualTo
larger_20 = LargerThan(FirstNumber=item_24.Item1, SecondNumber="20.1")  # -> LargerThan, OrEqualTo

# ---- group: Spread (continued)
format_19 = Format(Format="Concrete target spread : {1:0} to {2:0} cm", Culture=127, Data1=item_24.Item, Data2=item_24.Item1)

# ----
or_10 = GateOr(A=smaller_11.SmallerThan, B=larger_20.LargerThan)
entwine_3 = Entwine(
    Branch00=format_6,
    Branch01=format_8,
    Branch02=format_7,
    Branch03=format_3,
    Branch04=concatenate,
    Branch05=concatenate_2,
    Branch06=format_5,
    Branch07=format_9,
    Branch08=filter_30,
    Branch09=filter_31,
    Branch010=format,
    Branch011=format_19,
    FlattenInputs=True)  # -> flatten(Result)
printing_info = Panel(entwine_3)
entwine_4 = Entwine(Branch01="-- Printing informations --", Branch02=entwine_3, FlattenInputs=True)
clean_all_3 = CleanAll(T=entwine_4)  # -> flatten(T_2)

# ---- group: Length
ma_5 = MassAddition(Input=len_2)  # -> Result, PartialResults
panel_41 = Panel("1000")

# ----
num_14 = Number(panel_41)

# ---- group: Length (continued)
division_14 = Division(A=ma_5.PartialResults, B=num_14)

# ---- group: Delta orientation
max_slope_warning_2 = Slider(11, range=0..100)
larger_than_7 = LargerThan(FirstNumber=angle_change, SecondNumber=max_slope_warning_2)  # -> LargerThan, OrEqualTo
cull_pattern_5 = CullPattern(List=pt_2, CullPattern=larger_than_7.LargerThan)
panel_42 = Panel("Head orientation changes too fast at some points (Δ>{0}°)")
list_item_18 = ListItem(List=flatten(cull_pattern_5), Index=0, Wrap=True)
null_item_12 = NullItem(Item=list_item_18)  # -> NullFlags, InvalidFlags, Description

# ----
format_20 = Format(Format=panel_42, Culture=127, Data0=max_slope_warning_2)

# ---- group: Delta orientation (continued)
stream_filter_24 = StreamFilter(Gate=null_item_12.NullFlags, Stream0=format_20)

# ---- group: First layer Height check
tree_branch_5 = TreeBranch(Tree=deplane.ZAxis, Path="0", MaintainPaths=True)
tree_branch_6 = TreeBranch(Tree=deplane.Origin, Path="0", MaintainPaths=True)
reverse = Reverse(Vector=tree_branch_5)
amplitude = Amplitude(Vector=reverse, Amplitude=tree_branch_4)
move_3 = Move(Geometry=tree_branch_6, Motion=amplitude)  # -> Geometry, Transform
plane_fit = PlaneFit(Points=move_3.Geometry)  # -> Plane, Deviation
panel_43 = Panel("""0
0.25
1
20""")
format_21 = Format(Format="{0:0.0}", Culture=127, Data0=plane_fit.Deviation)
consecutive_domains = ConsecutiveDomains(Numbers=panel_43, Additive=False)
includes_4 = Includes(Value=format_21, Domain=consecutive_domains)  # -> Includes, Deviation
list_length_10 = ListLength(List=consecutive_domains)
series_7 = Series(Start=0, Step=1, Count=list_length_10)
cull_pattern_6 = CullPattern(List=series_7, CullPattern=includes_4.Includes)
panel_44 = Panel("First layer heights & planes do not constitute a planar base (Δ = ")
concatenate_3 = Concatenate(Fragment_A=panel_44, A=format_21, Fragment_B=" mm)")
stream_filter_25 = StreamFilter(Gate=cull_pattern_6, Stream1=concatenate_3, Stream2=concatenate_3)

# ----
stream_filter_26 = StreamFilter(Gate=cull_pattern_6, Stream1=cull_pattern_6, Stream2=cull_pattern_6)

# ---- group: First layer Height check (continued)
fl_check_colour = Integer(stream_filter_26)

# ---- group: Warnings
# Contact points advices : print first the segments you dont want to move + overlap layer width using formula x = (1-pi/4)*H
subtraction_13 = Subtraction(A=filter_32, B=merge_7)
abs_5 = Absolute(Value=subtraction_13)
panel_45 = Panel("Contact points detected ! See them on 'Warnings' Preview mode")
null_10 = NullItem(Item=flatten(list_item_8))  # -> NullFlags, InvalidFlags, Description
item_25 = ListItem(List=null_10.NullFlags, Index=0, Wrap=True)
filter_47 = StreamFilter(Gate=item_25, Stream0=panel_45)
panel_46 = Panel(filter_47)
panel_47 = Panel("Slope detected, you should compensate layer widths regarding to the slope or orient plane normals.")

sort_12 = SortList(Keys=flatten(abs_5))  # -> Keys, ValuesA
item_26 = ListItem(List=sort_12.Keys, Index=0, Wrap=True)  # -> Item1, Item

# ----
format_22 = Format(Format="{0:0.0}", Culture=127, Data0=item_26.Item1)

# ---- group: Warnings (continued)
concat_15 = Concatenate(FragmentA="Planes orientations are not following the slope (Δmax = ", FragmentB=format_22, FragmentC="°).")
panel_48 = Panel(concat_15)

# ---- group: Height check
dprod = DotProduct(VectorA=replace_items_2, VectorB=branch_4, Unitize=False)
subtraction_14 = Subtraction(A=filter_44, B=dprod)
abs_6 = Absolute(Value=subtraction_14)
num_15 = Number("0.25")
larger_21 = LargerThan(FirstNumber=abs_6, SecondNumber=num_15)  # -> LargerThan, OrEqualTo
lng_10 = ListLength(List=flatten(abs_6))
sort_13 = SortList(Keys=flatten(abs_6))  # -> reverse(Keys), ValuesA
item_27 = ListItem(List=sort_13.Keys, Index=0, Wrap=True)
panel_49 = Panel("{0:0.0} % of layer heights do not match points position (Δmax = {1:0.0} mm)")

# ----
line = LineSDL(Start=branch_3, Direction=neg_2, Length=subtraction_14)  # disabled
cull_11 = CullPattern(List=abs_6, CullPattern=larger_21.LargerThan)
cull_12 = CullPattern(List=branch_3, CullPattern=larger_21.LargerThan)  # -> flatten(List)

# ---- group: Height check (continued)
lng_11 = ListLength(List=flatten(cull_11))
division_15 = Division(A=lng_11, B=lng_10)
multiplication_22 = Multiplication(A=division_15, B=100)
format_23 = Format(Format=panel_49, Culture=127, Data0=multiplication_22, Data1=item_27)
list_item_19 = ListItem(List=flatten(cull_11), Index=0, Wrap=True)
null_item_13 = NullItem(Item=list_item_19)  # -> NullFlags, InvalidFlags, Description
stream_filter_27 = StreamFilter(Gate=null_item_13.NullFlags, Stream0=format_23)

# ----
entwine_5 = Entwine(
    Branch00=object_name,
    Branch01=replace_paths,
    Branch02=list_length_2,
    Branch03=replace_paths_2,
    Branch04=replace_paths_3,
    Branch05=integer_2,
    Branch06=deplane.Origin,
    Branch07=pline_3,
    Branch08=list_length,
    Branch09=division_3,
    Branch010=merge_7,
    Branch011=deg,
    Branch012=accelerations_mm_s_2,
    Branch013=flow_rate_l_min,
    Branch014=renumber_paths_3,
    Branch015=renumber_paths_2,
    Branch016=cull_5,
    Branch017=list_item_8,
    Branch018=filter_33,
    Branch019=pt_5,
    Branch020=explode_2.Vertices,
    Branch021=cull_8,
    Branch022=cull_pattern_2,
    Branch023=cull_pattern_4,
    Branch024=cull_pattern_3,
    Branch025=cull_pattern_5,
    Branch026=cull_pattern,
    Branch027=cull_12,
    FlattenInputs=True)
entwine_6 = Entwine(
    Branch01=cull_5,
    Branch02=list_item_8,
    Branch03=pt_5,
    Branch04=explode_2.Vertices,
    Branch05=cull_8,
    Branch06=cull_pattern_2,
    Branch07=cull_pattern_4,
    Branch08=cull_pattern_3,
    Branch09=cull_pattern_5,
    Branch010=cull_pattern,
    Branch011=cull_12,
    FlattenInputs=True)
visualisation_data = ClusterOutput(entwine_5)
list_length_11 = ListLength(List=entwine_6)
larger_than_8 = LargerThan(FirstNumber=list_length_11, SecondNumber="0")  # -> LargerThan, OrEqualTo
mass_addition = MassAddition(Input=flatten(larger_than_8.LargerThan))  # -> Result, PartialResults

range_2 = Range(Domain=Domain(0, 1), Steps=mass_addition.Result)
cull_i_12 = CullIndex(List=range_2, Indices="0", Wrap=True)
gradient = Gradient(
    LowerLimit=0,
    UpperLimit=1,
    Parameter=cull_i_12,
    stops=[0: RGB(243, 57, 0), 0.1: RGB(236, 27, 60), 0.2: RGB(210, 0, 118), 0.3: RGB(103, 0, 120), 0.4: RGB(39, 72, 161), 0.5: RGB(1, 192, 229), 0.6: RGB(18, 178, 90), 0.7: RGB(79, 186, 8), 0.8: RGB(220, 237, 32), 0.9: RGB(247, 159, 20), 1: RGB(243, 57, 0)])

text_5 = Text(flatten(gradient))
text_6 = Text(flatten(gradient))
merge_9 = Merge(Data1=text_6, Data2=simplify(entwine_6))
list_length_12 = ListLength(List=merge_9)
warnings_keys_for_speckle = ClusterOutput(list_length_12)
warnings_for_speckle = ClusterOutput(merge_9)

# ---- group: Warnings
sort_14 = SortList(Keys=flatten(merge_7))  # -> Keys, ValuesA
item_28 = ListItem(List=sort_14.Keys, Index=0, Wrap=True)  # -> Item1, Item

format_24 = Format(Format="{0:0.0}", Culture=127, Data0=item_28.Item1)
larger_22 = LargerThan(FirstNumber=format_24, SecondNumber="10")  # -> LargerThan, OrEqualTo
larger_23 = LargerThan(FirstNumber=format_22, SecondNumber="0.1")  # -> LargerThan, OrEqualTo
larger_24 = LargerThan(FirstNumber=format_24, SecondNumber="40")  # -> LargerThan, OrEqualTo
larger_25 = LargerThan(FirstNumber=format_24, SecondNumber="30")  # -> LargerThan, OrEqualTo
multiplication_23 = Multiplication(A=larger_24.LargerThan, B=2)
list_item_20 = ListItem(List=flatten(item_28.Item1), Index=0, Wrap=True)
max_4 = Maximum(A=larger_25.LargerThan, B=multiplication_23)
null_item_14 = NullItem(Item=list_item_20)  # -> NullFlags, InvalidFlags, Description
filter_48 = StreamFilter(Gate=larger_23.LargerThan, Stream1=panel_48)  # disabled
stream_filter_28 = StreamFilter(Gate=null_item_14.NullFlags, Stream0=max_4)

# ----
null_item_15 = NullItem(Item=larger_22.LargerThan)  # -> NullFlags, InvalidFlags, Description
stream_filter_29 = StreamFilter(Gate=null_item_15.NullFlags, Stream0=larger_22.LargerThan, Stream1="0")

# ---- group: Warnings (continued)
concat_16 = Concatenate(FragmentA="Max slope : ", FragmentB=format_24, FragmentC="°")
panel_50 = Panel(concat_16)

# ----
gate_and_3 = GateAnd(A=fixed_width, B=stream_filter_29)

# ---- group: Warnings (continued)
filter_49 = StreamFilter(Gate=gate_and_3, Stream1=panel_47)
stream_filter_30 = StreamFilter(Gate=null_item_14.NullFlags, Stream0=panel_50)

# ---- group: Informations color
entwine_7 = Entwine(
    Branch00="0",
    Branch01="0",
    Branch02=stream_filter_11,
    Branch03=bool_2,
    Branch04=bool_3,
    Branch05=stream_filter_9,
    Branch06=stream_filter_14,
    Branch07=stream_filter_28,
    Branch08=stream_filter_20,
    FlattenInputs=True)  # -> simplify(Result)

# ---- group: Informations
entwine_8 = Entwine(
    Branch00="-- Object informations --",
    Branch01=filter_35,
    Branch02=filter_34,
    Branch03=panel_25,
    Branch04=panel_38,
    Branch05=panel_39,
    Branch06=filter_39,
    Branch07=stream_filter_13,
    Branch08=stream_filter_30,
    Branch09=stream_filter_19,
    FlattenInputs=True)  # -> simplify(Result)

# ----
clean_all_4 = CleanAll(T=entwine_7)  # -> flatten(T_2)
clean_all_5 = CleanAll(T=entwine_8)  # -> flatten(T_2)
list_length_13 = ListLength(List=filter_48)
list_length_14 = ListLength(List=filter_49)

# ---- group: Warnings
entwine_9 = Entwine(
    Branch01="-- Warnings --",
    Branch02=filter_20,
    Branch03=filter_48,
    Branch04=filter_49,
    Branch05=stream_filter_17,
    Branch06=stream_filter_6,
    Branch07=stream_filter_5,
    Branch08=stream_filter_15,
    Branch09=stream_filter_16,
    Branch010=filter_16,
    Branch011=stream_filter_25,
    Branch014=filter_37,
    Branch015=panel_46,
    Branch016=filter_42,
    Branch017=stream_filter_21,
    Branch018=stream_filter_22,
    Branch019=stream_filter_8,
    Branch020=stream_filter_23,
    Branch021=panel_33,
    Branch022=stream_filter_24,
    Branch023=stream_filter_4,
    Branch024=stream_filter_27,
    FlattenInputs=True)  # -> simplify(Result)

# ----
repeat_data_8 = RepeatData(Data=text_2, Length=list_length_13)
repeat_data_9 = RepeatData(Data=text_3, Length=list_length_14)

merge_10 = Merge(Data1=text_2, Data2=text_3, Data3=text_4)
item_29 = ListItem(List=merge_10, Index=clean_all_4, Wrap=True)

list_item_21 = ListItem(List=merge_10, Index=fl_check_colour, Wrap=True)
clean_all_6 = CleanAll(T=entwine_9)  # -> flatten(T_2)

# ---- group: Printing infos variable colors
item_30 = ListItem(List=merge_10, Index=larger_10.LargerThan, Wrap=True)
item_31 = ListItem(List=merge_10, Index=larger_11.LargerThan, Wrap=True)
item_32 = ListItem(List=merge_10, Index=larger_9.LargerThan, Wrap=True)
item_33 = ListItem(List=merge_10, Index=or_10, Wrap=True)
list_length_15 = ListLength(List=entwine_3)
merge_11 = Merge(Data1=flatten(item_30), Data2=flatten(item_31), Data3=flatten(item_32), Data4=flatten(item_33))
repeat_data_10 = RepeatData(Data=text_2, Length=list_length_15)
panel_51 = Panel("""3
8
9
11""")
replace = ReplaceItems(List=repeat_data_10, Item=merge_11, Indices=panel_51, Wrap=False)

# ---- group: Warinings color
entwine_10 = Entwine(
    Branch01=repeat_data_3,
    Branch04=repeat_data_8,
    Branch05=repeat_data_9,
    Branch07=repeat_data_7,
    Branch08=repeat_data_4,
    Branch09=repeat_data_2,
    Branch010=repeat_data_5,
    Branch011=repeat_data_6,
    Branch015=repeat_data,
    Branch017=list_item_21,
    Branch020=text_5,
    FlattenInputs=True)  # -> simplify(Result)

# ----
clean_all_7 = CleanAll(T=entwine_10)  # -> flatten(T_2)
merge_12 = Merge(
    Data1=flatten(clean_all),
    Data2=flatten(text),
    Data3=flatten(item_29),
    Data4=flatten(text_2),
    Data5=flatten(text),
    Data6=flatten(clean_all_7),
    Data7=flatten(text_2),
    Data8=flatten(text),
    Data9=flatten(replace))
merge_13 = Merge(Data1=clean_all_2, Data2=clean_all_5, Data3=clean_all_6, Data4=clean_all_3)
filter_50 = StreamFilter(Gate=or, Stream0=merge_12)
colours = Data(filter_50)
# -- BASE --
# 
# 
# Base name : base1500x1000_2
# 
# -- OBJECT GEOMETRY --
# 
# 
# Object name : Gaby02_47mmsec_7dLmin
# Variable width (28 - 38.8 mm)
# Variable height (5 - 12.5 mm)
# Number of layers : 134
# Number of object points : 3818
# Number of session points : 3822
# Total length : 76 m
# Material consumption : 19 L (44 kg)
# Premix quantity : 40 kg
# Closest points : 19 mm
# 
# -- SYSTEM CALCULATIONS --
# 
# 
# Flow rate : 0.7 L/min
# Total printing time : 0 h 28 min
# Nominal robot speed : 47 mm/s
# Robot speed range : 25 - 60 mm/s (53 - 128 %)
# Time between layers : 6.2 - 24.6 s
# Vertical speed : 37.2 mm/min (12.7 - 73 mm/min)
# 
# -- RAFT --
# 
# 
# No raft selected
colours_2 = ClusterOutput(colours)
tags = ClusterOutput(merge_13)

# ==== cluster CleanAll: Clean All
T = ClusterInput()
clean = CleanTree(RemoveNulls="True", RemoveInvalid="True", RemoveEmpty="True", Tree=T)
T_2 = ClusterOutput(clean)

# ==== cluster Cluster
relay = ClusterInput()
flatten = FlattenTree(Tree=relay, Path="{0}")
number_slider = Slider(20, range=0..100)
bnd = Bounds(Numbers=flatten)
num = Number(bnd)
dedomain = DeconstructDomain(Domain=bnd)  # -> Start, End
division = Division(A=num, B=number_slider)
series = Series(Start=dedomain.Start, Step=division, Count=number_slider)
consec = ConsecutiveDomains(Numbers=series, Additive=False)  # -> graft(Domains)
inc = Includes(Value=flatten, Domain=consec)  # -> Includes, Deviation
cull = CullPattern(List=flatten, CullPattern=inc.Includes)
lng = ListLength(List=cull)
sort_list = SortList(Keys=flatten(lng))  # -> reverse(Keys), ValuesValuesA
min = Slider(0.01, range=0..0.1)
list_item = ListItem(List=sort_list.Keys, Index=0, Wrap=True)
multiplication = Multiplication(A=list_item, B=min)
smaller = SmallerThan(FirstNumber=lng, SecondNumber=multiplication)  # -> SmallerThan, OrEqualTo
cull_2 = CullPattern(List=cull, CullPattern=invert(smaller.SmallerThan))
bounds = Bounds(Numbers=flatten(cull_2))
deconstruct_domain = DeconstructDomain(Domain=bounds)  # -> Start, End
maximum = Maximum(A=relay, B=deconstruct_domain.Start)
minimum = Minimum(A=maximum, B=deconstruct_domain.End)
result = ClusterOutput(minimum)

# ==== cluster RenumberPaths
data = ClusterInput()  # Data to renumber
tree_statistics = TreeStatistics(Tree=data)  # -> Paths, Length, Count
series = Series(Start=0, Step=1, Count=tree_statistics.Count)
replace_paths = ReplacePaths(Data=data, Search=tree_statistics.Paths, Replace=series)
renumbered_data = ClusterOutput(replace_paths)

# ==== cluster ToolpathObjectDecoderV002: Decodes the data from the Toolpath object.
reload = ClusterInput()
S = ClusterInput()
gate = StreamGate(Stream=S, Gate=reload)  # -> Target0, Target1
# Deserialize
dejson = DeserializeJson(JSON=gate.Target0, OutputsLocked=True)  # -> ObjectInfo, ToolpathDataRange, Toolpath
objectinfo = Data(dejson.ObjectInfo)
toolpathdatarange = Data(dejson.ToolpathDataRange)
dejsonkv = DeserializeKeysAndValues(JSON=dejson.Toolpath)  # -> Key, simplify(Value)
dejsonkv_2 = DeserializeKeysAndValues(JSON=objectinfo, Keys="Version")  # -> Key, simplify(Value); disabled
dejsonkv_3 = DeserializeKeysAndValues(JSON=objectinfo, Keys="ObjectVersion")  # -> Key, simplify(Value); disabled
dejsonkv_4 = DeserializeKeysAndValues(JSON=objectinfo, Keys="ProjectName")  # -> Key, simplify(Value); disabled
dejsonkv_5 = DeserializeKeysAndValues(JSON=objectinfo, Keys="ObjectName")  # -> Key, simplify(Value)
dejsonkv_6 = DeserializeKeysAndValues(JSON=objectinfo, Keys="Designer")  # -> Key, simplify(Value)
dejsonkv_7 = DeserializeKeysAndValues(JSON=objectinfo, Keys="ExportDate")  # -> Key, simplify(Value); disabled
dejsonkv_8 = DeserializeKeysAndValues(JSON=objectinfo, Keys="Observations")  # -> Key, simplify(Value); disabled
dejsonkv_9 = DeserializeKeysAndValues(JSON=objectinfo, Keys="ExportTime")  # -> Key, simplify(Value); disabled
dejsonkv_10 = DeserializeKeysAndValues(JSON=dejsonkv.Value, Keys="Positions")  # -> Key, simplify(Value)
dejsonkv_11 = DeserializeKeysAndValues(JSON=dejsonkv.Value, Keys="NormalVectors")  # -> Key, simplify(Value)
dejsonkv_12 = DeserializeKeysAndValues(JSON=dejsonkv.Value, Keys="LayerWidths")  # -> Key, simplify(Value)
dejsonkv_13 = DeserializeKeysAndValues(JSON=dejsonkv.Value, Keys="LayerHeights")  # -> Key, simplify(Value)
dejsonkv_14 = DeserializeKeysAndValues(JSON=dejsonkv.Value, Keys="Zones")  # -> Key, simplify(Value)
dejsonkv_15 = DeserializeKeysAndValues(JSON=dejsonkv.Value, Keys="MaterialFlowRates")  # -> Key, simplify(Value)
dejsonkv_16 = DeserializeKeysAndValues(JSON=dejsonkv.Value, Keys="PrimaryProportions")  # -> Key, simplify(Value)
dejsonkv_17 = DeserializeKeysAndValues(JSON=dejsonkv.Value, Keys="SecondaryProportions")  # -> Key, simplify(Value)
dejsonkv_18 = DeserializeKeysAndValues(JSON=toolpathdatarange, Keys="NormalVectors")  # -> Key, simplify(Value)
dejsonkv_19 = DeserializeKeysAndValues(JSON=toolpathdatarange, Keys="LayerWidths")  # -> Key, simplify(Value)
dejsonkv_20 = DeserializeKeysAndValues(JSON=toolpathdatarange, Keys="LayerHeights")  # -> Key, simplify(Value)
dejsonkv_21 = DeserializeKeysAndValues(JSON=toolpathdatarange, Keys="Zones")  # -> Key, simplify(Value)
dejsonkv_22 = DeserializeKeysAndValues(JSON=toolpathdatarange, Keys="MaterialFlowRates")  # -> Key, simplify(Value)
dejsonkv_23 = DeserializeKeysAndValues(JSON=toolpathdatarange, Keys="PrimaryProportions")  # -> Key, simplify(Value)
dejsonkv_24 = DeserializeKeysAndValues(JSON=toolpathdatarange, Keys="SecondaryProportions")  # -> Key, simplify(Value)
dejsonkv_25 = DeserializeKeysAndValues(JSON=objectinfo, Keys="LayerWidthsUnit")  # -> Key, simplify(Value)
dejsonkv_26 = DeserializeKeysAndValues(JSON=objectinfo, Keys="LayerHeightsUnit")  # -> Key, simplify(Value)
dejsonkv_27 = DeserializeKeysAndValues(JSON=objectinfo, Keys="ZonesUnit")  # -> Key, simplify(Value)
dejsonkv_28 = DeserializeKeysAndValues(JSON=objectinfo, Keys="MaterialFlowRatesUnit")  # -> Key, simplify(Value)
dejsonkv_29 = DeserializeKeysAndValues(JSON=objectinfo, Keys="PrimaryProportionsUnit")  # -> Key, simplify(Value)
dejsonkv_30 = DeserializeKeysAndValues(JSON=objectinfo, Keys="SecondaryProportionsUnit")  # -> Key, simplify(Value)
dejson_2 = DeserializeJson(JSON=dejsonkv_10.Value, OutputsLocked=False)  # -> simplify(Array)
dejson_3 = DeserializeJson(JSON=dejsonkv_11.Value, OutputsLocked=False)  # -> simplify(Array)
dejson_4 = DeserializeJson(JSON=dejsonkv_12.Value, OutputsLocked=False)  # -> simplify(Array)
dejson_5 = DeserializeJson(JSON=dejsonkv_13.Value, OutputsLocked=False)  # -> simplify(Array)
dejson_6 = DeserializeJson(JSON=dejsonkv_14.Value, OutputsLocked=False)  # -> simplify(Array)
dejson_7 = DeserializeJson(JSON=dejsonkv_15.Value, OutputsLocked=False)  # -> simplify(Array)
dejson_8 = DeserializeJson(JSON=dejsonkv_16.Value, OutputsLocked=False)  # -> simplify(Array)
dejson_9 = DeserializeJson(JSON=dejsonkv_17.Value, OutputsLocked=False)  # -> simplify(Array)
entwine = Entwine(
    Branch00=dejsonkv_18.Key,
    Branch01=dejsonkv_19.Key,
    Branch02=dejsonkv_20.Key,
    Branch03=dejsonkv_21.Key,
    Branch04=dejsonkv_22.Key,
    Branch05=dejsonkv_23.Key,
    Branch06=dejsonkv_24.Key,
    FlattenInputs=True)  # -> simplify(Result); disabled
entwine_2 = Entwine(
    Branch00=dejsonkv_18.Value,
    Branch01=dejsonkv_19.Value,
    Branch02=dejsonkv_20.Value,
    Branch03=dejsonkv_21.Value,
    Branch04=dejsonkv_22.Value,
    Branch05=dejsonkv_23.Value,
    Branch06=dejsonkv_24.Value,
    FlattenInputs=True)  # -> simplify(Result); disabled
entwine_3 = Entwine(
    Branch01=dejsonkv_25.Value,
    Branch02=dejsonkv_26.Value,
    Branch03=dejsonkv_27.Value,
    Branch04=dejsonkv_28.Value,
    Branch05=dejsonkv_29.Value,
    Branch06=dejsonkv_30.Value,
    FlattenInputs=True)  # -> simplify(Result); disabled
panel = Panel("{0} at {1}")  # disabled
keynames = Text(entwine)  # disabled
datarange = Text(entwine_2)  # disabled
dataunits = Text(entwine_3)  # disabled
projectname = Text(dejsonkv_4.Value)  # disabled
objectname = Text(dejsonkv_5.Value)
designer = Text(dejsonkv_6.Value)
c_script = CSharpScript(rValue=simplify(dejson_4), Nominal=simplify(dejsonkv_19.Value))  # -> out, simplify(Value); inputs rValue: tree
# ---------- c_script: C# ----------
    DataTree<double> Converted = new DataTree<double>();

    if (rValue.Branch(0).Count == 0)
    {
      Value = Convert.ToString(Nominal);
    }
    else {
      for(int i = 0; i < rValue.BranchCount ;i++)
      {
        for(int j = 0; j < rValue.Branch(i).Count;j++)
          Converted.Add(Convert.ToDouble(rValue.Branch(i)[j]), new GH_Path(i));
      }
      Value = Converted;
    }
# ---------- end c_script ----------
c_script_2 = CSharpScript(rValue=simplify(dejson_5), Nominal=simplify(dejsonkv_20.Value))  # -> out, simplify(Value); inputs rValue: tree; same code as c_script
c_script_3 = CSharpScript(rValue=simplify(dejson_6), Nominal=simplify(dejsonkv_21.Value))  # -> out, simplify(Value); inputs rValue: tree
# ---------- c_script_3: C# ----------
    if (rValue.Branch(0).Count == 0)
    {
      Value = Nominal;
    }
    else {

      Value = rValue;
    }
# ---------- end c_script_3 ----------

c_script_4 = CSharpScript(rValue=simplify(dejson_7), Nominal=simplify(dejsonkv_22.Value))  # -> out, simplify(Value); inputs rValue: tree; same code as c_script
c_script_5 = CSharpScript(rValue=simplify(dejson_8), Nominal=simplify(dejsonkv_23.Value))  # -> out, simplify(Value); inputs rValue: tree; same code as c_script
c_script_6 = CSharpScript(rValue=simplify(dejson_9), Nominal=simplify(dejsonkv_24.Value))  # -> out, simplify(Value); inputs rValue: tree; same code as c_script

c_script_7 = CSharpScript(O=dejson_2, N=dejson_3, Nominal=dejsonkv_18.Value)  # -> out, simplify(Value); inputs O: tree, N: tree
# ---------- c_script_7: C# ----------
    DataTree<Plane> Planes = new DataTree<Plane>();

    if (N.Branch(0).Count == 0){
      for(int i = 0; i < O.BranchCount ;i++)
      {
        for(int j = 0; j < O.Branch(i).Count;j++)
          Planes.Add(new Plane(StringToPoint(O.Branch(i)[j]), StringToVector(Nominal)), new GH_Path(i));
      }
    }

    if (N.Branch(0).Count != 0){
      for(int i = 0; i < O.BranchCount ;i++)
      {
        for(int j = 0; j < O.Branch(i).Count;j++)
          Planes.Add(new Plane(StringToPoint(O.Branch(i)[j]), StringToVector(N.Branch(i)[j])), new GH_Path(i));
      }
    }

    Value = Planes;
# ---------- c_script_7: C# additional code ----------
  private Point3d StringToPoint(object s){
    string[] strlist1 = Convert.ToString(s).Split(',');

    double X = Convert.ToDouble(strlist1[0]);
    double Y = Convert.ToDouble(strlist1[1]);
    double Z = Convert.ToDouble(strlist1[2]);
    Point3d myPoint = new Point3d(X, Y, Z);
    return myPoint;
  }

  private Vector3d StringToVector(object s){
    string[] strlist1 = Convert.ToString(s).Split(',');

    double X = Convert.ToDouble(strlist1[0]);
    double Y = Convert.ToDouble(strlist1[1]);
    double Z = Convert.ToDouble(strlist1[2]);
    Vector3d vectorN = new Vector3d(X, Y, Z);
    return vectorN;
  }
# ---------- end c_script_7 ----------
null = NullItem(Item=dejsonkv_7.Value)  # -> NullFlags, InvalidFlags, Description; disabled
format = Format(Format=panel, Culture=127, Data0=dejsonkv_7.Value, Data1=dejsonkv_9.Value)  # disabled
panel_2 = Panel("Never")  # disabled
projectname_2 = ClusterOutput(projectname)  # disabled
objectname_2 = ClusterOutput(objectname)
designer_2 = ClusterOutput(designer)
filter = StreamFilter(Gate=null.NullFlags, Stream0=format, Stream1=panel_2)  # disabled
planes = ClusterOutput(c_script_7.Value)
layer_widths = ClusterOutput(c_script.Value)
layer_heights = ClusterOutput(c_script_2.Value)
zones = ClusterOutput(c_script_3.Value)  # Zones
flow_rate = ClusterOutput(c_script_4.Value)
primary_proportion = ClusterOutput(c_script_5.Value)
secondary_proportion = ClusterOutput(c_script_6.Value)
x = ClusterOutput()
format_2 = Format(Format="{0} : {1} {2}", Culture=127, Data0=keynames, Data1=datarange, Data2=dataunits)  # -> flatten(Text); disabled
panel_3 = Panel("{0} : {1} {2}")
panel_4 = Panel(format_2)

panel_5 = Panel(" v")  # disabled
concat = Concatenate(FragmentA=dejsonkv_5.Value, FragmentB=panel_5, FragmentC=dejsonkv_3.Value)  # disabled
panel_6 = Panel("""Encoding version
Project
Object
Created by
Observations
Exported on""")  # disabled
entwine_4 = Entwine(
    Branch00=dejsonkv_2.Value,
    Branch01=dejsonkv_4.Value,
    Branch02=concat,
    Branch03=dejsonkv_6.Value,
    Branch04=dejsonkv_8.Value,
    Branch05=filter,
    FlattenInputs=True)  # -> simplify(flatten(Result)); disabled
panel_7 = Panel(": ")  # disabled
concat_2 = Concatenate(FragmentA=panel_6, FragmentB=panel_7, FragmentC=entwine_4)  # disabled
object_info = Text(flatten(concat_2))  # disabled

entwine_5 = Entwine(Branch00=object_info, Branch01=format_2, FlattenInputs=True)  # -> flatten(Result); disabled

object_info_2 = ClusterOutput(entwine_5)  # disabled
